# Grasshopper definition 27092024_Konstantina_digital_slat.gh (Grasshopper 1.0.8)
# plug-ins: RhinoCodePluginGH

# ----
# Slat Dimensions
number_of_horizontal_sections = Slider(7, range=0..100)
middle_part = Slider(100, range=0..1000)

# ----
# Original Cross Section
width = Slider(46, range=0..100)
length = Slider(4, range=0..100)

modifying_factor = Slider(6, range=0..100)

# ----
# in Centimeters
# FINAL
number_slider = Slider(30, range=1..30)
data = Data(modifying_factor)
neg = Negative(Value=data)

# ----
# origin point / slat position
y = Slider(0, range=0..100)

# ----
# Slats
transformation_factor = Slider(17, range=0..30)

# ----
# Slat Properties
cross_section_width = Slider(21, range=0..100)
cross_section_length = Slider(3, range=0..100)
number_of_horizontal_sections_2 = Slider(7, range=0..100)
middle_part_2 = Slider(100, range=0..1000)
x_axis_scale = Slider(4, range=0..100)

# ----
# origin point
number_slider_2 = Slider(0, range=0..100)
y_2 = Slider(0, range=0..100)

# ----
# Slat Dimensions
number_of_horizontal_sections_3 = Slider(7, range=0..100)
slat_height = Slider(200, range=0..1000)

# ----
# Original Cross Section
length_2 = Slider(4, range=0..100)
width_2 = Slider(46, range=0..100)

modifying_factor_2 = Slider(6, range=0..100)

# ----
# Slat Dimensions
number_of_horizontal_sections_4 = Slider(7, range=0..100)
slat_height_2 = Slider(200, range=0..1000)

modifying_factor_3 = Slider(14, range=0..100)

# ----
# Slat Dimensions
number_of_horizontal_sections_5 = Slider(7, range=0..100)
middle_part_3 = Slider(100, range=0..1000)

# ----
# Original Cross Section
length_3 = Slider(4, range=0..100)
width_3 = Slider(46, range=0..100)

# ----
# Original Cross Section
length_4 = Slider(4, range=0..100)
width_4 = Slider(46, range=0..100)

# ----
# origin point / slat position
y_3 = Slider(0, range=0..100)
number_slider_3 = Slider(0, range=0..100)

modifying_factor_4 = Slider(6, range=0..100)

# ----
# origin point / slat position
y_4 = Slider(0, range=0..100)
number_slider_4 = Slider(0, range=0..100)

# ----
# origin point / slat position
y_5 = Slider(0, range=0..100)
number_slider_5 = Slider(0, range=0..100)

# ----
# List of Points
ipy2 = IronPython2Script(x=number_slider_3, y=y_3, number=number_of_horizontal_sections_3, slat_height=slat_height)  # -> points, vertical_factor; inputs y: Int32, number: Int32, slat_height: Double
# ---------- ipy2: IronPython ----------
import Rhino.Geometry as rg


vertical_factor = slat_height // number

points = []
for i in range(number):
    if i !=0 :
       point = rg.Point3d(x,y,i * vertical_factor)
       points.append(point)
    else :
       point = rg.Point3d(x,y,i)
       points.append(point) 

#points.pop(0)
# ---------- end ipy2 ----------

# ----
# List of Points
ipy2_2 = IronPython2Script(x=number_slider_4, y=y_4, number=number_of_horizontal_sections_4, slat_height=slat_height_2)  # -> out, points, vertical_factor; inputs number: Int32, slat_height: Double; same code as ipy2

# ----
# modified cross section
ipy2_3 = IronPython2Script(
    y=y,
    x=Slider(0, range=0..100),
    number=number_of_horizontal_sections,
    width=width,
    length=length,
    to_min=data,
    to_max=neg,
    opening_factor=Slider(7, range=1..20),
    slat_height=middle_part,
    number_of_slats=number_slider)  # -> extruded_surface_1, extruded_surface_2, points_y, slats, loft, merged_brep_2; inputs number: Int32, opening_factor: Int32, number_of_slats: Int32
# ---------- ipy2_3: IronPython ----------
import Rhino.Geometry as rg
import Rhino
import System.Guid

###################################################
# Create Points
###################################################

vertical_factor = slat_height // number

points = []
for i in range(number):
    if i !=0 :
       point = rg.Point3d(x,y,i * vertical_factor)
       points.append(point)
    else :
       point = rg.Point3d(x,y,i)
       points.append(point) 


###################################################
# Create Rectangles
###################################################


vector = rg.Vector3d.ZAxis

planes = []
for i in range(number):
    pln = rg.Plane(points[i],vector)
    planes.append(pln)


#rectangle around a central point
width_interval = rg.Interval(-width/2, width/2)
length_interval = rg.Interval(-length/2, length/2)

rectangles = []
for i in planes :
    rectangle = rg.Rectangle3d(i,width_interval,length_interval)
    rectangles.append(rectangle)

##################################################
# Modify Rectangles
##################################################

#we want to constrain within a width to a given range
from_min = -width/2 * len(planes)
from_max = width/2 * len(planes)


#remap function
def remap(value, from_min, from_max, to_min, to_max):
    # Calculate the proportion of the value within the original range
    proportion = (value - from_min) / (from_max - from_min)
    # Map the value to the target range using the proportion
    remapped_value = to_min + (proportion * (to_max - to_min))
    return remapped_value

factor = 2

remapped_height = remap(slat_height,0,slat_height,0,100)

print(remapped_height)
print(slat_height)

modified_rectangles = []

for index, pln in enumerate(planes):
  if len(planes) / opening_factor < (index * 0.5) :
     remapped_interval_0 = remap(-width/factor*index, from_min, from_max, to_min, to_max)
     remapped_interval_1 = remap(width/factor*index, from_min, from_max, to_min, to_max)
     width_interval = rg.Interval(remapped_interval_0, remapped_interval_1)

     length_interval = rg.Interval(-length/2, length/2)
     rectangle = rg.Rectangle3d(pln,width_interval,length_interval)
     modified_rectangles.append(rectangle)
  else :
     remapped_interval_0 = remap(-width/factor * (len(planes)-index), from_min, from_max, to_min, to_max)
     remapped_interval_1 = remap(width/factor * (len(planes)-index), from_min, from_max, to_min, to_max)
     width_interval = rg.Interval(remapped_interval_0, remapped_interval_1)

     length_interval = rg.Interval(-length/2, length/2)
     rectangle = rg.Rectangle3d(pln,width_interval,length_interval)
     modified_rectangles.append(rectangle)


#################################################
#Loft Middle Part Rectangles
#################################################

def loft_function(rectangles):
   
    curves = []
    for rect in rectangles:
        polyline = rect.ToPolyline()  
        polyline_curve = rg.PolylineCurve(polyline)  
        curves.append(polyline_curve)  
        

    #  CreateFromLoft method
    loft = rg.Brep.CreateFromLoft(curves, rg.Point3d.Unset, rg.Point3d.Unset, rg.LoftType.Normal, False)

    return loft[0]
    
loft = loft_function(modified_rectangles)


#################################################
# Extrude Base and Top Part
#################################################

# rectangles3D to Curves
rect =  modified_rectangles[0].ToNurbsCurve()
# Extrude to Base
vector = rg.Vector3d(0,0,-50)
extruded_surface_1 = rg.Surface.CreateExtrusion(rect, vector)
extruded_surface_1 = rg.Brep.CreateFromSurface(extruded_surface_1)

# rectangles3D to Curves
rect =  modified_rectangles[-1].ToNurbsCurve()
# Extrude to top
vector = rg.Vector3d(0,0,50)
extruded_surface_2 = rg.Surface.CreateExtrusion(rect, vector)
extruded_surface_2 = rg.Brep.CreateFromSurface(extruded_surface_2)


##################################################
# Move brep / Merge Breps
##################################################

# print(type(merged_brep)) > ArrayBrep
# Join Brep returns a list of breps not one brep !

vector = rg.Vector3d(0,0,50)
translation_transform = rg.Transform.Translation(vector)
loft.Transform(translation_transform)
extruded_surface_1.Transform(translation_transform)
extruded_surface_2.Transform(translation_transform)

list_of_breps = [loft,extruded_surface_1, extruded_surface_2]
merged_brep = rg.Brep.JoinBreps(list_of_breps,0.001 , 0.01) #list of breps, tolerance, angle tolerance, index Map


#################################################
# Generate a Number of Slats
#################################################

points_y = []
slats = []

for i in range(number_of_slats):
    point = rg.Point3d(x,i * 10,0)
    points_y.append(point) 

    vector = rg.Vector3d(0,i * 10,0)
    translation_transform = rg.Transform.Translation(vector)

    moved_slats = merged_brep[0].Duplicate()
    moved_slats.Transform(translation_transform)
    
    slats.append(moved_slats)
# ---------- end ipy2_3 ----------

geo = Geometry(ipy2_3.slats)

# ---- group: Closed Brep
cap = CapHoles(Brep=geo)

# ----
preview = CustomPreview(Geometry=cap, Material=ColourSwatch(SwatchColor=RGB(139, 95, 255)))

# ----
# Slats
transformation_factor_2 = Slider(17, range=0..30)

# ----
# Slat Properties
cross_section_width_2 = Slider(56, range=0..100)
cross_section_length_2 = Slider(3, range=0..100)
number_of_horizontal_sections_6 = Slider(7, range=0..100)
middle_part_4 = Slider(100, range=0..1000)
x_axis_scale_2 = Slider(4, range=0..100)

# ----
# origin point
number_slider_6 = Slider(0, range=0..100)
y_6 = Slider(0, range=0..100)

# ----
# in Centimeters
number_slider_7 = Slider(30, range=1..30)
pt = Point(ipy2.points)
panel = Panel(ipy2.vertical_factor)
data_2 = Data(modifying_factor_2)
data_3 = Data(number_of_horizontal_sections_3)
neg_2 = Negative(Value=data_2)

# ----
# Rectangles List
ipy2_4 = IronPython2Script(x=number_slider_3, y=y_3, width=width_2, length=length_2, points=pt, number=number_of_horizontal_sections_3)  # -> planes, rectangles; inputs width: Int32, length: Int32, points: list of Point3d, number: Int32
# ---------- ipy2_4: IronPython ----------
import Rhino.Geometry as rg

#value_x = point.x
#print(value_x)

#getting the default z axis - 2 ways

vector = rg.Vector3d(0,0,1)
vector = rg.Vector3d.ZAxis

xax = rg.Vector3d.XAxis
yax = rg.Vector3d.YAxis

#pln = rg.Plane(points,vector) #creating a plane with only the z direction
#pln = rg.Plane(points, xax, yax) #creating a plane with x and y direction

planes = []
for i in range(number):
    pln = rg.Plane(points[i],vector)
    planes.append(pln)

#print(planes)
#rectangle = rg.Rectangle3d(pln,width,length)

#rectangle around a central point
width_interval = rg.Interval(-width/2, width/2)
length_interval = rg.Interval(-length/2, length/2)

rectangles = []
for i in planes :
    rectangle = rg.Rectangle3d(i,width_interval,length_interval)
    rectangles.append(rectangle)

print(len(rectangles))
# ---------- end ipy2_4 ----------

# ----
# in Centimeters
number_slider_8 = Slider(30, range=1..30)
data_4 = Data(modifying_factor_4)
neg_3 = Negative(Value=data_4)

# ----
# modified cross section
ipy2_5 = IronPython2Script(
    y=y_5,
    x=number_slider_5,
    number=number_of_horizontal_sections_5,
    width=width_3,
    length=length_3,
    to_min=data_4,
    to_max=neg_3,
    opening_factor=Slider(7, range=1..20),
    slat_height=middle_part_3)  # -> modified_rectangles, loft, d, extruded_surface; inputs number: Int32, opening_factor: Int32
# ---------- ipy2_5: IronPython ----------
import Rhino.Geometry as rg
import Rhino
import System.Guid


# Create Points
#___________________________________________________

vertical_factor = slat_height // number

points = []
for i in range(number):
    if i !=0 :
       point = rg.Point3d(x,y,i * vertical_factor)
       points.append(point)
    else :
       point = rg.Point3d(x,y,i)
       points.append(point) 


# Create Rectangles
#___________________________________________________


vector = rg.Vector3d.ZAxis

planes = []
for i in range(number):
    pln = rg.Plane(points[i],vector)
    planes.append(pln)


#rectangle around a central point
width_interval = rg.Interval(-width/2, width/2)
length_interval = rg.Interval(-length/2, length/2)

rectangles = []
for i in planes :
    rectangle = rg.Rectangle3d(i,width_interval,length_interval)
    rectangles.append(rectangle)

# Modify Rectangles
#___________________________________________________

#we want to constrain within a width to a given range
from_min = -width/2 * len(planes)
from_max = width/2 * len(planes)


#remap function
def remap(value, from_min, from_max, to_min, to_max):
    # Calculate the proportion of the value within the original range
    proportion = (value - from_min) / (from_max - from_min)
    # Map the value to the target range using the proportion
    remapped_value = to_min + (proportion * (to_max - to_min))
    return remapped_value

factor = 2

remapped_height = remap(slat_height,0,slat_height,0,100)

print(remapped_height)
print(slat_height)

modified_rectangles = []

for index, pln in enumerate(planes):
  if len(planes) / opening_factor < (index * 0.5) :
     remapped_interval_0 = remap(-width/factor*index, from_min, from_max, to_min, to_max)
     remapped_interval_1 = remap(width/factor*index, from_min, from_max, to_min, to_max)
     width_interval = rg.Interval(remapped_interval_0, remapped_interval_1)

     length_interval = rg.Interval(-length/2, length/2)
     rectangle = rg.Rectangle3d(pln,width_interval,length_interval)
     modified_rectangles.append(rectangle)
  else :
     remapped_interval_0 = remap(-width/factor * (len(planes)-index), from_min, from_max, to_min, to_max)
     remapped_interval_1 = remap(width/factor * (len(planes)-index), from_min, from_max, to_min, to_max)
     width_interval = rg.Interval(remapped_interval_0, remapped_interval_1)

     length_interval = rg.Interval(-length/2, length/2)
     rectangle = rg.Rectangle3d(pln,width_interval,length_interval)
     modified_rectangles.append(rectangle)

# Base 
#________________________________________

# rectangles3D to Curves
rect =  modified_rectangles[0].ToNurbsCurve()
# Extrude to Base
vector = rg.Vector3d(0,0,50)
extruded_surface = rg.Surface.CreateExtrusion(rect, vector)


# rectangles3D to Curves
rect =  modified_rectangles[-1].ToNurbsCurve()
# Extrude to top
vector = rg.Vector3d(0,0,200)
extruded_surface = rg.Surface.CreateExtrusion(rect, vector)


# Loft Middle Part Rectangles
#________________________________________

def loft_function(rectangles):
   
    curves = []
    for rect in rectangles:
        polyline = rect.ToPolyline()  
        polyline_curve = rg.PolylineCurve(polyline)  
        curves.append(polyline_curve)  
        

    #  CreateFromLoft method
    loft = rg.Brep.CreateFromLoft(curves, rg.Point3d.Unset, rg.Point3d.Unset, rg.LoftType.Normal, False)

    return loft[0]
    
loft = loft_function(modified_rectangles)

#______________________________________________
# ---------- end ipy2_5 ----------

geo_2 = Geometry(ipy2_5.extruded_surface)

# ---- group: Closed Brep
cap_2 = CapHoles(Brep=ipy2_5.loft)

# ----
preview_2 = CustomPreview(Geometry=cap_2, Material=ColourSwatch(SwatchColor=RGB(139, 95, 190)))

cap_3 = CapHoles(Brep=cap_2)

# ----
# dublicate slats
ipy2_6 = IronPython2Script(x=number_slider_5, y=y_5, slat=cap_3, number_of_slats=number_slider_8)  # -> points_y, slats, middle_slats; inputs x: Int32, y: Int32, slat: Brep, number_of_slats: Int32
# ---------- ipy2_6: IronPython ----------
import Rhino.Geometry as rg
import Rhino

points_y = []
slats = []

for i in range(number_of_slats):
    point = rg.Point3d(x,i * 10,0)
    points_y.append(point) 

    vector = rg.Vector3d(0,i * 10,0)
    translation_transform = rg.Transform.Translation(vector)

    moved_slat = slat.Duplicate()
    moved_slat.Transform(translation_transform)
    
    slats.append(moved_slat)

# Move slat middle part
#___________________________________

middle_slats = []
for i in range(number_of_slats):
    vector = rg.Vector3d(0,i,50)
    translation_transform = rg.Transform.Translation(vector)
    slats[i].Transform(translation_transform)
    middle_slats.append(slats)
# ---------- end ipy2_6 ----------

pt_2 = Point(ipy2_6.points_y)
panel_2 = Panel(ipy2_6.middle_slats)

geo_3 = Geometry(ipy2_6.slats)

# ----
# Original Cross Section
# ! in Centimeters
data_5 = Data(x_axis_scale)
neg_4 = Negative(Value=data_5)
ipy2_7 = IronPython2Script(
    y=y_2,
    x=number_slider_2,
    number=number_of_horizontal_sections_2,
    width=cross_section_width,
    length=cross_section_length,
    to_min=data_5,
    to_max=neg_4,
    opening_factor="7",
    slat_height=middle_part_2,
    number_of_slats=Slider(30, range=1..50),
    k=transformation_factor)  # -> extruded_surface_1, extruded_surface_2, slats, loft, merged_brep_2; inputs number: Int32, opening_factor: Int32, number_of_slats: Int32
# ---------- ipy2_7: IronPython ----------
import Rhino.Geometry as rg
import Rhino
import System.Guid
import math

###################################################
# Create Points
###################################################


vertical_factor = slat_height // number

points = []
for i in range(number):
    if i !=0 :
       point = rg.Point3d(x,y,i * vertical_factor)
       points.append(point)
    else :
       point = rg.Point3d(x,y,i)
       points.append(point) 


###################################################
# Create Rectangles
###################################################


vector = rg.Vector3d.ZAxis

planes = []
for i in range(number):
    pln = rg.Plane(points[i],vector)
    planes.append(pln)


#rectangle around a central point
width_interval = rg.Interval(-width/2, width/2)
length_interval = rg.Interval(-length/2, length/2)

rectangles = []
for i in planes :
    rectangle = rg.Rectangle3d(i,width_interval,length_interval)
    rectangles.append(rectangle)

##################################################
# Modify Rectangles
##################################################

#we want to constrain within a width to a given range
from_min = -width/2 * len(planes)
from_max = width/2 * len(planes)


#remap function
def remap(value, from_min, from_max, to_min, to_max):
    # Calculate the proportion of the value within the original range
    proportion = (value - from_min) / (from_max - from_min)
    # Map the value to the target range using the proportion
    remapped_value = to_min + (proportion * (to_max - to_min))
    return remapped_value

factor = 1.5

remapped_height = remap(slat_height,0,slat_height,0,100)

print(remapped_height)
print(slat_height)

modified_rectangles = []

for index, pln in enumerate(planes):
  if len(planes) / opening_factor < (index * 0.5) :
     remapped_interval_0 = remap(-width/factor*index, from_min, from_max, to_min, to_max)
     remapped_interval_1 = remap(width/factor*index, from_min, from_max, to_min, to_max)
     width_interval = rg.Interval(remapped_interval_0, remapped_interval_1)

     length_interval = rg.Interval(-length/2, length/2)
     rectangle = rg.Rectangle3d(pln,width_interval,length_interval)
     modified_rectangles.append(rectangle)
  else :
     remapped_interval_0 = remap(-width/factor * (len(planes)-index), from_min, from_max, to_min, to_max)
     remapped_interval_1 = remap(width/factor * (len(planes)-index), from_min, from_max, to_min, to_max)
     width_interval = rg.Interval(remapped_interval_0, remapped_interval_1)

     length_interval = rg.Interval(-length/2, length/2)
     rectangle = rg.Rectangle3d(pln,width_interval,length_interval)
     modified_rectangles.append(rectangle)


#################################################
#Loft Middle Part Rectangles
#################################################

def loft_function(rectangles):
   
    curves = []
    for rect in rectangles:
        polyline = rect.ToPolyline()  
        polyline_curve = rg.PolylineCurve(polyline)  
        curves.append(polyline_curve)  
        

    #  CreateFromLoft method
    loft = rg.Brep.CreateFromLoft(curves, rg.Point3d.Unset, rg.Point3d.Unset, rg.LoftType.Normal, False)

    return loft[0]
    
loft = loft_function(modified_rectangles)


#################################################
# Extrude Base and Top Part
#################################################

# rectangles3D to Curves
rect =  modified_rectangles[0].ToNurbsCurve()
# Extrude to Base
vector = rg.Vector3d(0,0,-50)
extruded_surface_1 = rg.Surface.CreateExtrusion(rect, vector)
extruded_surface_1 = rg.Brep.CreateFromSurface(extruded_surface_1)

# rectangles3D to Curves
rect =  modified_rectangles[-1].ToNurbsCurve()
# Extrude to top
vector = rg.Vector3d(0,0,50)
extruded_surface_2 = rg.Surface.CreateExtrusion(rect, vector)
extruded_surface_2 = rg.Brep.CreateFromSurface(extruded_surface_2)


##################################################
# Move brep / Merge Breps
##################################################

# print(type(merged_brep)) > ArrayBrep
# Join Brep returns a list of breps not one brep !


vector = rg.Vector3d(0,0,50)
translation_transform = rg.Transform.Translation(vector)
loft.Transform(translation_transform)
extruded_surface_1.Transform(translation_transform)
extruded_surface_2.Transform(translation_transform)

list_of_breps = [loft,extruded_surface_1, extruded_surface_2]
merged_brep = rg.Brep.JoinBreps(list_of_breps,0.001 , 0.01) #list of breps, tolerance, angle tolerance, index Map


#################################################
# Generate a Number of Slats
#################################################


slats = []
f= 10 # factor for distanse between slabs
#k factor for transformation in slats

for i in range(number_of_slats):
    vector = rg.Vector3d(0,i * f, math.sin(i) * k)
    translation_transform = rg.Transform.Translation(vector)

    moved_slats = merged_brep[0].Duplicate()
    moved_slats.Transform(translation_transform)
    
    slats.append(moved_slats)
# ---------- end ipy2_7 ----------

# ---- group: Closed Brep
cap_4 = CapHoles(Brep=ipy2_7.slats)

# ----
preview_3 = CustomPreview(Geometry=cap_4, Material=ColourSwatch(SwatchColor=RGB(170, 153, 196)))

# ----
# in Centimeters
panel_3 = Panel(ipy2_2.vertical_factor)
pt_3 = Point(ipy2_2.points)
data_6 = Data(number_of_horizontal_sections_4)
data_7 = Data(modifying_factor_3)
neg_5 = Negative(Value=data_7)

# ----
# Rectangles List
ipy2_8 = IronPython2Script(x=number_slider_4, y=y_4, width=width_4, length=length_4, points=pt_3, number=number_of_horizontal_sections_4)  # -> planes, rectangles; inputs width: Int32, length: Int32, points: list of Point3d, number: Int32; same code as ipy2_4

data_8 = Data(ipy2_4.rectangles)

# ----
# modified cross section
ipy2_9 = IronPython2Script(
    rectangles=data_8,
    number=data_3,
    planes=ipy2_4.planes,
    width=width_2,
    length=length_2,
    to_min=data_2,
    to_max=neg_2,
    opening_factor=Slider(6, range=1..20),
    slat_height=slat_height)  # -> out, modified_rectangles; inputs rectangles: list, planes: list, opening_factor: Int32
# ---------- ipy2_9: IronPython ----------
import Rhino.Geometry as rg

#we want to constrain within a width to a given range
from_min = -width/2 * len(planes)
from_max = width/2 * len(planes)


#remap function
def remap(value, from_min, from_max, to_min, to_max):
    # Calculate the proportion of the value within the original range
    proportion = (value - from_min) / (from_max - from_min)
    # Map the value to the target range using the proportion
    remapped_value = to_min + (proportion * (to_max - to_min))
    return remapped_value

factor = 2

remapped_height = remap(slat_height,0,slat_height,0,100)

print(remapped_height)
print(slat_height)

modified_rectangles = []

for index, pln in enumerate(planes):
  if len(planes) / opening_factor < (index * 0.5) :
     remapped_interval_0 = remap(-width/factor*index, from_min, from_max, to_min, to_max)
     remapped_interval_1 = remap(width/factor*index, from_min, from_max, to_min, to_max)
     width_interval = rg.Interval(remapped_interval_0, remapped_interval_1)

     length_interval = rg.Interval(-length/2, length/2)
     rectangle = rg.Rectangle3d(pln,width_interval,length_interval)
     modified_rectangles.append(rectangle)
  else :
     remapped_interval_0 = remap(-width/factor * (len(planes)-index), from_min, from_max, to_min, to_max)
     remapped_interval_1 = remap(width/factor * (len(planes)-index), from_min, from_max, to_min, to_max)
     width_interval = rg.Interval(remapped_interval_0, remapped_interval_1)

     length_interval = rg.Interval(-length/2, length/2)
     rectangle = rg.Rectangle3d(pln,width_interval,length_interval)
     modified_rectangles.append(rectangle)

modified_rectangles[0]
# ---------- end ipy2_9 ----------

data_9 = Data(ipy2_8.rectangles)

# ----
# modified cross section
ipy2_10 = IronPython2Script(
    rectangles=data_9,
    number=data_6,
    planes=ipy2_8.planes,
    width=width_4,
    length=length_4,
    to_min=data_7,
    to_max=neg_5,
    opening_factor=Slider(6, range=1..20),
    slat_height=slat_height_2)  # -> out, modified_rectangles; inputs rectangles: list, planes: list, opening_factor: Int32; same code as ipy2_9

# ----
# Original Cross Section
# ! in Centimeters
data_10 = Data(x_axis_scale_2)
neg_6 = Negative(Value=data_10)
ipy2_11 = IronPython2Script(
    y=y_6,
    x=number_slider_6,
    number=number_of_horizontal_sections_6,
    width=cross_section_width_2,
    length=cross_section_length_2,
    to_min=data_10,
    to_max=neg_6,
    opening_factor="7",
    slat_height=middle_part_4,
    number_of_slats=Slider(30, range=1..50))  # -> extruded_surface_1, extruded_surface_2, slats, loft, merged_brep_2; inputs number: Int32, opening_factor: Int32, number_of_slats: Int32
# ---------- ipy2_11: IronPython ----------
import Rhino.Geometry as rg
import Rhino
import System.Guid
import math

###################################################
# Create Points
###################################################


vertical_factor = slat_height // number

points = []
for i in range(number):
    if i !=0 :
       point = rg.Point3d(x,y,i * vertical_factor)
       points.append(point)
    else :
       point = rg.Point3d(x,y,i)
       points.append(point) 


###################################################
# Create Rectangles
###################################################


vector = rg.Vector3d.ZAxis

planes = []
for i in range(number):
    pln = rg.Plane(points[i],vector)
    planes.append(pln)


#rectangle around a central point
width_interval = rg.Interval(-width/2, width/2)
length_interval = rg.Interval(-length/2, length/2)

rectangles = []
for i in planes :
    rectangle = rg.Rectangle3d(i,width_interval,length_interval)
    rectangles.append(rectangle)

##################################################
# Modify Rectangles
##################################################

#we want to constrain within a width to a given range
from_min = -width/2 * len(planes)
from_max = width/2 * len(planes)


#remap function
def remap(value, from_min, from_max, to_min, to_max):
    # Calculate the proportion of the value within the original range
    proportion = (value - from_min) / (from_max - from_min)
    # Map the value to the target range using the proportion
    remapped_value = to_min + (proportion * (to_max - to_min))
    return remapped_value

factor = 2

remapped_height = remap(slat_height,0,slat_height,0,100)

print(remapped_height)
print(slat_height)

modified_rectangles = []

for index, pln in enumerate(planes):
  if len(planes) / opening_factor < (index * 0.5) :
     remapped_interval_0 = remap(-width/factor*index, from_min, from_max, to_min, to_max)
     remapped_interval_1 = remap(width/factor*index, from_min, from_max, to_min, to_max)
     width_interval = rg.Interval(remapped_interval_0, remapped_interval_1)

     length_interval = rg.Interval(-length/2, length/2)
     rectangle = rg.Rectangle3d(pln,width_interval,length_interval)
     modified_rectangles.append(rectangle)
  else :
     remapped_interval_0 = remap(-width/factor * (len(planes)-index), from_min, from_max, to_min, to_max)
     remapped_interval_1 = remap(width/factor * (len(planes)-index), from_min, from_max, to_min, to_max)
     width_interval = rg.Interval(remapped_interval_0, remapped_interval_1)

     length_interval = rg.Interval(-length/2, length/2)
     rectangle = rg.Rectangle3d(pln,width_interval,length_interval)
     modified_rectangles.append(rectangle)


#################################################
#Loft Middle Part Rectangles
#################################################

def loft_function(rectangles):
   
    curves = []
    for rect in rectangles:
        polyline = rect.ToPolyline()  
        polyline_curve = rg.PolylineCurve(polyline)  
        curves.append(polyline_curve)  
        

    #  CreateFromLoft method
    loft = rg.Brep.CreateFromLoft(curves, rg.Point3d.Unset, rg.Point3d.Unset, rg.LoftType.Normal, False)

    return loft[0]
    
loft = loft_function(modified_rectangles)


#################################################
# Extrude Base and Top Part
#################################################

# rectangles3D to Curves
rect =  modified_rectangles[0].ToNurbsCurve()
# Extrude to Base
vector = rg.Vector3d(0,0,-50)
extruded_surface_1 = rg.Surface.CreateExtrusion(rect, vector)
extruded_surface_1 = rg.Brep.CreateFromSurface(extruded_surface_1)

# rectangles3D to Curves
rect =  modified_rectangles[-1].ToNurbsCurve()
# Extrude to top
vector = rg.Vector3d(0,0,50)
extruded_surface_2 = rg.Surface.CreateExtrusion(rect, vector)
extruded_surface_2 = rg.Brep.CreateFromSurface(extruded_surface_2)


##################################################
# Move brep / Merge Breps
##################################################

# print(type(merged_brep)) > ArrayBrep
# Join Brep returns a list of breps not one brep !


vector = rg.Vector3d(0,0,50)
translation_transform = rg.Transform.Translation(vector)
loft.Transform(translation_transform)
extruded_surface_1.Transform(translation_transform)
extruded_surface_2.Transform(translation_transform)

list_of_breps = [loft,extruded_surface_1, extruded_surface_2]
merged_brep = rg.Brep.JoinBreps(list_of_breps,0.001 , 0.01) #list of breps, tolerance, angle tolerance, index Map


#################################################
# Generate a Number of Slats
#################################################


slats = []
f= 10 # factor for distanse between slabs
#k factor for transformation in slats

for i in range(number_of_slats):

    # Define parabola constants

    a = 0.08  # Controls the curvature of the parabola
    b = 0     # Optional linear component, if you want to tilt the parabola
    c = 0    # Initial Z-offset for the parabola (can be used to move all slats up/down)

    k = a * i ** 2 + b*i + c

    vector = rg.Vector3d(0,i * f, k)
    translation_transform = rg.Transform.Translation(vector)

    moved_slats = merged_brep[0].Duplicate()
    moved_slats.Transform(translation_transform)
    
    slats.append(moved_slats)
# ---------- end ipy2_11 ----------

# ---- group: Closed Brep
cap_5 = CapHoles(Brep=ipy2_11.slats)

# ----
preview_4 = CustomPreview(Geometry=cap_5, Material=ColourSwatch(SwatchColor=RGB(207, 194, 240)))

geometry = Data(ipy2_9.modified_rectangles)

# ----
# Loft Cross Sections
ipy2_12 = IronPython2Script(modified_rectangles=geometry)  # -> solid, loft; inputs modified_rectangles: list of Curve
# ---------- ipy2_12: IronPython ----------
import Rhino.Geometry as rg
import scriptcontext as sc


def loft_function(rectangles):
   
    curves = []
    for rect in rectangles:
        polyline = rect.ToPolyline()  
        polyline_curve = rg.PolylineCurve(polyline)  
        curves.append(polyline_curve)  
        

    #  CreateFromLoft method
    loft = rg.Brep.CreateFromLoft(curves, rg.Point3d.Unset, rg.Point3d.Unset, rg.LoftType.Normal, False)

    return loft[0]
    
loft = loft_function(modified_rectangles)
# ---------- end ipy2_12 ----------

# ---- group: Closed Brep
cap_6 = CapHoles(Brep=ipy2_12.loft)

# ----
preview_5 = CustomPreview(Geometry=cap_6, Material=ColourSwatch(SwatchColor=RGB(139, 95, 190)))

cap_7 = CapHoles(Brep=cap_6)

# ----
# dublicate slats
ipy2_13 = IronPython2Script(x=number_slider_3, y=y_3, slat=cap_7, number_of_slats=number_slider_7)  # -> points_y, slats; inputs x: Int32, y: Int32, slat: Brep, number_of_slats: Int32
# ---------- ipy2_13: IronPython ----------
import Rhino.Geometry as rg
import Rhino

points_y = []
slats = []

for i in range(number_of_slats):
    point = rg.Point3d(x,i * 10,0)
    points_y.append(point) 

    vector = rg.Vector3d(0,i * 10,0)
    translation_transform = rg.Transform.Translation(vector)

    moved_slat = slat.Duplicate()
    moved_slat.Transform(translation_transform)
    
    slats.append(moved_slat)


# Move slat middle part
#___________________________________

middle_slats = []
for i in range(number_of_slats):
    vector = rg.Vector3d(0,i,50)
    translation_transform = rg.Transform.Translation(vector)
    slats[i].Transform(translation_transform)
    middle_slats.append(slats)
# ---------- end ipy2_13 ----------

geo_4 = Geometry(ipy2_13.slats)
pt_4 = Point(ipy2_13.points_y)
panel_4 = Panel(geo_4)

geometry_2 = Data(ipy2_10.modified_rectangles)

# ----
# Loft Cross Sections
ipy2_14 = IronPython2Script(modified_rectangles=geometry_2)  # -> solid, loft; inputs modified_rectangles: list of Curve
# ---------- ipy2_14: IronPython ----------
import Rhino.Geometry as rg
import scriptcontext as sc
import rhinoscriptsyntax as rs

def loft_function(rectangles):
   
    curves = []
    for rect in rectangles:
        polyline = rect.ToPolyline()  
        polyline_curve = rg.PolylineCurve(polyline)  
        curves.append(polyline_curve)  
        

    #  CreateFromLoft method
    loft = rg.Brep.CreateFromLoft(curves, rg.Point3d.Unset, rg.Point3d.Unset, rg.LoftType.Normal, False)
    sc.doc.Objects.AddBrep(loft[0])
    sc.doc.Views.Redraw()
    return loft[0]
    
    

loft = loft_function(modified_rectangles)

solid = rs.CapPlanarHoles(loft)
# ---------- end ipy2_14 ----------

# ---- group: Closed Brep
cap_8 = CapHoles(Brep=ipy2_14.loft)

# ----
panel_5 = Panel(ipy2_14.loft)
preview_6 = CustomPreview(Geometry=cap_8, Material=ColourSwatch(SwatchColor=RGB(139, 95, 190)))
