# Grasshopper definition AS1_Digital Slat_NB.gh (Grasshopper 1.0.8)
# plug-ins: RhinoCodePluginGH

# ---- group: 00_Planes
ipy2 = IronPython2Script(number=Slider(15, range=2..100), y=Slider(0, range=0..100), x=Slider(0, range=0..100))  # -> out, points, planes; inputs number: Int32
# ---------- ipy2: IronPython ----------
import Rhino.Geometry as rg

points = []
planes = []

for i in range(number):
    point = rg.Point3d(x,y,i*100)
    points.append(point)

    vector = rg.Vector3d.ZAxis # default Z axis vector

    pln = rg.Plane(point, vector) # creating a plane with only z direction
    planes.append(pln)
# ---------- end ipy2 ----------

# ----
number_slider = Slider(45, range=0..100)
neg = Negative(Value=number_slider)

# ---- group: 01_Rectangles
number_slider_2 = Slider(25, range=0..100)
neg_2 = Negative(Value=number_slider_2)
ipy2_2 = IronPython2Script(
    planes=ipy2.planes,
    mid=Slider(0.25, range=0..1),
    to_min_w=neg_2,
    to_max_w=number_slider_2,
    to_min_h=neg,
    to_max_h=number_slider)  # -> out, rectangles; inputs planes: list of Plane
# ---------- ipy2_2: IronPython ----------
import Rhino.Geometry as rg

rectangles = []
width = 10.0
height = 10.0

if to_max_h != 0 and to_max_w != 0:
    print("No errors")
     
if to_max_w == 0:
    to_min_w = -1
    to_max_w = 1
    print("Error: w can't be 0, changed to min 1")
    
if to_max_h == 0:
    to_min_h = -1
    to_max_h = 1
    print("Error: h can't be 0, changed to min 1")

# Constrain width and height to a given range
from_min_w = -width / 2 * len(planes)
from_max_w = width / 2 * len(planes)

from_min_h = -height / 2 * len(planes)
from_max_h = height / 2 * len(planes)

def remap_w(value, from_min_w, from_max_w, to_min_w, to_max_w):
    proportion = (value - from_min_w) / (from_max_w - from_min_w)
    remapped_value_w = to_min_w + (proportion * (to_max_w - to_min_w))
    return remapped_value_w

def remap_h(value, from_min_h, from_max_h, to_min_h, to_max_h):
    proportion = (value - from_min_h) / (from_max_h - from_min_h)
    remapped_value_h = to_min_h + (proportion * (to_max_h - to_min_h))
    return remapped_value_h

half_index = len(planes) * mid

for index, pln in enumerate(planes):

    if index < half_index:
        inverted_index = len(planes) - index - 1  # Reverse the index for decreasing size
        remapped_interval_0_w = remap_w(-width / 2 * (inverted_index + 1), from_min_w, from_max_w, to_min_w, to_max_w)
        remapped_interval_1_w = remap_w(width / 2 * (inverted_index + 1), from_min_w, from_max_w, to_min_w, to_max_w)
        width_interval = rg.Interval(remapped_interval_1_w, remapped_interval_0_w)  # Inverted order

        remapped_interval_0_h = remap_h(-height / 2 * (inverted_index + 1), from_min_h, from_max_h, to_min_h, to_max_h)
        remapped_interval_1_h = remap_h(height / 2 * (inverted_index + 1), from_min_h, from_max_h, to_min_h, to_max_h)
        height_interval = rg.Interval(remapped_interval_1_h, remapped_interval_0_h)  # Inverted order

    else:
        remapped_interval_0_w = remap_w(width / 2 * (index + 1), from_min_w, from_max_w, to_min_w, to_max_w)
        remapped_interval_1_w = remap_w(-width / 2 * (index + 1), from_min_w, from_max_w, to_min_w, to_max_w)
        width_interval = rg.Interval(remapped_interval_0_w, remapped_interval_1_w)

        remapped_interval_0_h = remap_h(height / 2 * (index + 1), from_min_h, from_max_h, to_min_h, to_max_h)
        remapped_interval_1_h = remap_h(-height / 2 * (index + 1), from_min_h, from_max_h, to_min_h, to_max_h)
        height_interval = rg.Interval(remapped_interval_0_h, remapped_interval_1_h)

    rectangle = rg.Rectangle3d(pln, width_interval, height_interval)
    rectangles.append(rectangle)
# ---------- end ipy2_2 ----------

# ---- group: 02_Repetition
ipy2_3 = IronPython2Script(number=Slider(25, range=1..100), x=number_slider_2)  # -> out, points, planes; inputs number: Int32
# ---------- ipy2_3: IronPython ----------
import Rhino.Geometry as rg

points = []
planes = []

number = number*3

for i in range(number):
    if number == 0:
        i = 1
    point = rg.Point3d(i*x,0,0)
    vector = rg.Vector3d.ZAxis # default Z axis vector
    pln = rg.Plane(point, vector) # creating a plane with only z direction
    if i % 3 == 0:
        points.append(point)
        planes.append(pln)
# ---------- end ipy2_3 ----------
ipy2_4 = IronPython2Script(planes=ipy2_3.planes, rectangles=ipy2_2.rectangles, y=Slider(10, range=1..10), z=Slider(10, range=1..10))  # -> out, slats; inputs planes: list
# ---------- ipy2_4: IronPython ----------
import rhinoscriptsyntax as rs

slats = []
half_index = len(planes) // 2  

for index, pln in enumerate(planes):
    move_point = pln.Origin 
    scale_y = 1/y
    scale_z = 1/z

    if index < half_index:
        slat = rs.ScaleObject(rectangles, move_point,(1, scale_y*index+1, scale_z*index+1),True)

    else:
        scale_down = index - half_index 
        inverted = half_index - scale_down 
        slat = rs.ScaleObject(rectangles, move_point, (1,scale_y*inverted+1, scale_z*inverted+1), True)

    rs.MoveObject(slat, move_point)
    slats.append(slat)

print(half_index)
# ---------- end ipy2_4 ----------

# ----
flip = FlipMatrix(Data=ipy2_4.slats)

# ---- group: 03_Loft
ipy2_5 = IronPython2Script(my_rectangles=flip)  # -> out, loft; inputs my_rectangles: list of Rectangle3d
# ---------- ipy2_5: IronPython ----------
import Rhino.Geometry as rg

my_nurbs_rectangles = []

for rect in my_rectangles:
    curve_rect = rect.ToNurbsCurve()
    my_nurbs_rectangles.append(curve_rect)

start_point = rg.Point3d(my_nurbs_rectangles[0].PointAtStart)
end_point = rg.Point3d(my_nurbs_rectangles[-1].PointAtStart)

start_point = rg.Point3d.Unset
end_point = rg.Point3d.Unset

loft = rg.Brep.CreateFromLoft(my_nurbs_rectangles, start_point, end_point, rg.LoftType.Normal, False)[0]
print(loft)
# ---------- end ipy2_5 ----------

# ----
geo = Geometry(ipy2.planes)
geo_2 = Geometry(ipy2_5.loft)
geo_3 = Geometry(ipy2_3.planes)
geo_4 = Geometry(ipy2_2.rectangles)
panel = Panel(ipy2_2.out)
