# Grasshopper definition Spyros_Digital_Slat.gh (Grasshopper 1.0.8)
# plug-ins: RhinoCodePluginGH

xy = XYPlane(Origin=Point(0, 0, 0))
pt = Point(<point referenced from the Rhino model>)
pt_2 = Point(<point referenced from the Rhino model>)
number_slider = Slider(30, range=0..1000)
number_slider_2 = Slider(200, range=0..1000)
number_slider_3 = Slider(15, range=0..100)
panel = Panel("TEST RECTANGLE")
ipy2 = IronPython2Script(pln=xy, y=pt, x=pt_2)  # -> out, rectangle; inputs y: Point3d, x: Point3d
# ---------- ipy2: IronPython ----------
import Rhino.Geometry as rg

rectangle = rg.Rectangle3d(pln, x, y)
# ---------- end ipy2 ----------
geometries = IronPython2Script(x=Slider(0, range=0..100), y=Slider(0, range=0..100), number=Slider(11, range=0..100))  # -> out, point, points, planes, rectangle; inputs number: Int32
# ---------- geometries: IronPython ----------
import Rhino.Geometry as rg

points = []
planes = []
rectangles = []
height = 15
divisions = 5

for i in range(101):
    if (i == 0) or (i%15 ==0) or (i==100):
        point = rg.Point3d(x, y, i)
        points.append(point)

        vector = rg.Vector3d(0,0,1) # another eay to make a default z axis vector

        pln = rg.Plane(point, vector) # creating a plane with only z direction
        #pln = rg.Plane(point, xax, yax) # creating a plane with z and y directions

        rectangle = rg.Rectangle3d(pln, 40, 30)

        planes.append(pln)

#for j in range(divisions):
    #if (j == 45) or (j == 60):
        #rectangle = rg.Rectangle3d(pln, 40, height)
        #rectangles.append(rectangle)
# ---------- end geometries ----------
v_planes = IronPython2Script(
    x=Slider(0, range=0..100),
    y=Slider(0, range=0..100),
    z=Slider(0, range=0..100),
    h_rep=number_slider_2,
    h_dist=number_slider,
    slb_height=Slider(200, range=0..1000),
    div=number_slider_3,
    number=Slider(11, range=0..100))  # -> out, point, h_points, planes, h_planes; inputs z: Int32, h_rep: Int32, h_dist: Int32, slb_height: Int32, div: Int32, number: Int32
# ---------- v_planes: IronPython ----------
import Rhino.Geometry as rg

points = []
planes = []
h_planes = []
vectors = []
rectangles = []

points_2 = []
h_slabs = []

h_planes_2 = []


#for j in range(0, h_rep, h_dist):
for i in range(0, slb_height, div):
        # if (i == 0) or (i%15 == 0) or (i == 100):
    point = rg.Point3d(x, y, i)
    points.append(point)

    vector = rg.Vector3d(0,0,1)

    pln = rg.Plane(point, vector)       

    planes.append(pln)
#h_planes.append(planes)


#for j in range(0, h_rep, h_dist):
    
    # point_2 = rg.Point3d(j, y, z)
    # points_2.append(point)

    # # vector = rg.Vector3d(0,0,1) 

    # h_pln = rg.Plane(point_2, vector) 
    # h_planes.append(h_pln)

#for k in range(0, h_rep, h_dist):
# ---------- end v_planes ----------
panel_2 = Panel(ipy2.rectangle)
geo = Geometry(ipy2.rectangle)
panel_3 = Panel(v_planes.h_planes)
geo_2 = Geometry(geometries.rectangle)
geo_3 = Geometry(v_planes.planes)
geo_4 = Geometry(v_planes.h_planes)
ipy2_2 = IronPython2Script(planes=v_planes.planes)  # -> out, h_planes_2
# ---------- ipy2_2: IronPython ----------
import Rhino.Geometry as rg

h_planes_2 = []

a = planes.pop(1)

print a
# ---------- end ipy2_2 ----------
number_slider_4 = Slider(0, range=0..100)
attraction_points = IronPython2Script(
    x=number_slider_4,
    y=number_slider_4,
    z=number_slider_4,
    h_rep=number_slider_2,
    h_dist=number_slider,
    planes=v_planes.planes,
    div=number_slider_3)  # -> out, h_points; inputs h_rep: Int32, h_dist: Int32, planes: list
# ---------- attraction_points: IronPython ----------
import Rhino.Geometry as rg

h_points = []

length = len(planes)
p = length/(div-1)
p = int(p)

for k in range(0, h_rep, h_dist):
    point_2 = (rg.Point3d(k,y,z))
    h_points.append(point_2)
# ---------- end attraction_points ----------
geo_5 = Geometry(attraction_points.h_points)
number_slider_5 = Slider(50, range=5..50)
neg = Negative(Value=number_slider_5)
transform_rectangles = IronPython2Script(
    k=Slider(5, range=0..10),
    height=Slider(30, range=0..100),
    width=Slider(5, range=0..100),
    planes=v_planes.planes,
    to_min=neg,
    to_max=number_slider_5)  # -> out, rectangles, Brep; inputs planes: list of Plane
# ---------- transform_rectangles: IronPython ----------
import Rhino.Geometry as rg

rectangles = []

# We want to construct width of a given range
from_min = -width/2  * len(planes)
from_max = width/2 * len(planes)

# def remap(value, from_min, from_max, to_min, to_max):
#     #Calculate the proportion of the value within the original range
#     proportion = (value - from_min) / (from_max - from_min)
#     # Map the value to the target range using the proportion
#     remapped_value = to_min + (proportion * (to_max - to_min))
#     return remapped_value
    

for index, pln in enumerate(planes):
    # 3rd and fifth element /4
    if (index == k):
        # remapped_interval_0 = remap(-width/2.5, from_min, from_max, to_min, to_max)
        # remapped_interval_1 = remap(width/1.2, from_min, from_max, to_min, to_max)
        width_interval = rg.Interval((-width/2.5), (width/1.2))#(remapped_interval_0, remapped_interval_1)

        
        height_interval = rg.Interval(-height/2, height/2)
        rectangle = rg.Rectangle3d(pln, width_interval, height_interval)
        rectangles.append(rectangle)
    
    elif (index == (k+3)):
        # remapped_interval_0 = remap(-width/1.2, from_min, from_max, to_min, to_max)
        # remapped_interval_1 = remap(width/2.5, from_min, from_max, to_min, to_max)
        width_interval = rg.Interval((-width/1.2), (width/2.5))#(remapped_interval_0, remapped_interval_1)

        
        height_interval = rg.Interval(-height/2, height/2)
        rectangle = rg.Rectangle3d(pln, width_interval, height_interval)
        rectangles.append(rectangle)

    #elif (index==3):
        #remapped_interval_0 = remap(-width, from_min, from_max, to_min, to_max)
       #remapped_interval_1 = remap(width, from_min, from_max, to_min, to_max)
        #width_interval = rg.Interval(remapped_interval_0, remapped_interval_1)

    elif (index == (k+1)):
        # remapped_interval_0 = remap(-width/3, from_min, from_max, to_min, to_max)
        # remapped_interval_1 = remap(width/1.8, from_min, from_max, to_min, to_max)
        width_interval = rg.Interval((-width/3), (width/1.8))#(remapped_interval_0, remapped_interval_1)

        
        height_interval = rg.Interval(-height/2, height/2)
        rectangle = rg.Rectangle3d(pln, width_interval, height_interval)
        rectangles.append(rectangle)

    elif (index == (k+2)):
        # remapped_interval_0 = remap(-width/1.8, from_min, from_max, to_min, to_max)
        # remapped_interval_1 = remap(width/3, from_min, from_max, to_min, to_max)
        width_interval = rg.Interval((-width/1.8), (width/3))#(remapped_interval_0, remapped_interval_1)

        
        height_interval = rg.Interval(-height/2, height/2)
        rectangle = rg.Rectangle3d(pln, width_interval, height_interval)
        rectangles.append(rectangle)

    else:
        # remapped_interval_0 = remap(-width, from_min, from_max, to_min, to_max)
        # remapped_interval_1 = remap(width, from_min, from_max, to_min, to_max)
        width_interval = rg.Interval(-width, width)#(remapped_interval_0, remapped_interval_1)

        
        height_interval = rg.Interval(-height/2, height/2)
        rectangle = rg.Rectangle3d(pln, width_interval, height_interval)
        rectangles.append(rectangle)

#rg.Brep.CreateFromLoft[rectangles, 2, False]

    # Ananya method:
    # remapped_interval_0 = remap(-width/6 * index, from_min, from_max, to_min, to_max)
        # remapped_interval_1 = remap(width/6 * index, from_min, from_max, to_min, to_max)
        # width_interval = rg.Interval(remapped_interval_0, remapped_interval_1)
# ---------- end transform_rectangles ----------
panel_4 = Panel("list access!!")
geo_6 = Geometry(transform_rectangles.rectangles)
loft = IronPython2Script(my_rectangles=transform_rectangles.rectangles)  # -> out, lofted_shape; inputs my_rectangles: list of Rectangle3d
# ---------- loft: IronPython ----------
import Rhino.Geometry as rg
print(my_rectangles)

my_nurbs_rectangles = [] # creating anew empty list

for rect in my_rectangles:
    print("before")
    print(rect)
    curve_rect = rect.ToNurbsCurve()
    #print("after")
    #print(curve_rect)
    
    my_nurbs_rectangles.append(curve_rect)

print(my_nurbs_rectangles)

# 1st method, but the points are not set with the proper way
# lofted_shape = rg.Brep.CreateFromLoft(my_nurbs_rectangles, rg.Point3d.Unset, rg.Point3d.Unset, 0, False)

# we define the start-end points and then use them
start_point = rg.Point3d(my_nurbs_rectangles[0].PointAtStart)
end_point = rg.Point3d(my_nurbs_rectangles[-1].PointAtStart)

# eventually we use the 'not proper way'
start_point = rg.Point3d.Unset
end_point = rg.Point3d.Unset

lofted_shape = rg.Brep.CreateFromLoft(my_nurbs_rectangles, start_point, end_point, rg.LoftType.Normal, False)

print(lofted_shape)
# ---------- end loft ----------
panel_5 = Panel(geo_6)
geo_7 = Geometry(loft.lofted_shape)
panel_6 = Panel(loft.lofted_shape)
panel_7 = Panel("Intergrated loft ?")
geometries_2 = IronPython2Script(x=Slider(0, range=0..100), z=Slider(0, range=0..100), rep=Slider(100, range=0..100), dist=Slider(10, range=0..100))  # -> out, h_planes, h_slabs; inputs rep: Int32, dist: Int32
# ---------- geometries_2: IronPython ----------
import Rhino.Geometry as rg

points = []
h_planes = []
h_slabs = []



for i in range(0, rep, dist):
    
        point = rg.Point3d(x, i, z)
        points.append(point)

        vector = rg.Vector3d(0,0,1) # another eay to make a default z axis vector

        h_pln = rg.Plane(point, vector) # creating a plane with only z direction
        #pln = rg.Plane(point, xax, yax) # creating a plane with z and y directions

        h_planes.append(h_pln)

for index, h_pln in enumerate(h_planes):
    
    h_slabs.append(slabs)
# ---------- end geometries_2 ----------
horizontal_planes = Geometry(geometries_2.h_planes)
horizontal_slabs = Geometry(geometries_2.h_slabs)
