# Grasshopper definition W1_Assignment_Digital Slat_JimChen.gh (Grasshopper 1.0.8)
# plug-ins: RhinoCodePluginGH

number_slider = Slider(92, range=0..100)  # disabled
graph_mapper = GraphMapper(number_slider, x0=0, x1=100, y0=0, y1=100, Ox=0.5, Oy=0, Px=0.75, Py=0.25, container_name="Parabola")  # disabled
number_slider_2 = Slider(31, range=0..100)  # disabled
ironpython_2_script = IronPython2Script(position_x=200, y=number_slider, thin_range=number_slider_2, thin_place=graph_mapper)  # -> out, points, new_planes, new_rectangles, units; inputs y: Int32, thin_range: Int32, thin_place: Int32; disabled
# ---------- ironpython_2_script: IronPython ----------
import Rhino.Geometry as rg
from ghpythonlib.treehelpers import list_to_tree


y_steps =[]
units =[]

for z in range(y):
    step = 25*z
    y_steps.append(step)

    points = []
    planes = []
    rectangles = []


    for i in range(thin_range):
        point = rg.Point3d(position_x,y_steps[z],i*10)
        points.append(point)

        vectorZ = rg.Vector3d.ZAxis

        pln = rg.Plane(point, vectorZ) # Create plane with only z direction
        planes.append(pln)


    rectangles = []
    width = 10.0
    height = 10.0

    # we want to constrain width to a given range
    from_min = -width/2 * len(planes)
    from_max = width/2 * len(planes)

    to_min = -30.0
    to_max = 30.0

    def remap(value, from_min, from_max, to_min, to_max):
        # Calculate the proportion of the value within the original range
        proportion = (value - from_min) / (from_max - from_min)
        # Map the value to the target range using the proportion
        remapped_value = to_min + (proportion * (to_max - to_min))
        return remapped_value

    width_change = []

    for index, pln in enumerate(planes):
        if index > (len(planes)/2):
            width_change_0 = remap(width/2 * index, from_min, from_max, to_min, to_max)

            width_change.append(width_change_0)
        
        else:
            width_change_0 = remap(width/2 * (len(planes) - index), from_min, from_max, to_min, to_max)

            width_change.append(width_change_0)

    normal_rectangle_width =[]

    for j in range(100 - index):
        
        normal_rectangle = (width_change[index])
        normal_rectangle_width.append(normal_rectangle)

    normal_rectangle_width[thin_place:1] = width_change
    width_all = normal_rectangle_width    

    new_points =[]
    new_planes =[]
    new_rectangles =[]

    for k in range(len(width_all)):
        new_point = rg.Point3d(position_x,y_steps[z],k*10)
        new_points.append(new_point)
        vectorZ = rg.Vector3d.ZAxis

        new_pln = rg.Plane(new_point, vectorZ)
        new_planes.append(new_pln)

    for f in range(len(width_all)):
        
        width_interval = rg.Interval(-width_all[f], width_all[f])
        height_interval = rg.Interval(-height/2, height/2)
        new_rectangle = rg.Rectangle3d(new_planes[f], width_interval, height_interval) 
        new_rectangles.append(new_rectangle)
    

units.append(new_rectangles)

units = list_to_tree(units)
# ---------- end ironpython_2_script ----------
loft = Loft(
    Curves=ironpython_2_script.new_rectangles,
    Options={Adjust=False, Closed=False, LoftEnds=0, LoftSimp=0, LoftType=0, Rebuild=10, Refit=0.01})  # disabled

number_slider_3 = Slider(100, range=0..100)  # disabled
graph_mapper_2 = GraphMapper(number_slider_3, x0=0, x1=100, y0=0, y1=100, Ox=0.5, Oy=0, Px=0.75, Py=0.25, container_name="Parabola")  # disabled
number_slider_4 = Slider(31, range=0..100)  # disabled
ironpython_2_script_2 = IronPython2Script(position_x=200, y=number_slider_3, thin_range=number_slider_4, thin_place=graph_mapper_2)  # -> out, points, new_planes, new_rectangles, units; inputs y: Int32, thin_range: Int32, thin_place: Int32; disabled; same code as ironpython_2_script
loft_2 = Loft(
    Curves=ironpython_2_script_2.new_rectangles,
    Options={Adjust=False, Closed=False, LoftEnds=0, LoftSimp=0, LoftType=0, Rebuild=10, Refit=0.01})  # disabled
data_recorder = DataRecorder(loft_2, DataLimit=-10, RecordData=True)  # disabled

number_slider_5 = Slider(100, range=0..100)  # disabled
graph_mapper_3 = GraphMapper(
    number_slider_5,
    x0=0,
    x1=100,
    y0=0,
    y1=100,
    container_name="Bezier",
    cpx=[0, 0.5496076345, 0.330945909, 1],
    cpy=[0, 0, 1, 1])  # disabled
number_slider_6 = Slider(31, range=0..100)  # disabled
ironpython_2_script_3 = IronPython2Script(position_x=200, y=number_slider_5, thin_range=number_slider_6, thin_place=graph_mapper_3)  # -> out, points, new_planes, new_rectangles, units; inputs y: Int32, thin_range: Int32, thin_place: Int32; disabled; same code as ironpython_2_script
loft_3 = Loft(
    Curves=ironpython_2_script_3.new_rectangles,
    Options={Adjust=False, Closed=False, LoftEnds=0, LoftSimp=0, LoftType=0, Rebuild=10, Refit=0.01})  # disabled
data_recorder_2 = DataRecorder(loft_3, DataLimit=-10, RecordData=True)  # disabled

number_slider_7 = Slider(1, range=0..100)  # disabled
number_slider_8 = Slider(100, range=0..100)  # disabled
number_slider_9 = Slider(0, range=0..100)  # disabled
number_slider_10 = Slider(20, range=0..100)  # disabled
number_slider_11 = Slider(70, range=0..100)  # disabled
ironpython_2_script_4 = IronPython2Script(
    position_x=200,
    y=number_slider_7,
    thin_range=number_slider_10,
    thin_place=number_slider_8,
    thin_range_2=number_slider_11,
    thin_place_2=number_slider_9)  # -> out, points, new_planes, new_rectangles, units; inputs y: Int32, thin_range: Int32, thin_place: Int32; disabled
# ---------- ironpython_2_script_4: IronPython ----------
import Rhino.Geometry as rg

# Y-direction move
# /////////////////////////////////////////////////////////////////////////////////////////////////

y_steps =[]

for z in range(y):
    step = 25*z
    y_steps.append(step)

    points = []
    planes = []
    rectangles = []

# Change rectangle Part
# /////////////////////////////////////////////////////////////////////////////////////////////////
    for i in range(thin_range):
        point = rg.Point3d(position_x,y_steps[z],i*10)
        points.append(point)

        vectorZ = rg.Vector3d.ZAxis

        pln = rg.Plane(point, vectorZ) # Create plane with only z direction
        planes.append(pln)

    rectangles = []
    width = 10.0
    height = 10.0

    # we want to constrain width to a given range
    from_min = -width/2 * len(planes)
    from_max = width/2 * len(planes)

    to_min = -30.0
    to_max = 30.0

    def remap(value, from_min, from_max, to_min, to_max):
        # Calculate the proportion of the value within the original range
        proportion = (value - from_min) / (from_max - from_min)
        # Map the value to the target range using the proportion
        remapped_value = to_min + (proportion * (to_max - to_min))
        return remapped_value

    width_change = []

    for index, pln in enumerate(planes):
        if index > (len(planes)/2):
            width_change_0 = remap(width/2 * index, from_min, from_max, to_min, to_max)

            width_change.append(width_change_0)        
        else:
            width_change_0 = remap(width/2 * (len(planes) - index), from_min, from_max, to_min, to_max)

            width_change.append(width_change_0)


# Normal rectangle
# /////////////////////////////////////////////////////////////////////////////////////////////////

    normal_rectangle_width =[]

    for j in range(100 - index):
        
        normal_rectangle = (width_change[index])
        normal_rectangle_width.append(normal_rectangle)

# Insert rectangle
# /////////////////////////////////////////////////////////////////////////////////////////////////

    normal_rectangle_width[thin_place:1] = width_change
    width_all = normal_rectangle_width    

# All planes
# /////////////////////////////////////////////////////////////////////////////////////////////////
 
    new_points =[]
    new_planes =[]
    new_rectangles =[]
 
    for k in range(len(width_all)):
        new_point = rg.Point3d(position_x,y_steps[z],k*10)
        new_points.append(new_point)
        vectorZ = rg.Vector3d.ZAxis

        new_pln = rg.Plane(new_point, vectorZ)
        new_planes.append(new_pln)

# Generate Units
# /////////////////////////////////////////////////////////////////////////////////////////////////

    for f in range(len(width_all)):
        
        width_interval = rg.Interval(-width_all[f], width_all[f])
        height_interval = rg.Interval(-height/2, height/2)
        new_rectangle = rg.Rectangle3d(new_planes[f], width_interval, height_interval) 
        new_rectangles.append(new_rectangle)
# ---------- end ironpython_2_script_4 ----------
loft_4 = Loft(
    Curves=ironpython_2_script_4.new_rectangles,
    Options={Adjust=False, Closed=False, LoftEnds=0, LoftSimp=0, LoftType=0, Rebuild=10, Refit=0.01})  # disabled

number_slider_12 = Slider(0, range=0..10)  # disabled
number_slider_13 = Slider(79, range=0..100)  # disabled
number_slider_14 = Slider(100, range=0..100)  # disabled
number_slider_15 = Slider(0, range=0..10)  # disabled
number_slider_16 = Slider(71, range=0..100)  # disabled
number_slider_17 = Slider(250, range=0..1000)  # disabled
number_slider_18 = Slider(71, range=0..100)  # disabled
number_slider_19 = Slider(0, range=0..10)  # disabled
number_slider_20 = Slider(0, range=0..10)  # disabled
number_slider_21 = Slider(71, range=0..100)  # disabled
number_slider_22 = Slider(49, range=0..100)  # disabled
ironpython_2_script_5 = IronPython2Script(position_x=number_slider_17, position_y=number_slider_12, steps=number_slider_18, thin=number_slider_13)  # -> out, points, planes, rectangles; inputs steps: Int32; disabled
# ---------- ironpython_2_script_5: IronPython ----------
import Rhino.Geometry as rg

points = []
planes = []
rectangles = []

for i in range(steps):
    point = rg.Point3d(position_x,position_y,i*10)
    points.append(point)

    vectorZ = rg.Vector3d.ZAxis

    pln = rg.Plane(point, vectorZ) # Create plane with only z direction
    planes.append(pln)


rectangles = []
width = 10.0
height = 10.0

# we want to constrain width to a given range
from_min = -width/2 * len(planes)
from_max = width/2 * len(planes)

to_min = -thin
to_max = thin

def remap(value, from_min, from_max, to_min, to_max):
    # Calculate the proportion of the value within the original range
    proportion = (value - from_min) / (from_max - from_min)
    # Map the value to the target range using the proportion
    remapped_value = to_min + (proportion * (to_max - to_min))
    return remapped_value



for index, pln in enumerate(planes):
    if index > (len(planes)/2):
         remapped_interval_0 = remap(-width/2 * index, from_min, from_max, to_min, to_max)
         remapped_interval_1 = remap(width/2 * index, from_min, from_max, to_min, to_max)
      
         width_interval = rg.Interval(remapped_interval_0, remapped_interval_1)
         height_interval = rg.Interval(-height/2, height/2)

         rectangle = rg.Rectangle3d(pln, width_interval, height_interval)
         rectangles.append(rectangle)
    
    else:
         remapped_interval_0 = remap(-width/2 * (len(planes) - index), from_min, from_max, to_min, to_max)
         remapped_interval_1 = remap(width/2 * (len(planes) - index), from_min, from_max, to_min, to_max)
         
         width_interval = rg.Interval(remapped_interval_0, remapped_interval_1)
         height_interval = rg.Interval(-height/2, height/2)

         rectangle = rg.Rectangle3d(pln, width_interval, height_interval)
         rectangles.append(rectangle)
# ---------- end ironpython_2_script_5 ----------
ironpython_2_script_6 = IronPython2Script(position_x=number_slider_14, position_y=number_slider_15, steps=number_slider_16, thin=number_slider_22)  # -> out, points, planes, rectangles; inputs steps: Int32; disabled; same code as ironpython_2_script_5
ironpython_2_script_7 = IronPython2Script(position_x=number_slider_19, position_y=number_slider_20, steps=number_slider_21)  # -> out, points, planes, rectangles; inputs steps: Int32; disabled
# ---------- ironpython_2_script_7: IronPython ----------
import Rhino.Geometry as rg

points = []
planes = []
rectangles = []

for i in range(steps):
    point = rg.Point3d(position_x,position_y,i*10)
    points.append(point)

    vectorZ = rg.Vector3d.ZAxis

    pln = rg.Plane(point, vectorZ) # Create plane with only z direction
    planes.append(pln)


rectangles = []
width = 10.0
height = 10.0

# we want to constrain width to a given range
from_min = -width/2 * len(planes)
from_max = width/2 * len(planes)

to_min = -27.0
to_max = 27.0

def remap(value, from_min, from_max, to_min, to_max):
    # Calculate the proportion of the value within the original range
    proportion = (value - from_min) / (from_max - from_min)
    # Map the value to the target range using the proportion
    remapped_value = to_min + (proportion * (to_max - to_min))
    return remapped_value



for index, pln in enumerate(planes):
    if index > (len(planes)/2):
         remapped_interval_0 = remap(-width/2 * index, from_min, from_max, to_min, to_max)
         remapped_interval_1 = remap(width/2 * index, from_min, from_max, to_min, to_max)
      
         width_interval = rg.Interval(remapped_interval_0, remapped_interval_1)
         height_interval = rg.Interval(-height/2, height/2)

         rectangle = rg.Rectangle3d(pln, width_interval, height_interval)
         rectangles.append(rectangle)
    
    else:
         remapped_interval_0 = remap(-width/2 * (len(planes) - index), from_min, from_max, to_min, to_max)
         remapped_interval_1 = remap(width/2 * (len(planes) - index), from_min, from_max, to_min, to_max)
         
         width_interval = rg.Interval(remapped_interval_0, remapped_interval_1)
         height_interval = rg.Interval(-height/2, height/2)

         rectangle = rg.Rectangle3d(pln, width_interval, height_interval)
         rectangles.append(rectangle)
# ---------- end ironpython_2_script_7 ----------
point = Point(ironpython_2_script_7.points)  # disabled
point_2 = Point(ironpython_2_script_6.points)  # disabled
point_3 = Point(ironpython_2_script_5.points)  # disabled
plane = Plane(ironpython_2_script_6.planes)  # disabled
plane_2 = Plane(ironpython_2_script_5.planes)  # disabled
plane_3 = Plane(ironpython_2_script_7.planes)  # disabled
curve = Curve(ironpython_2_script_7.rectangles)  # disabled
curve_2 = Curve(ironpython_2_script_5.rectangles)  # disabled
curve_3 = Curve(ironpython_2_script_6.rectangles)  # disabled
loft_5 = Loft(Curves=curve_2, Options={Adjust=False, Closed=False, LoftEnds=0, LoftSimp=0, LoftType=0, Rebuild=10, Refit=0.01})  # disabled
loft_6 = Loft(Curves=curve_3, Options={Adjust=False, Closed=False, LoftEnds=0, LoftSimp=0, LoftType=0, Rebuild=10, Refit=0.01})  # disabled
loft_7 = Loft(Curves=curve, Options={Adjust=False, Closed=False, LoftEnds=0, LoftSimp=0, LoftType=0, Rebuild=10, Refit=0.01})  # disabled

number_slider_23 = Slider(50, range=0..100)  # disabled
ironpython_2_script_8 = IronPython2Script(count=number_slider_23)  # -> out, unit_steps; inputs count: Int32; disabled
# ---------- ironpython_2_script_8: IronPython ----------
import Rhino.Geometry as rg


steps = []

for i in range(count):
    step = 25*i
    steps.append(step)

unit_steps = steps
print(steps)
# ---------- end ironpython_2_script_8 ----------
number_slider_24 = Slider(39, range=0..100)  # disabled
number_slider_25 = Slider(0, range=0..10)  # disabled
number_slider_26 = Slider(30, range=0..100)  # disabled
ironpython_2_script_9 = IronPython2Script(position_x=number_slider_25, y_steps=ironpython_2_script_8.unit_steps, steps=number_slider_24, change=number_slider_26)  # -> out, points, new_planes, new_rectangles; inputs steps: Int32, change: Int32; disabled
# ---------- ironpython_2_script_9: IronPython ----------
import Rhino.Geometry as rg

points = []
planes = []
rectangles = []


for i in range(steps):
    point = rg.Point3d(position_x,y_steps,i*10)
    points.append(point)

    vectorZ = rg.Vector3d.ZAxis

    pln = rg.Plane(point, vectorZ) # Create plane with only z direction
    planes.append(pln)


rectangles = []
width = 10.0
height = 10.0

# we want to constrain width to a given range
from_min = -width/2 * len(planes)
from_max = width/2 * len(planes)

to_min = -27.0
to_max = 27.0

def remap(value, from_min, from_max, to_min, to_max):
    # Calculate the proportion of the value within the original range
    proportion = (value - from_min) / (from_max - from_min)
    # Map the value to the target range using the proportion
    remapped_value = to_min + (proportion * (to_max - to_min))
    return remapped_value

width_change = []

for index, pln in enumerate(planes):
    if index > (len(planes)/2):
         width_change_0 = remap(width/2 * index, from_min, from_max, to_min, to_max)

         width_change.append(width_change_0)
    
    else:
         width_change_0 = remap(width/2 * (len(planes) - index), from_min, from_max, to_min, to_max)

         width_change.append(width_change_0)

normal_rectangle_width =[]

for j in range(100 - index):
    
    normal_rectangle = (width_change[index])
    normal_rectangle_width.append(normal_rectangle)

normal_rectangle_width[change:1] = width_change
width_all = normal_rectangle_width    

new_points =[]
new_planes =[]
new_rectangles =[]

for k in range(len(width_all)):
    new_point = rg.Point3d(position_x,y_steps,k*10)
    new_points.append(new_point)
    vectorZ = rg.Vector3d.ZAxis

    new_pln = rg.Plane(new_point, vectorZ)
    new_planes.append(new_pln)

for f in range(len(width_all)):
    
    width_interval = rg.Interval(-width_all[f], width_all[f])
    height_interval = rg.Interval(-height/2, height/2)
    new_rectangle = rg.Rectangle3d(new_planes[f], width_interval, height_interval) 
    new_rectangles.append(new_rectangle)
# ---------- end ironpython_2_script_9 ----------
loft_8 = Loft(
    Curves=ironpython_2_script_9.new_rectangles,
    Options={Adjust=False, Closed=False, LoftEnds=0, LoftSimp=0, LoftType=0, Rebuild=10, Refit=0.01})  # disabled

number_slider_27 = Slider(14, range=0..100)  # disabled
number_slider_28 = Slider(100, range=100..500)  # disabled
number_slider_29 = Slider(62, range=0..100)  # disabled
number_slider_30 = Slider(8, range=1..100)  # disabled
number_slider_31 = Slider(45, range=1..100)  # disabled
number_slider_32 = Slider(100, range=1..100)  # disabled
graph_mapper_4 = GraphMapper(
    number_slider_32,
    x0=0,
    x1=100,
    y0=100,
    y1=300,
    amplitude=0.5,
    container_name="Perlin",
    decay=0.3,
    frequency=0.1,
    x_offset=0.5,
    y_offset=0.5)  # disabled
ironpython_2_script_10 = IronPython2Script(
    position_x=0,
    y=number_slider_32,
    normal_range=graph_mapper_4,
    thin_range=number_slider_29,
    thin_place=number_slider_27,
    height=number_slider_30,
    remap_range=number_slider_31)  # -> out, new_rectangles, loft; inputs y: Int32, normal_range: Int32, thin_range: Int32, thin_place: Int32; disabled
# ---------- ironpython_2_script_10: IronPython ----------
import Rhino.Geometry as rg
import rhinoscriptsyntax as rs

# Y-direction move
# /////////////////////////////////////////////////////////////////////////////////////////////////

y_steps =[]

for z in range(y):
    step = height*2*z
    y_steps.append(step)

    points = []
    planes = []
    rectangles = []

# Change rectangle Part
# /////////////////////////////////////////////////////////////////////////////////////////////////
    for i in range(thin_range):
        point = rg.Point3d(position_x,y_steps[z],i*10)
        points.append(point)

        vectorZ = rg.Vector3d.ZAxis

        pln = rg.Plane(point, vectorZ) # Create plane with only z direction
        planes.append(pln)

    rectangles = []
    width = 10.0


    # we want to constrain width to a given range
    from_min = -width/2 * len(planes)
    from_max = width/2 * len(planes)

    to_min = -remap_range
    to_max = remap_range

    def remap(value, from_min, from_max, to_min, to_max):
        # Calculate the proportion of the value within the original range
        proportion = (value - from_min) / (from_max - from_min)
        # Map the value to the target range using the proportion
        remapped_value = to_min + (proportion * (to_max - to_min))
        return remapped_value

    width_change = []

    for index, pln in enumerate(planes):
        if index > (len(planes)/2):
            width_change_0 = remap(width/2 * index, from_min, from_max, to_min, to_max)

            width_change.append(width_change_0)        
        else:
            width_change_0 = remap(width/2 * (len(planes) - index), from_min, from_max, to_min, to_max)

            width_change.append(width_change_0)


# Normal rectangle
# /////////////////////////////////////////////////////////////////////////////////////////////////

    normal_rectangle_width =[]

    for j in range(normal_range - index):
        
        normal_rectangle = (width_change[index])
        normal_rectangle_width.append(normal_rectangle)


# Insert rectangle
# /////////////////////////////////////////////////////////////////////////////////////////////////

    thin_place_remap = remap(thin_place, 0, 100, 0, normal_range)
    thin = int(thin_place_remap)

    normal_rectangle_width[thin:1] = width_change
    width_all = normal_rectangle_width    

# All planes
# /////////////////////////////////////////////////////////////////////////////////////////////////
 
    new_points =[]
    new_planes =[]
    new_rectangles =[]
 
    for k in range(len(width_all)):
        new_point = rg.Point3d(position_x,y_steps[z],k*10)
        new_points.append(new_point)
        vectorZ = rg.Vector3d.ZAxis

        new_pln = rg.Plane(new_point, vectorZ)
        new_planes.append(new_pln)

# Generate Units
# /////////////////////////////////////////////////////////////////////////////////////////////////

    for f in range(len(width_all)):
        
        width_interval = rg.Interval(-width_all[f], width_all[f])
        height_interval = rg.Interval(-height/2, height/2)
        new_rectangle = rg.Rectangle3d(new_planes[f], width_interval, height_interval) 
        new_rectangles.append(new_rectangle)


# 假設 list_of_rectangles 是你的 Rhino.Geometry.Rectangle3d 列表
list_of_rectangles = new_rectangles

# 將每個 Rectangle3d 轉換為 Curve
curves = [rect.ToNurbsCurve() for rect in list_of_rectangles]

# 執行 Loft 操作
loft = rs.AddLoftSrf(curves)
# ---------- end ironpython_2_script_10 ----------
brep = Brep(ironpython_2_script_10.loft)  # disabled

number_slider_33 = Slider(42, range=0..100)  # disabled
number_slider_34 = Slider(29, range=0..100)  # disabled
# Result 1
number_slider_35 = Slider(78, range=1..100)  # disabled
number_slider_36 = Slider(110, range=100..500)  # disabled
number_slider_37 = Slider(8, range=1..100)  # disabled
number_slider_38 = Slider(45, range=1..100)  # disabled
ironpython_2_script_11 = IronPython2Script(
    position_x=0,
    y=number_slider_35,
    normal_range=number_slider_36,
    thin_range=number_slider_33,
    thin_place=number_slider_34,
    height=number_slider_37,
    remap_range=number_slider_38)  # -> out, new_rectangles, loft; inputs y: Int32, normal_range: Int32, thin_range: Int32, thin_place: Int32; disabled; same code as ironpython_2_script_10
brep_2 = Brep(ironpython_2_script_11.loft)  # disabled

number_slider_39 = Slider(110, range=100..500)  # disabled
number_slider_40 = Slider(42, range=0..100)  # disabled
number_slider_41 = Slider(29, range=0..100)  # disabled
number_slider_42 = Slider(8, range=1..100)  # disabled
number_slider_43 = Slider(45, range=1..100)  # disabled
number_slider_44 = Slider(78, range=1..100)  # disabled
ironpython_2_script_12 = IronPython2Script(
    position_x=0,
    y=number_slider_44,
    normal_range=number_slider_39,
    thin_range=number_slider_40,
    thin_place=number_slider_41,
    height=number_slider_42,
    remap_range=number_slider_43)  # -> out, new_rectangles, loft; inputs y: Int32, normal_range: Int32, thin_range: Int32, thin_place: Int32; disabled; same code as ironpython_2_script_10
brep_3 = Brep(ironpython_2_script_12.loft)  # disabled

number_slider_45 = Slider(1, range=1..100)  # disabled
number_slider_46 = Slider(23, range=0..100)  # disabled
number_slider_47 = Slider(30, range=0..100)  # disabled
number_slider_48 = Slider(0, range=0..10)  # disabled
ironpython_2_script_13 = IronPython2Script(position_x=number_slider_48, y=number_slider_45, steps=number_slider_46, change=number_slider_47)  # -> out, points, new_planes, new_rectangles, units; inputs y: Int32, steps: Int32, change: Int32; disabled
# ---------- ironpython_2_script_13: IronPython ----------
import Rhino.Geometry as rg

y_steps =[]
units =[]

for z in range(y):
    step = 25*z
    y_steps.append(step)

    points = []
    planes = []
    rectangles = []


    for i in range(steps):
        point = rg.Point3d(position_x,y_steps[z],i*10)
        points.append(point)

        vectorZ = rg.Vector3d.ZAxis

        pln = rg.Plane(point, vectorZ) # Create plane with only z direction
        planes.append(pln)


    rectangles = []
    width = 10.0
    height = 10.0

    # we want to constrain width to a given range
    from_min = -width/2 * len(planes)
    from_max = width/2 * len(planes)

    to_min = -27.0
    to_max = 27.0

    def remap(value, from_min, from_max, to_min, to_max):
        # Calculate the proportion of the value within the original range
        proportion = (value - from_min) / (from_max - from_min)
        # Map the value to the target range using the proportion
        remapped_value = to_min + (proportion * (to_max - to_min))
        return remapped_value

    width_change = []

    for index, pln in enumerate(planes):
        if index > (len(planes)/2):
            width_change_0 = remap(width/2 * index, from_min, from_max, to_min, to_max)

            width_change.append(width_change_0)
        
        else:
            width_change_0 = remap(width/2 * (len(planes) - index), from_min, from_max, to_min, to_max)

            width_change.append(width_change_0)

    normal_rectangle_width =[]

    for j in range(100 - index):
        
        normal_rectangle = (width_change[index])
        normal_rectangle_width.append(normal_rectangle)

    normal_rectangle_width[change:1] = width_change
    width_all = normal_rectangle_width    

    new_points =[]
    new_planes =[]
    new_rectangles =[]

    for k in range(len(width_all)):
        new_point = rg.Point3d(position_x,y_steps[z],k*10)
        new_points.append(new_point)
        vectorZ = rg.Vector3d.ZAxis

        new_pln = rg.Plane(new_point, vectorZ)
        new_planes.append(new_pln)

    for f in range(len(width_all)):
        
        width_interval = rg.Interval(-width_all[f], width_all[f])
        height_interval = rg.Interval(-height/2, height/2)
        new_rectangle = rg.Rectangle3d(new_planes[f], width_interval, height_interval) 
        new_rectangles.append(new_rectangle)
    
units.append(new_rectangles)
# ---------- end ironpython_2_script_13 ----------
curve_4 = Curve(ironpython_2_script_13.new_rectangles)  # disabled

ironpython_2_script_14 = IronPython2Script(my_rectangles=ironpython_2_script_7.rectangles)  # -> out, lofted_shape; inputs my_rectangles: list of Curve; disabled
# ---------- ironpython_2_script_14: IronPython ----------
import Rhino.Geometry as rg
# import rhinoscriptsyntax as rs

my_nurbs_rectangles=[]
for rect in my_rectangles:
    print("before")
    print(rect)
    curve_rect = rect.ToNurbsCurve()
    print("after")
    print(curve_rect)
    my_nurbs_rectangles.append(curve_rect)

start_point = rg.Point3d(my_nurbs_rectangles[0].PointAtStart)
end_point = rg.Point3d(my_nurbs_rectangles[-1].PointAtStart)

lofted_shape = rg.Brep.CreateFromLoft(my_nurbs_rectangles, start_point, end_point, rg.LoftType.Normal, False)

# curves = [rect.ToNurbsCurve() for rect in my_rectangles]
# # 執行 Loft 操作
# lofted_shape = rs.AddLoftSrf(curves)
# ---------- end ironpython_2_script_14 ----------
data_recorder_3 = DataRecorder(brep_2, DataLimit=-10, RecordData=False)
brep_4 = Brep(ironpython_2_script_14.lofted_shape)  # disabled

data = Data([0, 1, 2, 3, 4, 5, 6, 7, 8, 9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])  # disabled
data_2 = Data([0, 1, 2, 3, 4, 5, 6, 7, 8, 9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])  # disabled
graph_mapper_5 = GraphMapper(data, x0=0, x1=100, y0=0, y1=100, container_name="Sine", Equation_px=[0, 1], Equation_py=[0, 0.7783486247])  # disabled
graph_mapper_6 = GraphMapper(data_2, x0=0, x1=100, y0=0, y1=100, container_name="Sine", Equation_px=[0, 1], Equation_py=[0.848549664, 0])  # disabled
number_slider_49 = Slider(12, range=0..50)  # disabled
number_slider_50 = Slider(13, range=0..50)  # disabled
number_slider_51 = Slider(100, range=0..100)  # disabled
ironpython_2_script_15 = IronPython2Script(
    Range=number_slider_49,
    Pattern=graph_mapper_5,
    Number=number_slider_51,
    Range_1=number_slider_50,
    Pattern_1=graph_mapper_6)  # -> out, Loft; inputs Pattern: list of Double, Number: Int32, Pattern_1: list of Double; disabled
# ---------- ironpython_2_script_15: IronPython ----------
import Rhino.Geometry as rg
import rhinoscriptsyntax as rs
import math
Timber_Length = 100  # 整個序列的總長度

Units = []
for Num in range(Number):
    def remap(value, from_min, from_max, to_min, to_max):
        # Calculate the proportion of the value within the original range
        proportion = (value - from_min) / (from_max - from_min)
        # Map the value to the target range using the proportion
        remapped_value = to_min + (proportion * (to_max - to_min))
        return remapped_value
    
    # 寬度變化量函式(並且加入List)

    width_list = []
    for i in range(Timber_Length):
        if Pattern[Num]  <= i < Pattern[Num] + 2 * Range:
            position_in_dom = i - Pattern[Num]
            if position_in_dom < Range:
                num = Range - position_in_dom 
            else:
                num = Range - (2 * Range - position_in_dom - 1)
        elif Pattern_1[Num]  <= i < Pattern_1[Num] + 2 * Range:
            position_in_dom = i - Pattern_1[Num]
            if position_in_dom < Range:
                num = Range_1 - position_in_dom 
            else:
                num = Range_1 - (2 * Range_1 - position_in_dom - 1)
        else:
            num = Range
        remap_num = remap(num, 0, Range, 0, 50)
        width_list.append(remap_num)
    
    # Planes List Build
    height = 10
    planes = []
    for i in range(Timber_Length):
        point = rg.Point3d(0, Num * height * 2, i * 10)
        vectorZ = rg.Vector3d.ZAxis
        plane = rg.Plane(point, vectorZ)
        planes.append(plane)
    
    # Rectangle List Build
    rectangles = []
    width_interval_list = []
    for i in range(Timber_Length):
        width_interval = rg.Interval(-width_list[i], width_list[i])
        height_interval = rg.Interval(-height / 2, height / 2)
        width_interval_list.append(width_interval)

        rectangle = rg.Rectangle3d(planes[i], width_interval_list[i], height_interval)
        rectangles.append(rectangle)
    
    # 將每個 Rectangle3d 轉換為 Curve
    curves = [rect.ToNurbsCurve() for rect in rectangles]
    
    # 執行 Loft 操作
    loft_guid = rs.AddLoftSrf(curves)
    Units.append(loft_guid)

# 將 GUID 轉換為 Brep
breps = [rs.coercebrep(guid) for guid in Units]

# 將結果輸出到 Rhino
Loft = breps
# ---------- end ironpython_2_script_15 ----------
colour_swatch = ColourSwatch(SwatchColor=RGB(130, 95, 46))  # disabled
custom_preview = CustomPreview(Geometry=ironpython_2_script_15.Loft, Material=colour_swatch)  # disabled

data_3 = Data([0, 1, 2, 3, 4, 5, 6, 7, 8, 9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])  # disabled
data_4 = Data([0, 1, 2, 3, 4, 5, 6, 7, 8, 9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])  # disabled
graph_mapper_7 = GraphMapper(data_3, x0=0, x1=100, y0=0, y1=100, container_name="Sine", Equation_px=[0, 1], Equation_py=[0, 0.7958258986])  # disabled
graph_mapper_8 = GraphMapper(data_4, x0=0, x1=100, y0=0, y1=100, container_name="Sine", Equation_px=[0, 1], Equation_py=[0.8345133662, 0.4396742582])  # disabled
number_slider_52 = Slider(9, range=0..50)  # disabled
number_slider_53 = Slider(100, range=0..100)  # disabled
ironpython_2_script_16 = IronPython2Script(
    Range=number_slider_52,
    Pattern=graph_mapper_7,
    Number=number_slider_53,
    Range_1=number_slider_52,
    Pattern_1=graph_mapper_8)  # -> out, Loft; inputs Pattern: list of Double, Number: Int32, Pattern_1: list of Double; disabled; same code as ironpython_2_script_15
colour_swatch_2 = ColourSwatch(SwatchColor=RGB(130, 95, 46))  # disabled
custom_preview_2 = CustomPreview(Geometry=ironpython_2_script_16.Loft, Material=colour_swatch_2)  # disabled

data_5 = Data([0, 1, 2, 3, 4, 5, 6, 7, 8, 9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])  # disabled
data_6 = Data([0, 1, 2, 3, 4, 5, 6, 7, 8, 9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])  # disabled
data_7 = Data([0, 1, 2, 3, 4, 5, 6, 7, 8, 9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])  # disabled
data_8 = Data([0, 1, 2, 3, 4, 5, 6, 7, 8, 9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])  # disabled
graph_mapper_9 = GraphMapper(
    data_5,
    x0=0,
    x1=100,
    y0=0,
    y1=100,
    container_name="Sine",
    Equation_px=[0, 0.4205286801],
    Equation_py=[0.131719172, 0.4125658274])  # disabled
graph_mapper_10 = GraphMapper(data_6, x0=0, x1=100, y0=0, y1=100, container_name="Sine", Equation_px=[0, 1], Equation_py=[0, 0.7958258986])  # disabled
graph_mapper_11 = GraphMapper(data_7, x0=0, x1=100, y0=0, y1=100, container_name="Sine", Equation_px=[0, 1], Equation_py=[0.6196855307, 0.4396742582])  # disabled
graph_mapper_12 = GraphMapper(
    data_8,
    x0=0,
    x1=100,
    y0=0,
    y1=100,
    container_name="Sinc",
    Equation_X0=0.2884061635,
    Equation_X1=0.6275369525,
    Equation_Y0=0.9768101573,
    Equation_Y1=0.2000007033)  # disabled
number_slider_54 = Slider(10, range=0..50)  # disabled
number_slider_55 = Slider(100, range=0..100)  # disabled
ironpython_2_script_17 = IronPython2Script(
    Height=graph_mapper_9,
    Range=number_slider_54,
    Pattern_0=graph_mapper_10,
    Pattern_1=graph_mapper_11,
    Pattern_2=graph_mapper_12,
    Number=number_slider_55)  # -> out, Loft; inputs Height: list of Int32, Pattern_0: list of Double, Pattern_1: list, Pattern_2: list of Double, Number: Int32; disabled
# ---------- ironpython_2_script_17: IronPython ----------
import Rhino.Geometry as rg
import rhinoscriptsyntax as rs
import math
Timber_Length = 100  # 整個序列的總長度

Units = []
for Num in range(Number):
    def remap(value, from_min, from_max, to_min, to_max):
        # Calculate the proportion of the value within the original range
        proportion = (value - from_min) / (from_max - from_min)
        # Map the value to the target range using the proportion
        remapped_value = to_min + (proportion * (to_max - to_min))
        return remapped_value
    # 寬度變化量函式(並且加入List)
    width_list = []
    for i in range(Timber_Length + Height[Num]):
        if Pattern_0[Num]  <= i < Pattern_0[Num] + 2 * Range:
            position_in_dom = i - Pattern_0[Num]
            if position_in_dom < Range:
                num = Range - position_in_dom 
            else:
                num = Range - (2 * Range - position_in_dom - 1)
        elif Pattern_1[Num]  <= i < Pattern_1[Num] + 2 * Range:
            position_in_dom = i - Pattern_1[Num]
            if position_in_dom < Range:
                num = Range - position_in_dom 
            else:
                num = Range - (2 * Range - position_in_dom - 1)
        elif Pattern_2[Num]  <= i < Pattern_2[Num] + 2 * Range:
            position_in_dom = i - Pattern_2[Num]
            if position_in_dom < Range:
                num = Range - position_in_dom 
            else:
                num = Range - (2 * Range - position_in_dom - 1)
        else:
            num = Range+1
        remap_num = remap(num, 0, Range, 0, 50)
        width_list.append(remap_num)
    
    # Planes List Build
    height = 10
    planes = []
    for i in range(Timber_Length + Height[Num]):
        point = rg.Point3d(0, Num * height * 2, i * 10)
        vectorZ = rg.Vector3d.ZAxis
        plane = rg.Plane(point, vectorZ)
        planes.append(plane)
    
    # Rectangle List Build
    rectangles = []
    width_interval_list = []
    for i in range(Timber_Length + Height[Num]):
        width_interval = rg.Interval(-width_list[i], width_list[i])
        height_interval = rg.Interval(-height / 2, height / 2)
        width_interval_list.append(width_interval)

        rectangle = rg.Rectangle3d(planes[i], width_interval_list[i], height_interval)
        rectangles.append(rectangle)
    
    # 將每個 Rectangle3d 轉換為 Curve
    curves = [rect.ToNurbsCurve() for rect in rectangles]
    
    # 執行 Loft 操作
    loft_guid = rs.AddLoftSrf(curves)
    Units.append(loft_guid)

# 將 GUID 轉換為 Brep
breps = [rs.coercebrep(guid) for guid in Units]

# 將結果輸出到 Rhino
Loft = breps
# ---------- end ironpython_2_script_17 ----------
colour_swatch_3 = ColourSwatch(SwatchColor=RGB(130, 95, 46))  # disabled
custom_preview_3 = CustomPreview(Geometry=ironpython_2_script_17.Loft, Material=colour_swatch_3)  # disabled

data_9 = Data([0, 1, 2, 3, 4, 5, 6, 7, 8, 9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])  # disabled
data_10 = Data([0, 1, 2, 3, 4, 5, 6, 7, 8, 9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])  # disabled
data_11 = Data([0, 1, 2, 3, 4, 5, 6, 7, 8, 9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])  # disabled
graph_mapper_13 = GraphMapper(
    data_9,
    x0=0,
    x1=100,
    y0=0,
    y1=100,
    container_name="Sine",
    Equation_px=[0, 0.4205286801],
    Equation_py=[0.131719172, 0.4125658274])  # disabled
graph_mapper_14 = GraphMapper(data_10, x0=0, x1=100, y0=0, y1=100, container_name="Sine", Equation_px=[0, 1], Equation_py=[0, 0.7958258986])  # disabled
graph_mapper_15 = GraphMapper(data_11, x0=0, x1=100, y0=0, y1=100, container_name="Sine", Equation_px=[0, 1], Equation_py=[0.8345133662, 0.4396742582])  # disabled
number_slider_56 = Slider(9, range=0..50)  # disabled
number_slider_57 = Slider(100, range=0..100)  # disabled
ironpython_2_script_18 = IronPython2Script(
    Height=graph_mapper_13,
    Range=number_slider_56,
    Pattern=graph_mapper_14,
    Pattern_1=graph_mapper_15,
    Number=number_slider_57)  # -> out, Loft; inputs Height: list of Int32, Pattern: list of Double, Pattern_1: list, Number: Int32; disabled
# ---------- ironpython_2_script_18: IronPython ----------
import Rhino.Geometry as rg
import rhinoscriptsyntax as rs
import math
Timber_Length = 100  # 整個序列的總長度

Units = []
for Num in range(Number):
    def remap(value, from_min, from_max, to_min, to_max):
        # Calculate the proportion of the value within the original range
        proportion = (value - from_min) / (from_max - from_min)
        # Map the value to the target range using the proportion
        remapped_value = to_min + (proportion * (to_max - to_min))
        return remapped_value
    # 寬度變化量函式(並且加入List)
    width_list = []
    for i in range(Timber_Length + Height[Num]):
        if Pattern[Num]  <= i < Pattern[Num] + 2 * Range:
            position_in_dom = i - Pattern[Num]
            if position_in_dom < Range:
                num = Range - position_in_dom 
            else:
                num = Range - (2 * Range - position_in_dom - 1)
        elif Pattern_1[Num]  <= i < Pattern_1[Num] + 2 * Range:
            position_in_dom = i - Pattern_1[Num]
            if position_in_dom < Range:
                num = Range - position_in_dom 
            else:
                num = Range - (2 * Range - position_in_dom - 1)
        else:
            num = Range
        remap_num = remap(num, 0, Range, 0, 50)
        width_list.append(remap_num)
    
    # Planes List Build
    height = 10
    planes = []
    for i in range(Timber_Length + Height[Num]):
        point = rg.Point3d(0, Num * height * 2, i * 10)
        vectorZ = rg.Vector3d.ZAxis
        plane = rg.Plane(point, vectorZ)
        planes.append(plane)
    
    # Rectangle List Build
    rectangles = []
    width_interval_list = []
    for i in range(Timber_Length + Height[Num]):
        width_interval = rg.Interval(-width_list[i], width_list[i])
        height_interval = rg.Interval(-height / 2, height / 2)
        width_interval_list.append(width_interval)

        rectangle = rg.Rectangle3d(planes[i], width_interval_list[i], height_interval)
        rectangles.append(rectangle)
    
    # 將每個 Rectangle3d 轉換為 Curve
    curves = [rect.ToNurbsCurve() for rect in rectangles]
    
    # 執行 Loft 操作
    loft_guid = rs.AddLoftSrf(curves)
    Units.append(loft_guid)

# 將 GUID 轉換為 Brep
breps = [rs.coercebrep(guid) for guid in Units]

# 將結果輸出到 Rhino
Loft = breps
# ---------- end ironpython_2_script_18 ----------
colour_swatch_4 = ColourSwatch(SwatchColor=RGB(130, 95, 46))  # disabled
custom_preview_4 = CustomPreview(Geometry=ironpython_2_script_18.Loft, Material=colour_swatch_4)  # disabled

data_12 = Data([0, 1, 2, 3, 4, 5, 6, 7, 8, 9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])  # disabled
graph_mapper_16 = GraphMapper(
    data_12,
    x0=0,
    x1=100,
    y0=0,
    y1=100,
    container_name="Sine",
    Equation_px=[0.009565712884, 1],
    Equation_py=[0, 0.6375360489])  # disabled

data_13 = Data([0, 1, 2, 3, 4, 5, 6, 7, 8, 9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])  # disabled
graph_mapper_17 = GraphMapper(
    data_13,
    x0=0,
    x1=100,
    y0=0,
    y1=100,
    amplitude=0.2828369141,
    container_name="Perlin",
    decay=0.3,
    frequency=0.01807966828,
    x_offset=0.5,
    y_offset=0.5)  # disabled
number_slider_58 = Slider(100, range=0..100)  # disabled
number_slider_59 = Slider(12, range=0..50)  # disabled
ironpython_2_script_19 = IronPython2Script(Range=number_slider_59, Pattern=graph_mapper_17, Number=number_slider_58)  # -> out, Loft; inputs Pattern: list, Number: Int32; disabled
# ---------- ironpython_2_script_19: IronPython ----------
import Rhino.Geometry as rg
import rhinoscriptsyntax as rs
import math
Timber_Length = 100  # 整個序列的總長度

Units = []
for Num in range(Number):
    def remap(value, from_min, from_max, to_min, to_max):
        # Calculate the proportion of the value within the original range
        proportion = (value - from_min) / (from_max - from_min)
        # Map the value to the target range using the proportion
        remapped_value = to_min + (proportion * (to_max - to_min))
        return remapped_value
    
    # 寬度變化量函式(並且加入List)

    width_list = []
    for i in range(Timber_Length):
        if Pattern[Num]  <= i < Pattern[Num] + 2 * Range:
            position_in_dom = i - Pattern[Num]
            if position_in_dom < Range:
                num = Range - position_in_dom 
            else:
                num = Range - (2 * Range - position_in_dom - 1)
        else:
            num = Range
        remap_num = remap(num, 0, Range, 0, 50)
        width_list.append(remap_num)
    
    # Planes List Build
    height = 10
    planes = []
    for i in range(Timber_Length):
        point = rg.Point3d(0, Num * height * 2, i * 10)
        vectorZ = rg.Vector3d.ZAxis
        plane = rg.Plane(point, vectorZ)
        planes.append(plane)
    
    # Rectangle List Build
    rectangles = []
    width_interval_list = []
    for i in range(Timber_Length):
        width_interval = rg.Interval(-width_list[i], width_list[i])
        height_interval = rg.Interval(-height / 2, height / 2)
        width_interval_list.append(width_interval)

        rectangle = rg.Rectangle3d(planes[i], width_interval_list[i], height_interval)
        rectangles.append(rectangle)
    
    # 將每個 Rectangle3d 轉換為 Curve
    curves = [rect.ToNurbsCurve() for rect in rectangles]
    
    # 執行 Loft 操作
    loft_guid = rs.AddLoftSrf(curves)
    Units.append(loft_guid)

# 將 GUID 轉換為 Brep
breps = [rs.coercebrep(guid) for guid in Units]

# 將結果輸出到 Rhino
Loft = breps
# ---------- end ironpython_2_script_19 ----------
brep_5 = Brep(ironpython_2_script_19.Loft)  # disabled

# ---- group: Test
number_slider_60 = Slider(100, range=0..100)  # disabled
graph_mapper_18 = GraphMapper(number_slider_60, x0=0, x1=100, y0=0, y1=100, Ox=0.5, Oy=0, Px=0.75, Py=0.25, container_name="Parabola")  # disabled
ironpython_2_script_20 = IronPython2Script(Range=8, Start_Index=graph_mapper_18, Number=number_slider_60)  # -> out, Loft; disabled
# ---------- ironpython_2_script_20: IronPython ----------
import Rhino.Geometry as rg
import rhinoscriptsyntax as rs
Timber_Length = 100  # 整個序列的總長度
# Range = 變化數列的最大值
# Start_Index = 變化數列開始的位置
# Remap 函數式
def remap(value, from_min, from_max, to_min, to_max):
        # Calculate the proportion of the value within the original range
        proportion = (value - from_min) / (from_max - from_min)
        # Map the value to the target range using the proportion
        remapped_value = to_min + (proportion * (to_max - to_min))
        return remapped_value
# 寬度變化量函式(並且加入List)
width_list =[]
for i in range(Timber_Length):
    if Start_Index <= i < Start_Index + 2*Range:
        position_in_dom = i - Start_Index
        if position_in_dom < Range:
            num = Range - position_in_dom
        else:
            num = Range - (2*Range - position_in_dom - 1)
    else:
        num = Range
    remap_num = remap(num, 0, Range, 0, 50)
    width_list.append(remap_num)
# Planes List Build
height = 10
planes =[]
for i in range(Timber_Length):
    point = rg.Point3d(0, Number*height*2, i*10)

    vectorZ = rg.Vector3d.ZAxis
    plane = rg.Plane(point, vectorZ)
    planes.append(plane)
# Rectangle List Build
rectangles =[]
width_interval_list =[]
for i in range(Timber_Length):
    width_interval = rg.Interval(-width_list[i], width_list[i])
    height_interval = rg.Interval(-height/2, height/2)
    width_interval_list.append(width_interval)

    rectangle = rg.Rectangle3d(planes[i],width_interval_list[i],height_interval)
    rectangles.append(rectangle)
# 將每個 Rectangle3d 轉換為 Curve
curves = [rect.ToNurbsCurve() for rect in rectangles]
# 執行 Loft 操作
Loft = rs.AddLoftSrf(curves)
# ---------- end ironpython_2_script_20 ----------
data_recorder_4 = DataRecorder(ironpython_2_script_20.Loft, DataLimit=-10, RecordData=False)  # disabled

# ----
# Result 2 (optimization)
number_slider_61 = Slider(12, range=0..50)  # disabled
number_slider_62 = Slider(44, range=-100..100)  # disabled
number_slider_63 = Slider(0, range=0..50)  # disabled
ironpython_2_script_21 = IronPython2Script(Range=number_slider_61, Start_Index=number_slider_62, Number=number_slider_63)  # -> out, Loft; disabled; same code as ironpython_2_script_20

number_slider_64 = Slider(8, range=0..50)  # disabled
number_slider_65 = Slider(24, range=-100..100)  # disabled
number_slider_66 = Slider(100, range=0..100)  # disabled
ironpython_2_script_22 = IronPython2Script(Range=number_slider_64, Start_Index=number_slider_65, Number=number_slider_66)  # -> out, Loft; inputs Number: Int32; disabled
# ---------- ironpython_2_script_22: IronPython ----------
import Rhino.Geometry as rg
import rhinoscriptsyntax as rs

Timber_Length = 100  # 整個序列的總長度

Units = []
for Num in range(Number):
    def remap(value, from_min, from_max, to_min, to_max):
        # Calculate the proportion of the value within the original range
        proportion = (value - from_min) / (from_max - from_min)
        # Map the value to the target range using the proportion
        remapped_value = to_min + (proportion * (to_max - to_min))
        return remapped_value
    
    # 寬度變化量函式(並且加入List)
    width_list = []
    for i in range(Timber_Length):
        if Start_Index  <= i < Start_Index + 2 * Range:
            position_in_dom = i - Start_Index
            if position_in_dom < Range:
                num = Range - position_in_dom 
            else:
                num = Range - (2 * Range - position_in_dom - 1)
        else:
            num = Range
        remap_num = remap(num, 0, Range, 0, 50)
        width_list.append(remap_num)
    
    # Planes List Build
    height = 10
    planes = []
    for i in range(Timber_Length):
        point = rg.Point3d(0, Num * height * 2, i * 10)
        vectorZ = rg.Vector3d.ZAxis
        plane = rg.Plane(point, vectorZ)
        planes.append(plane)
    
    # Rectangle List Build
    rectangles = []
    width_interval_list = []
    for i in range(Timber_Length):
        width_interval = rg.Interval(-width_list[i], width_list[i])
        height_interval = rg.Interval(-height / 2, height / 2)
        width_interval_list.append(width_interval)

        rectangle = rg.Rectangle3d(planes[i], width_interval_list[i], height_interval)
        rectangles.append(rectangle)
    
    # 將每個 Rectangle3d 轉換為 Curve
    curves = [rect.ToNurbsCurve() for rect in rectangles]
    
    # 執行 Loft 操作
    loft_guid = rs.AddLoftSrf(curves)
    Units.append(loft_guid)

# 將 GUID 轉換為 Brep
breps = [rs.coercebrep(guid) for guid in Units]

# 將結果輸出到 Rhino
Loft = breps
# ---------- end ironpython_2_script_22 ----------
brep_6 = Brep(ironpython_2_script_22.Loft)  # disabled

number_slider_67 = Slider(8, range=0..50)  # disabled
number_slider_68 = Slider(-31, range=-100..100)  # disabled
number_slider_69 = Slider(3, range=0..50)  # disabled
ironpython_2_script_23 = IronPython2Script(Range=number_slider_67, Start_Index=number_slider_68, Number=number_slider_69)  # -> out, Loft; inputs Number: Int32; disabled
# ---------- ironpython_2_script_23: IronPython ----------
import Rhino.Geometry as rg
import rhinoscriptsyntax as rs
Timber_Length = 100  # 整個序列的總長度
# Range = 變化數列的最大值
# Start_Index = 變化數列開始的位置
# Remap 函數式

Units =[]
for Num in range(Number):
    def remap(value, from_min, from_max, to_min, to_max):
            # Calculate the proportion of the value within the original range
            proportion = (value - from_min) / (from_max - from_min)
            # Map the value to the target range using the proportion
            remapped_value = to_min + (proportion * (to_max - to_min))
            return remapped_value
    # 寬度變化量函式(並且加入List)
    width_list =[]
    for i in range(Timber_Length):
        if Start_Index <= i < Start_Index + 2*Range:
            position_in_dom = i - Start_Index
            if position_in_dom < Range:
                num = Range - position_in_dom
            else:
                num = Range - (2*Range - position_in_dom - 1)
        else:
            num = Range
        remap_num = remap(num, 0, Range, 0, 50)
        width_list.append(remap_num)
    # Planes List Build
    height = 10
    planes =[]
    for i in range(Timber_Length):
        point = rg.Point3d(0, Num*height*2, i*10)

        vectorZ = rg.Vector3d.ZAxis
        plane = rg.Plane(point, vectorZ)
        planes.append(plane)
    # Rectangle List Build
    rectangles =[]
    width_interval_list =[]
    for i in range(Timber_Length):
        width_interval = rg.Interval(-width_list[i], width_list[i])
        height_interval = rg.Interval(-height/2, height/2)
        width_interval_list.append(width_interval)

        rectangle = rg.Rectangle3d(planes[i],width_interval_list[i],height_interval)
        rectangles.append(rectangle)
    # 將每個 Rectangle3d 轉換為 Curve
    curves = [rect.ToNurbsCurve() for rect in rectangles]
    # 執行 Loft 操作
    loft = rs.AddLoftSrf(curves)
    Units.append(loft)



breps = [rs.coercebrep(guid) for guid in Units]
Loft = Units
print(Loft)
# ---------- end ironpython_2_script_23 ----------

# ---- group: Series
# Process 2
number_slider_70 = Slider(10, range=0..50)  # disabled
number_slider_71 = Slider(50, range=0..50)  # disabled
ironpython_2_script_24 = IronPython2Script(Num=number_slider_70, Dom=number_slider_71)  # -> out, a; inputs Dom: Int32; disabled
# ---------- ironpython_2_script_24: IronPython ----------
import Rhino.Geometry as rg

for i in range(Dom):
    if i < Num:
        num = Num - i
    elif i < 2 * Num - 1 :
        num = i - Num + 2
    else:
        num = Num
    print(num)
# ---------- end ironpython_2_script_24 ----------

# ---- group: List
number_slider_72 = Slider(14, range=0..50)  # disabled
number_slider_73 = Slider(37, range=0..100)  # disabled
ironpython_2_script_25 = IronPython2Script(Num=number_slider_72, Start_Index=number_slider_73)  # -> out, a; disabled
# ---------- ironpython_2_script_25: IronPython ----------
import Rhino.Geometry as rg

Timber_Length = 100  # 整個序列的總長度
# Num = 變化數列的最大值
# Start_Index = 變化數列開始的位置

# Remap 函數式
def remap(value, from_min, from_max, to_min, to_max):
        # Calculate the proportion of the value within the original range
        proportion = (value - from_min) / (from_max - from_min)
        # Map the value to the target range using the proportion
        remapped_value = to_min + (proportion * (to_max - to_min))
        return remapped_value

width_list =[]
for i in range(Timber_Length):
    if Start_Index <= i < Start_Index + 2*Num:
        position_in_dom = i - Start_Index
        if position_in_dom < Num:
            num = Num - position_in_dom
        else:
            num = Num - (2*Num - position_in_dom - 1)
    else:
        num = Num
    remap_num = remap(num, 0, Num, 0, 100)

    width_list.append(remap_num)

print(width_list)
# ---------- end ironpython_2_script_25 ----------

# ---- group: Change range & Position
number_slider_74 = Slider(8, range=0..50)  # disabled
number_slider_75 = Slider(13, range=0..50)  # disabled
ironpython_2_script_26 = IronPython2Script(Num=number_slider_75, Start_Index=number_slider_74)  # -> out, a; disabled
# ---------- ironpython_2_script_26: IronPython ----------
import Rhino.Geometry as rg

Timber_Length = 100  # 整個序列的總長度
# Num = 變化數列的最大值
# Start_Index = 變化數列開始的位置

for i in range(Timber_Length):
    if Start_Index <= i < Start_Index + 2*Num:
        position_in_dom = i - Start_Index
        if position_in_dom < Num:
            num = Num - position_in_dom
        else:
            num = Num - (2*Num - position_in_dom - 1)
    else:
        num = Num
    print(num)
# ---------- end ironpython_2_script_26 ----------

# ---- group: Remap
number_slider_76 = Slider(14, range=0..50)  # disabled
number_slider_77 = Slider(37, range=0..100)  # disabled
ironpython_2_script_27 = IronPython2Script(Num=number_slider_76, Start_Index=number_slider_77)  # -> out, a; disabled
# ---------- ironpython_2_script_27: IronPython ----------
import Rhino.Geometry as rg

Timber_Length = 100  # 整個序列的總長度
# Num = 變化數列的最大值
# Start_Index = 變化數列開始的位置

# Remap 函數式
def remap(value, from_min, from_max, to_min, to_max):
        # Calculate the proportion of the value within the original range
        proportion = (value - from_min) / (from_max - from_min)
        # Map the value to the target range using the proportion
        remapped_value = to_min + (proportion * (to_max - to_min))
        return remapped_value

for i in range(Timber_Length):
    if Start_Index <= i < Start_Index + 2*Num:
        position_in_dom = i - Start_Index
        if position_in_dom < Num:
            num = Num - position_in_dom
        else:
            num = Num - (2*Num - position_in_dom - 1)
    else:
        num = Num
    remap_num = remap(num, 0, Num, 0, 100)

    print(remap_num)
# ---------- end ironpython_2_script_27 ----------

# ---- group: Interal Rectangle
number_slider_78 = Slider(21, range=0..50)  # disabled
number_slider_79 = Slider(27, range=-100..100)  # disabled
ironpython_2_script_28 = IronPython2Script(Num=number_slider_78, Start_Index=number_slider_79)  # -> out, a; disabled
# ---------- ironpython_2_script_28: IronPython ----------
import Rhino.Geometry as rg

Timber_Length = 100  # 整個序列的總長度
# Num = 變化數列的最大值
# Start_Index = 變化數列開始的位置
# Remap 函數式
def remap(value, from_min, from_max, to_min, to_max):
        # Calculate the proportion of the value within the original range
        proportion = (value - from_min) / (from_max - from_min)
        # Map the value to the target range using the proportion
        remapped_value = to_min + (proportion * (to_max - to_min))
        return remapped_value
# 寬度變化量函式(並且加入List)
width_list =[]
for i in range(Timber_Length):
    if Start_Index <= i < Start_Index + 2*Num:
        position_in_dom = i - Start_Index
        if position_in_dom < Num:
            num = Num - position_in_dom
        else:
            num = Num - (2*Num - position_in_dom - 1)
    else:
        num = Num
    remap_num = remap(num, 0, Num, 0, 50)
    width_list.append(remap_num)

# Planes List Build
planes =[]
for i in range(Timber_Length):
    point = rg.Point3d(0, 0, i*10)

    vectorZ = rg.Vector3d.ZAxis
    plane = rg.Plane(point, vectorZ)
    planes.append(plane)

# Rectangle List Build
height = 10
rectangles =[]
width_interval_list =[]
for i in range(Timber_Length):
    width_interval = rg.Interval(-width_list[i], width_list[i])
    height_interval = rg.Interval(-height/2, height/2)
    width_interval_list.append(width_interval)

    rectangle = rg.Rectangle3d(planes[i],width_interval_list[i],height_interval)
    rectangles.append(rectangle)




a = rectangles






print(width_list)
# ---------- end ironpython_2_script_28 ----------

# ---- group: Array
number_slider_80 = Slider(19, range=0..50)  # disabled
number_slider_81 = Slider(15, range=-100..100)  # disabled
number_slider_82 = Slider(0, range=0..50)  # disabled
ironpython_2_script_29 = IronPython2Script(Range=number_slider_80, Start_Index=number_slider_81, Number=number_slider_82)  # -> out, a; disabled
# ---------- ironpython_2_script_29: IronPython ----------
import Rhino.Geometry as rg
import rhinoscriptsyntax as rs
Timber_Length = 100  # 整個序列的總長度
# Range = 變化數列的最大值
# Start_Index = 變化數列開始的位置
# Remap 函數式
def remap(value, from_min, from_max, to_min, to_max):
        # Calculate the proportion of the value within the original range
        proportion = (value - from_min) / (from_max - from_min)
        # Map the value to the target range using the proportion
        remapped_value = to_min + (proportion * (to_max - to_min))
        return remapped_value
# 寬度變化量函式(並且加入List)
width_list =[]
for i in range(Timber_Length):
    if Start_Index <= i < Start_Index + 2*Range:
        position_in_dom = i - Start_Index
        if position_in_dom < Range:
            num = Range - position_in_dom
        else:
            num = Range - (2*Range - position_in_dom - 1)
    else:
        num = Range
    remap_num = remap(num, 0, Range, 0, 50)
    width_list.append(remap_num)
# Planes List Build
height = 10
planes =[]
for i in range(Timber_Length):
    point = rg.Point3d(0, Number*height*2, i*10)

    vectorZ = rg.Vector3d.ZAxis
    plane = rg.Plane(point, vectorZ)
    planes.append(plane)
# Rectangle List Build
rectangles =[]
width_interval_list =[]
for i in range(Timber_Length):
    width_interval = rg.Interval(-width_list[i], width_list[i])
    height_interval = rg.Interval(-height/2, height/2)
    width_interval_list.append(width_interval)

    rectangle = rg.Rectangle3d(planes[i],width_interval_list[i],height_interval)
    rectangles.append(rectangle)




a = rectangles






print(width_list)
# ---------- end ironpython_2_script_29 ----------

# ---- group: Loft
number_slider_83 = Slider(8, range=0..50)  # disabled
number_slider_84 = Slider(-31, range=-100..100)  # disabled
number_slider_85 = Slider(0, range=0..50)  # disabled
ironpython_2_script_30 = IronPython2Script(Range=number_slider_83, Start_Index=number_slider_84, Number=number_slider_85)  # -> out, Loft; disabled; same code as ironpython_2_script_20

# ---- group: Rectangle
number_slider_86 = Slider(27, range=0..50)  # disabled
number_slider_87 = Slider(21, range=0..100)  # disabled
ironpython_2_script_31 = IronPython2Script(Num=number_slider_86, Start_Index=number_slider_87)  # -> out, a; disabled
# ---------- ironpython_2_script_31: IronPython ----------
import Rhino.Geometry as rg

Timber_Length = 100  # 整個序列的總長度
# Num = 變化數列的最大值
# Start_Index = 變化數列開始的位置

# Remap 函數式
def remap(value, from_min, from_max, to_min, to_max):
        # Calculate the proportion of the value within the original range
        proportion = (value - from_min) / (from_max - from_min)
        # Map the value to the target range using the proportion
        remapped_value = to_min + (proportion * (to_max - to_min))
        return remapped_value
# 寬度變化量函式(並且加入List)
width_list =[]
for i in range(Timber_Length):
    if Start_Index <= i < Start_Index + 2*Num:
        position_in_dom = i - Start_Index
        if position_in_dom < Num:
            num = Num - position_in_dom
        else:
            num = Num - (2*Num - position_in_dom - 1)
    else:
        num = Num
    remap_num = remap(num, 0, Num, 0, 100)
    width_list.append(remap_num)

# Planes List Build
planes =[]
for i in range(Timber_Length):
    point = rg.Point3d(0, 0, i*10)

    vectorZ = rg.Vector3d.ZAxis
    plane = rg.Plane(point, vectorZ)
    planes.append(plane)

# Rectangle List Build
rectangles =[]
for i in range(Timber_Length):
    rectangle = rg.Rectangle3d(planes[i],width_list[i],10)
    rectangles.append(rectangle)




a = rectangles






print(width_list)
# ---------- end ironpython_2_script_31 ----------

# ----
number_slider_88 = Slider(100, range=0..100)  # disabled
number_slider_89 = Slider(24, range=0..50)  # disabled
ironpython_2_script_32 = IronPython2Script(Range=number_slider_89, Pattern=graph_mapper_16, Number=number_slider_88)  # -> out, Loft; inputs Pattern: list, Number: Int32; disabled; same code as ironpython_2_script_19

data_recorder_5 = DataRecorder(ironpython_2_script_21.Loft, DataLimit=-10, RecordData=False)  # disabled
colour_swatch_5 = ColourSwatch(SwatchColor=RGB(130, 95, 46))  # disabled
custom_preview_5 = CustomPreview(Geometry=ironpython_2_script_32.Loft, Material=colour_swatch_5)  # disabled

number_slider_90 = Slider(5, range=0..50)  # disabled
number_slider_91 = Slider(12, range=0..50)  # disabled
number_slider_92 = Slider(5, range=0..50)  # disabled
number_slider_93 = Slider(20, range=0..50)  # disabled
ironpython_2_script_33 = IronPython2Script(Num=number_slider_92, Start_Index=number_slider_93, Num_1=number_slider_90, Start_Index_1=number_slider_91)  # -> out, a; disabled
# ---------- ironpython_2_script_33: IronPython ----------
import Rhino.Geometry as rg

Timber_Length = 100  # 整個序列的總長度
# Num = 變化數列的最大值
# Start_Index = 變化數列開始的位置

for i in range(Timber_Length):
    if Start_Index <= i < Start_Index + 2*Num:
        position_in_dom = i - Start_Index
        if position_in_dom < Num:
            num = Num - position_in_dom
        else:
            num = Num - (2*Num - position_in_dom - 1)
    elif Start_Index_1 <= i < Start_Index_1 + 2*Num_1:
        position_in_dom = i - Start_Index_1
        if position_in_dom < Num_1:
            num = Num_1 - position_in_dom
        else:
            num = Num_1 - (2*Num_1 - position_in_dom - 1)
    else:
        num = Num

    a = num
    print(num)
# ---------- end ironpython_2_script_33 ----------

number_slider_94 = Slider(0, range=0..10)  # disabled
number_slider_95 = Slider(0, range=0..10)  # disabled
number_slider_96 = Slider(10, range=0..10)  # disabled
number_slider_97 = Slider(10, range=0..10)  # disabled
number_slider_98 = Slider(7, range=0..10)  # disabled
number_slider_99 = Slider(0, range=0..10)  # disabled
number_slider_100 = Slider(0, range=0..10)  # disabled
# Process 1
number_slider_101 = Slider(0, range=0..10)  # disabled
number_slider_102 = Slider(0, range=0..10)  # disabled
number_slider_103 = Slider(100, range=100..500)  # disabled
number_slider_104 = Slider(8, range=1..100)  # disabled
number_slider_105 = Slider(100, range=1..100)  # disabled
ironpython_2_script_34 = IronPython2Script(x=number_slider_94, y=number_slider_95, number=number_slider_96)  # -> out, point, points, planes, rectangles; inputs number: Int32; disabled
# ---------- ironpython_2_script_34: IronPython ----------
import Rhino.Geometry as rg

points = []
planes = []
rectangles = []

for i in range(number):
    point = rg.Point3d(x,y,i*10)
    points.append(point)

    vectorZ = rg.Vector3d.ZAxis

    pln = rg.Plane(point, vectorZ) # Create plane with only z direction
    
    planes.append(pln)
    width = 10.0
    height = 10.0
    
    rectangle = rg.Rectangle3d(pln, width, height)
    rectangles.append(rectangle)

    # Rectangle around a center point
    width_interval = rg.Interval(-width/2, width/2)
    height_interval = rg.Interval(-height/2, height/2)
    
    rectangle = rg.Rectangle3d(pln, width_interval, height_interval)
    rectangles.append(rectangle)
# ---------- end ironpython_2_script_34 ----------
ironpython_2_script_35 = IronPython2Script(x=number_slider_100, y=number_slider_97, number=number_slider_98)  # -> out, point, points, planes, rectangles; inputs number: Int32; disabled
# ---------- ironpython_2_script_35: IronPython ----------
import Rhino.Geometry as rg

points = []
planes = []
rectangles = []

for i in range(number):
    point = rg.Point3d(x,y,i*10)
    points.append(point)

    vectorZ = rg.Vector3d.ZAxis

    pln = rg.Plane(point, vectorZ) # Create plane with only z direction
    planes.append(pln)
# ---------- end ironpython_2_script_35 ----------
ironpython_2_script_36 = IronPython2Script(x=number_slider_101, y=number_slider_99, z=number_slider_102)  # -> out, point, pln, rectangle; disabled
# ---------- ironpython_2_script_36: IronPython ----------
import Rhino.Geometry as rg

point = rg.Point3d(x,y,z)

# x_value = point.X
# a = x_value
# print(x_value)


vector = rg.Vector3d(0,0,1)
vectorZ = rg.Vector3d.ZAxis
xax = rg.Vector3d.XAxis
yax = rg.Vector3d.YAxis


pln = rg.Plane(point, vectorZ) # Create plane with only z direction
pln = rg.Plane(point, xax, yax) # Create plane with x and y direction

width = 10.0
height = 10.0

rectangle = rg.Rectangle3d(pln, width, height)

# Rectangle around a center point
width_interval = rg.Interval(-width/2, width/2)
height_interval = rg.Interval(-height/2, height/2)

rectangle = rg.Rectangle3d(pln, width_interval, height_interval)
# ---------- end ironpython_2_script_36 ----------
graph_mapper_19 = GraphMapper(
    number_slider_105,
    x0=0,
    x1=100,
    y0=100,
    y1=300,
    amplitude=0.5,
    container_name="Perlin",
    decay=0.3,
    frequency=0.1,
    x_offset=0.5,
    y_offset=0.5)  # disabled
plane_4 = Plane(ironpython_2_script_34.planes)  # disabled
plane_5 = Plane(ironpython_2_script_36.pln)  # disabled
point_4 = Point(ironpython_2_script_35.points)  # disabled
curve_5 = Curve(ironpython_2_script_36.rectangle)  # disabled
point_5 = Point(ironpython_2_script_34.points)  # disabled
curve_6 = Curve(ironpython_2_script_34.rectangles)  # disabled
ironpython_2_script_37 = IronPython2Script(planes=ironpython_2_script_35.planes)  # -> out, rectangles; inputs planes: list; disabled
# ---------- ironpython_2_script_37: IronPython ----------
import Rhino.Geometry as rg

rectangles = []
width = 10.0
height = 10.0

# we want to constrain width to a given range
from_min = -width/2 * len(planes)
from_max = width/2 * len(planes)

to_min = -27.0
to_max = 27.0

def remap(value, from_min, from_max, to_min, to_max):
    # Calculate the proportion of the value within the original range
    proportion = (value - from_min) / (from_max - from_min)
    # Map the value to the target range using the proportion
    remapped_value = to_min + (proportion * (to_max - to_min))
    return remapped_value

for index, pln in enumerate(planes):
      remapped_interval_0 = remap(-width/2 * index, from_min, from_max, to_min, to_max)
      remapped_interval_1 = remap(width/2 * index, from_min, from_max, to_min, to_max)
      width_interval = rg.Interval(remapped_interval_0, remapped_interval_1)

      height_interval = rg.Interval(-height/2, height/2)
      rectangle = rg.Rectangle3d(pln, width_interval, height_interval)
      rectangles.append(rectangle)
# ---------- end ironpython_2_script_37 ----------
data_recorder_6 = DataRecorder(DataLimit=-10, RecordData=False)
curve_7 = Curve(ironpython_2_script_9.new_rectangles)  # disabled

number_slider_106 = Slider(62, range=0..100)  # disabled
number_slider_107 = Slider(14, range=0..100)  # disabled
ironpython_2_script_38 = IronPython2Script(
    position_x=0,
    y=number_slider_105,
    normal_range=graph_mapper_19,
    thin_range=number_slider_106,
    thin_place=number_slider_107,
    height=number_slider_104,
    remap_range=Slider(45, range=1..100))  # -> out, new_rectangles; inputs y: Int32, normal_range: Int32, thin_range: Int32, thin_place: Int32; disabled
# ---------- ironpython_2_script_38: IronPython ----------
import Rhino.Geometry as rg

# Y-direction move
# /////////////////////////////////////////////////////////////////////////////////////////////////

y_steps =[]

for z in range(y):
    step = height*2*z
    y_steps.append(step)

    points = []
    planes = []
    rectangles = []

# Change rectangle Part
# /////////////////////////////////////////////////////////////////////////////////////////////////
    for i in range(thin_range):
        point = rg.Point3d(position_x,y_steps[z],i*10)
        points.append(point)

        vectorZ = rg.Vector3d.ZAxis

        pln = rg.Plane(point, vectorZ) # Create plane with only z direction
        planes.append(pln)

    rectangles = []
    width = 10.0


    # we want to constrain width to a given range
    from_min = -width/2 * len(planes)
    from_max = width/2 * len(planes)

    to_min = -remap_range
    to_max = remap_range

    def remap(value, from_min, from_max, to_min, to_max):
        # Calculate the proportion of the value within the original range
        proportion = (value - from_min) / (from_max - from_min)
        # Map the value to the target range using the proportion
        remapped_value = to_min + (proportion * (to_max - to_min))
        return remapped_value

    width_change = []

    for index, pln in enumerate(planes):
        if index > (len(planes)/2):
            width_change_0 = remap(width/2 * index, from_min, from_max, to_min, to_max)

            width_change.append(width_change_0)        
        else:
            width_change_0 = remap(width/2 * (len(planes) - index), from_min, from_max, to_min, to_max)

            width_change.append(width_change_0)


# Normal rectangle
# /////////////////////////////////////////////////////////////////////////////////////////////////

    normal_rectangle_width =[]

    for j in range(normal_range - index):
        
        normal_rectangle = (width_change[index])
        normal_rectangle_width.append(normal_rectangle)


# Insert rectangle
# /////////////////////////////////////////////////////////////////////////////////////////////////

    thin_place_remap = remap(thin_place, 0, 100, 0, normal_range)
    thin = int(thin_place_remap)

    normal_rectangle_width[thin:1] = width_change
    width_all = normal_rectangle_width    

# All planes
# /////////////////////////////////////////////////////////////////////////////////////////////////
 
    new_points =[]
    new_planes =[]
    new_rectangles =[]
 
    for k in range(len(width_all)):
        new_point = rg.Point3d(position_x,y_steps[z],k*10)
        new_points.append(new_point)
        vectorZ = rg.Vector3d.ZAxis

        new_pln = rg.Plane(new_point, vectorZ)
        new_planes.append(new_pln)

# Generate Units
# /////////////////////////////////////////////////////////////////////////////////////////////////

    for f in range(len(width_all)):
        
        width_interval = rg.Interval(-width_all[f], width_all[f])
        height_interval = rg.Interval(-height/2, height/2)
        new_rectangle = rg.Rectangle3d(new_planes[f], width_interval, height_interval) 
        new_rectangles.append(new_rectangle)
# ---------- end ironpython_2_script_38 ----------
loft_9 = Loft(
    Curves=ironpython_2_script_38.new_rectangles,
    Options={Adjust=False, Closed=False, LoftEnds=0, LoftSimp=0, LoftType=0, Rebuild=10, Refit=0.01})  # disabled

data_recorder_7 = DataRecorder(loft_9, DataLimit=-10, RecordData=True)  # disabled
