# Grasshopper definition rectangles_dv.gh (Grasshopper 1.0.8)
# plug-ins: RhinoCodePluginGH

number_slider = Slider(0.434, range=0..15)
number_slider_2 = Slider(1.49, range=0..10)
number_slider_3 = Slider(3.1, range=0..10)

# ----
# SIMPLE SLAT
number_slider_4 = Slider(18, range=0..100)

# ----
# INITIAL POINTS
number_slider_5 = Slider(10, range=0..10)
number_slider_6 = Slider(0, range=0..1)
number_slider_7 = Slider(5, range=5..10)
number_slider_8 = Slider(7, range=0..10)
initial_planes = IronPython2Script(
    x=number_slider_7,
    y=number_slider_7,
    z=number_slider_6,
    distance_between_points=number_slider_5,
    number=number_slider_4,
    index=number_slider_8)  # -> planes, distances; inputs number: Int32, index: Int32
# ---------- initial_planes: IronPython ----------
import Rhino.Geometry as rg


points = []
vert_points = []
planes = []
initial_z = z
vector = rg.Vector3d(0,0,1)
distances = []

for i in range(number):
    if i == 0:
         point = rg.Point3d(x,y,initial_z)
         points.append(point)
         pln = rg.Plane(point, vector) # creating a plane with only z direction
         planes.append(pln)

    else:
        point = rg.Point3d(x,y,initial_z +distance_between_points)
        initial_z = initial_z + distance_between_points
        points.append(point)
        pln = rg.Plane(point, vector) # creating a plane with only z direction
        planes.append(pln)

center_point = points[index]

for i in points:
    line = (rg.Line(center_point,i))
    lenght = line.Length
    distances.append(lenght)
# ---------- end initial_planes ----------

negative = Negative(Value=number_slider)
addition = Addition(A=number_slider_8, B=1)

# ----
# DISTANCES
panel = Panel(initial_planes.distances)

# ----
# FINAL RECTANGLE AND LOFTING
morphing_the_rectangles_and_lofting = IronPython2Script(
    planes=initial_planes.planes,
    to_min=negative,
    to_max=number_slider,
    widht_1=number_slider_2,
    height_1=number_slider_3,
    distance=panel,
    selected_point=addition)  # -> out, rectangles, loft; inputs planes: list, distance: list of Int32
# ---------- morphing_the_rectangles_and_lofting: IronPython ----------
import Rhino.Geometry as rg
import rhinoscriptsyntax as rs
import math

rectangles = []
width = widht_1
height = height_1
plane_index = 0
# Define the sine function parameters
sine_amplitude = 0.5  # Adjust the amplitude of the sine wave
sine_frequency = 0.5  # Adjust the frequency of the sine wave

# we want to constrain width to a given range
from_min = -width/2 * len(planes)
from_max = width/2 * len(planes)

def remap(value, from_min, from_max, to_min, to_max):
    # Calculate the proportion of the value within the original range
    proportion = (value - from_min) / (from_max - from_min)
    # Map the value to the target range using the proportion
    remapped_value = to_min + (proportion * (to_max - to_min))
    return remapped_value

for i in distance:
    if i == 0:
        remapped_interval_0 = remap(width/2 * to_min, from_min, from_max, to_min, to_max)
        remapped_interval_1 = remap(-width/2 * to_min, from_min, from_max, to_min, to_max)
    # Apply sine function to modify the remapped width values
        sine_modifier = sine_amplitude * math.sin(sine_frequency * i)
      # Adjust the width intervals with the sine modifier
        width_interval = rg.Interval(remapped_interval_0 * (1 + sine_modifier), remapped_interval_1 * (1 + sine_modifier))
        height_interval = rg.Interval(-height/2, height/2)
        rectangle = rg.Rectangle3d(planes[plane_index], width_interval, height_interval)
        rectangles.append(rectangle)
        plane_index += 1
   
    else:
        remapped_interval_0 = remap(-width/2 * i, from_min, from_max, to_min, to_max)
        remapped_interval_1 = remap(width/2 * i, from_min, from_max, to_min, to_max)
    # Apply sine function to modify the remapped width values
        sine_modifier = sine_amplitude * math.sin(sine_frequency * i)
        
      # Adjust the width intervals with the sine modifier
        width_interval = rg.Interval(remapped_interval_0 * (1 + sine_modifier), remapped_interval_1 * (1 + sine_modifier))
        height_interval = rg.Interval(-height/2, height/2)
        rectangle = rg.Rectangle3d(planes[plane_index], width_interval, height_interval)
        rectangles.append(rectangle)
        plane_index += 1
    print(width_interval)

curves = []
for rect in rectangles:
    polyline = rect.ToPolyline()
    curve_id = rs.AddPolyline(polyline)
    curves.append(curve_id)

# Loft the curves using their GUIDs
loft = rs.AddLoftSrf(curves)
rs.CapPlanarHoles(loft)
# ---------- end morphing_the_rectangles_and_lofting ----------

data = Data(morphing_the_rectangles_and_lofting.loft)

# ----
# FACADE _ WITH GRASSHOPPER HELP FOR GRAFTING
initial_planes_in_x = IronPython2Script(
    x=number_slider_7,
    y=number_slider_7,
    z=number_slider_6,
    distance_between_points=number_slider_5,
    number=Slider(46, range=0..100),
    index=number_slider_8)  # -> planes; inputs number: Int32, index: Int32
# ---------- initial_planes_in_x: IronPython ----------
import Rhino.Geometry as rg


points = []
vert_points = []
planes = []
initial_x = x
vector = rg.Vector3d(0,0,1)
distances = []

for i in range(number):
    if i == 0:
         point = rg.Point3d(initial_x,y,z)
         points.append(point)
         pln = rg.Plane(point, vector) # creating a plane with only z direction
         planes.append(pln)

    else:
        point = rg.Point3d(initial_x + distance_between_points,y,z)
        initial_x = initial_x + distance_between_points
        points.append(point)
        pln = rg.Plane(point, vector) # creating a plane with only z direction
        planes.append(pln)

center_point = points[index]

for i in points:
    line = (rg.Line(center_point,i))
    lenght = line.Length
    distances.append(lenght)
# ---------- end initial_planes_in_x ----------
initial_rectangles = IronPython2Script(
    planes=initial_planes.planes,
    to_min=negative,
    to_max=number_slider,
    widht_1=number_slider_2,
    height_1=number_slider_3,
    distance=panel,
    selected_point=addition,
    number=number_slider_4)  # -> out, rectangles; inputs planes: list, distance: list of Int32, number: Int32
# ---------- initial_rectangles: IronPython ----------
import Rhino.Geometry as rg
import math

rectangles = []
width = widht_1
height = height_1
plane_index = 0

from_min = -width/2 * len(planes)
from_max = width/2 * len(planes)

def remap(value, from_min, from_max, to_min, to_max):
    # Calculate the proportion of the value within the original range
    proportion = (value - from_min) / (from_max - from_min)
    # Map the value to the target range using the proportion
    remapped_value = to_min + (proportion * (to_max - to_min))
    return remapped_value

for i in range(number):
    if i == 0:
        remapped_interval_0 = remap(width/2 * to_min, from_min, from_max, to_min, to_max)
        remapped_interval_1 = remap(-width/2 * to_min, from_min, from_max, to_min, to_max)

        width_interval = rg.Interval(remapped_interval_0, remapped_interval_1)
        height_interval = rg.Interval(-height/2, height/2)
        rectangle = rg.Rectangle3d(planes[plane_index], width_interval, height_interval)
        rectangles.append(rectangle)
        plane_index += 1
   
    else:
        remapped_interval_0 = remap(-width/2 * i, from_min, from_max, to_min, to_max)
        remapped_interval_1 = remap(width/2 * i, from_min, from_max, to_min, to_max)

        
      # Adjust the width intervals with the sine modifier
        width_interval = rg.Interval(remapped_interval_0, remapped_interval_1)
        height_interval = rg.Interval(-height/2, height/2)
        rectangle = rg.Rectangle3d(planes[plane_index], width_interval, height_interval)
        rectangles.append(rectangle)
        plane_index += 1
    print(width_interval)
# ---------- end initial_rectangles ----------
item = ListItem(List=initial_planes.planes, Index=0, Wrap=True)
grafting_and_orienting_the_rectangles = IronPython2Script(curves=initial_rectangles.rectangles, source_plane=item, target_plane=initial_planes_in_x)  # -> out, oriented_curves; inputs curves: list
# ---------- grafting_and_orienting_the_rectangles: IronPython ----------
import Rhino.Geometry as rg
import rhinoscriptsyntax as rs

# Initialize an empty list to store the oriented curves
oriented_curves = []

# Create the transformation from the source plane to the target plane
transformation = rg.Transform.PlaneToPlane(source_plane, target_plane)

# Convert GUIDs to Curve objects if needed
curves = [rs.coercecurve(guid) for guid in curves if rs.IsCurve(guid)]

for curve in curves:
    
    if isinstance(curve, rg.Curve):
       
        oriented_curve = curve.DuplicateCurve()
        
       
        oriented_curve.Transform(transformation)
        
       
        oriented_curves.append(oriented_curve)


a = oriented_curves
# ---------- end grafting_and_orienting_the_rectangles ----------

preview = CustomPreview(Geometry=data, Material=ColourSwatch(SwatchColor=RGB(237, 237, 237)))

ipy2 = IronPython2Script(x=grafting_and_orienting_the_rectangles.oriented_curves)  # -> out, a; inputs x: list
# ---------- ipy2: IronPython ----------
import random

# Inputs:
# 'min_val' is the minimum value of the range
# 'max_val' is the maximum value of the range

# Generate a random number between 'min_val' and 'max_val'
random_number = random.uniform(0, len(x))  # For a float between min_val and max_val
# OR
# random_number = random.randint(int(min_val), int(max_val))  # For an integer between min_val and max_val

# Output the random number
a = random_number
# ---------- end ipy2 ----------
grasshopper_help_for_grafting = GRASSHOPPERHELPFORGRAFTING(
    L=grafting_and_orienting_the_rectangles.oriented_curves,
    G=grafting_and_orienting_the_rectangles.oriented_curves,
    int=ipy2.a)  # -> P, L_2, i
remapping_and_lofting = IronPython2Script(
    planes=grasshopper_help_for_grafting.P,
    to_min=negative,
    to_max=number_slider,
    widht_1=number_slider_2,
    height_1=number_slider_3,
    distance=grasshopper_help_for_grafting.L_2,
    selected_point=grasshopper_help_for_grafting.i)  # -> out, rectangles, loft; inputs planes: list, distance: list of Int32
# ---------- remapping_and_lofting: IronPython ----------
import Rhino.Geometry as rg
import rhinoscriptsyntax as rs
import math

rectangles = []
width = widht_1
height = height_1
plane_index = 0
# Define the sine function parameters
sine_amplitude = 0.5  # Adjust the amplitude of the sine wave
sine_frequency = 0.5  # Adjust the frequency of the sine wave

# we want to constrain width to a given range
from_min = -width/2 * len(planes)
from_max = width/2 * len(planes)

def remap(value, from_min, from_max, to_min, to_max):
    # Calculate the proportion of the value within the original range
    proportion = (value - from_min) / (from_max - from_min)
    # Map the value to the target range using the proportion
    remapped_value = to_min + (proportion * (to_max - to_min))
    return remapped_value

for i in distance:
    if i == 0:
        remapped_interval_0 = remap(width/2 * to_min, from_min, from_max, to_min, to_max)
        remapped_interval_1 = remap(-width/2 * to_min, from_min, from_max, to_min, to_max)
    # Apply sine function to modify the remapped width values
        sine_modifier = sine_amplitude * math.sin(sine_frequency * i)
      # Adjust the width intervals with the sine modifier
        width_interval = rg.Interval(remapped_interval_0 * (1 + sine_modifier), remapped_interval_1 * (1 + sine_modifier))
        height_interval = rg.Interval(-height/2, height/2)
        rectangle = rg.Rectangle3d(planes[plane_index], width_interval, height_interval)
        rectangles.append(rectangle)
        plane_index += 1
   
    else:
        remapped_interval_0 = remap(-width/2 * i, from_min, from_max, to_min, to_max)
        remapped_interval_1 = remap(width/2 * i, from_min, from_max, to_min, to_max)
    # Apply sine function to modify the remapped width values
        sine_modifier = sine_amplitude * math.sin(sine_frequency * i)
        
      # Adjust the width intervals with the sine modifier
        width_interval = rg.Interval(remapped_interval_0 * (1 + sine_modifier), remapped_interval_1 * (1 + sine_modifier))
        height_interval = rg.Interval(-height/2, height/2)
        rectangle = rg.Rectangle3d(planes[plane_index], width_interval, height_interval)
        rectangles.append(rectangle)
        plane_index += 1
    print(width_interval)
curves = []
for rect in rectangles:
    polyline = rect.ToPolyline()
    curve_id = rs.AddPolyline(polyline)
    curves.append(curve_id)

# Loft the curves using their GUIDs
loft = rs.AddLoftSrf(curves)
rs.CapPlanarHoles(loft)
# ---------- end remapping_and_lofting ----------

# ==== cluster GRASSHOPPERHELPFORGRAFTING
G = ClusterInput()
area = Area(Geometry=G)  # -> Area, Centroid
int = ClusterInput()
int_2 = Integer(int)
L = ClusterInput()
item = ListItem(List=L, Index=int_2, Wrap=True)
xy = XYPlane(Origin=area.Centroid)
area_2 = Area(Geometry=item)  # -> Area, Centroid
i = ClusterOutput(item)
P = ClusterOutput(xy)
ln = Line(StartPoint=area.Centroid, EndPoint=area_2.Centroid)
len = Length(Curve=ln)
L_2 = ClusterOutput(len)
