# Grasshopper definition 301_ghpython_basics.ghx (Grasshopper 1.0.8)

# Interfacing with Rhino
# Creating a point
number_slider = Slider(1, range=1..10)
# Simple Python Example
# Let's add two numbers!
number_slider_2 = Slider(1, range=1..10)
py3 = Python3Script(x=Slider(7, range=1..10), y=Slider(4, range=1..10), z=Slider(4, range=1..10))  # -> out, a; inputs x: Int32, y: Int32, z: Int32
# ---------- py3: Python ----------
import compas
import compas.geometry as cg


a = cg.Point(x,y,z)
print(type(a))
# ---------- end py3 ----------
py3_2 = Python3Script(x=number_slider, y=Slider(4, range=1..10), z=Slider(4, range=1..10))  # -> out, a; inputs x: Int32, y: Int32, z: Int32
# ---------- py3_2: Python ----------
import Rhino
#This imports the Rhino namespace from RhinoCommon.dll in your Rhino installation
#Since we mostly want to deal with Geoemtry
#We will import the Rhino.Geometry namespace
import Rhino.Geometry as rg
#as means we can reference the module as the name without typing the whole thing
import Rhino.Geometry as cat
#this also work, but for sanity we stick with rg
import Rhino.Geometry as rg

#try rg.

a = rg.Point3d(x,y,z)
print(type(a))
# ---------- end py3_2 ----------
# This is the Grasshopper Python Component
# right "out" is python output messages(errors, messages, print outputs)
# left side is "inputs"
# (Don't forget "type hint" and "access")
# right variable 'a' can be named anything and can be assigned to your program output
py3_3 = Python3Script()  # -> out, a; unedited script template
py3_4 = Python3Script(x=number_slider_2, y=Slider(4, range=1..10))  # -> out, a; inputs x: Int32, y: Int32
# ---------- py3_4: Python ----------
a = x + y
print("I did it! I added {} and {}".format(x,y))
# ---------- end py3_4 ----------
addition = Addition(A=Slider(1, range=1..10), B=Slider(4, range=1..10))
panel = Panel(addition)
panel_2 = Panel(py3_4.a)
panel_3 = Panel(py3.a)
py3_5 = Python3Script(cg=py3.a)  # -> rg
# ---------- py3_5: Python ----------
"""
Draws COMPAS geometry in Grasshopper.
"""

from ghpythonlib.componentbase import executingcomponent as component

from compas.scene import SceneObject


class CompasToRhinoGeometry(component):
    def RunScript(self, cg):
        if not cg:
            return None

        return SceneObject(item=cg).draw()
# ---------- end py3_5 ----------
panel_4 = Panel(py3_2.a)
panel_5 = Panel(py3_4.out)
