# Grasshopper definition 302_rhino+ghpython.ghx (Grasshopper 1.0.8)

# ----
# Rhino.Geometry
# Create a list of points in Z direction
# remember to check access and data type
# Wre can connect multiple GHPython components like regular GH components
number_slider = Slider(1, range=1..10)
count = Slider(10, range=1..10)
count_2 = Slider(10, range=1..10)
py3 = Python3Script(x=number_slider, y=Slider(1, range=1..10), count=count, z_step=count_2)  # -> out, point_list; inputs x: Int32, y: Int32, count: Int32, z_step: Int32
# ---------- py3: Python ----------
import Rhino.Geometry as rg

#create an empty list
point_list = []

for i in range(count):
    point = rg.Point3d(x,y,z_step*i)
    point_list.append(point)
# ---------- end py3 ----------
length = Slider(4.22, range=0..10)
length_2 = Slider(4.22, range=0..10)
length_3 = Slider(4.22, range=0..10)
length_4 = Slider(4.22, range=0..10)
panel = Panel(py3.point_list)
py3_2 = Python3Script(in_pts=py3.point_list, width=Slider(6.5, range=0..10), length=length)  # -> out, rectangles; inputs in_pts: list of Point3d, width: Double, length: Double
# ---------- py3_2: Python ----------
import Rhino.Geometry as rg

#we can iterate through the points and create rectangle at each point
rectangles = []
for pt in in_pts:
    print(pt)
    plane = rg.Plane(pt, rg.Vector3d.XAxis, rg.Vector3d.YAxis)
    rect = rg.Rectangle3d(plane, width, length)
    rectangles.append(rect)
# ---------- end py3_2 ----------
py3_3 = Python3Script(in_pts=py3.point_list, width=Slider(6.5, range=0..10), length=length_2)  # -> out, rectangles; inputs in_pts: list of Point3d, width: Double, length: Double
# ---------- py3_3: Python ----------
import Rhino.Geometry as rg

#fucntion to do the repetitive tasks
def draw_rectangle(plane, width, length):
    w = rg.Interval(-width/2, width/2)
    l = rg.Interval(-length/2, length/2)
    rect = rg.Rectangle3d(plane, w, l)
    return rect

#we can iterate through the points and create rectangle at each point
rectangles = []
for pt in in_pts:
    plane = rg.Plane(pt, rg.Vector3d.XAxis, rg.Vector3d.YAxis)
    rect = draw_rectangle(plane, width, length)
    rectangles.append(rect)
# ---------- end py3_3 ----------
py3_4 = Python3Script(in_pts=py3.point_list, width=Slider(6.5, range=0..10), length=length_3)  # -> out, rectangles; inputs in_pts: list of Point3d, width: Double, length: Double
# ---------- py3_4: Python ----------
import Rhino.Geometry as rg

#we can iterate through the points and create rectangle at each point
rectangles = []
for pt in in_pts:
    plane = rg.Plane(pt, rg.Vector3d.XAxis, rg.Vector3d.YAxis)
    w = rg.Interval(-width/2, width/2)
    l = rg.Interval(-length/2, length/2)
    rect = rg.Rectangle3d(plane, w,l)
    rectangles.append(rect)
# ---------- end py3_4 ----------
py3_5 = Python3Script(in_pts=py3.point_list, width=Slider(6.5, range=0..10), length=length_4)  # -> out, rectangles; inputs in_pts: list of Point3d, width: Double, length: Double
# ---------- py3_5: Python ----------
import Rhino.Geometry as rg
import math

#fucntion to do the repetitive tasks
def draw_rectangle(plane, width, length):
    w = rg.Interval(-width/2, width/2)
    l = rg.Interval(-length/2, length/2)
    rect = rg.Rectangle3d(plane, w, l)
    return rect

def remap(val, old_min, old_max, min, max):
    #remap a number from a given range to another range
    return (max - min)*(val - old_min) / (old_max - old_min) + min

#we can iterate through the points and create rectangle at each point
rectangles = []
for i,pt in enumerate(in_pts):
    plane = rg.Plane(pt, rg.Vector3d.XAxis, rg.Vector3d.YAxis)
    angle = remap(i, 0, len(in_pts)-1, 0, 90)
    print(angle)
    axis = plane.ZAxis
    center = plane.Origin
    
    plane.Rotate(math.radians(angle), axis, center)
    rect = draw_rectangle(plane, width, length)
    rectangles.append(rect)
# ---------- end py3_5 ----------

# ----
# COMPAS
# Create a list of points in Z direction
number_slider_2 = Slider(43, range=0..100)
number_slider_3 = Slider(1, range=1..10)
number_slider_4 = Slider(1, range=1..10)
count_3 = Slider(10, range=1..10)
count_4 = Slider(10, range=1..10)
py3_6 = Python3Script(x=number_slider_2, y=number_slider_2, count=count_3, z_step=count_4)  # -> out, point_list; inputs x: Int32, y: Int32, count: Int32, z_step: Int32
# ---------- py3_6: Python ----------
import compas.geometry as cg

#create an empty list
point_list = []

for i in range(count):
    point = cg.Point(x,y,z_step*i)
    point_list.append(point)
# ---------- end py3_6 ----------
py3_7 = Python3Script(cg=py3_6.point_list)  # -> rg
# ---------- py3_7: Python ----------
"""
Draws COMPAS geometry in Grasshopper.
"""

from ghpythonlib.componentbase import executingcomponent as component

from compas.scene import SceneObject


class CompasToRhinoGeometry(component):
    def RunScript(self, cg):
        if not cg:
            return None

        return SceneObject(item=cg).draw()
# ---------- end py3_7 ----------
panel_2 = Panel(py3_6.point_list)
length_5 = Slider(4.22, range=0..10)
length_6 = Slider(4.22, range=0..10)
length_7 = Slider(4.22, range=0..10)
py3_8 = Python3Script(in_pts=py3_6.point_list, width=Slider(6.4, range=0..10), length=length_6)  # -> out, rectangles; inputs in_pts: list, width: Double, length: Double
# ---------- py3_8: Python ----------
import compas.geometry as cg

rectangles = []
for pt in in_pts:
    
    # Corner offsets from center
    dx = width / 2.0
    dy = length / 2.0

    pt1 = cg.Point(pt.x - dx, pt.y - dy, pt.z)
    pt2 = cg.Point(pt.x + dx, pt.y - dy, pt.z)
    pt3 = cg.Point(pt.x + dx, pt.y + dy, pt.z)
    pt4 = cg.Point(pt.x - dx, pt.y + dy, pt.z)
    
    corners = [pt1,pt2,pt3,pt4,pt1]
    rect = cg.Polyline(corners)
    rectangles.append(rect)
# ---------- end py3_8 ----------
py3_9 = Python3Script(in_pts=py3_6.point_list, width=Slider(6.5, range=0..10), length=length_5)  # -> out, rectangles; inputs in_pts: list, width: Double, length: Double
# ---------- py3_9: Python ----------
import compas.geometry as cg

rectangles = []
for pt in in_pts:
    print(pt)
    rect = cg.Polygon.from_rectangle(pt, width, length)
    rectangles.append(rect)
# ---------- end py3_9 ----------
py3_10 = Python3Script(in_pts=py3_6.point_list, width=Slider(6.4, range=0..10), length=length_7)  # -> out, rectangles; inputs in_pts: list, width: Double, length: Double
# ---------- py3_10: Python ----------
import compas.geometry as cg
import math

#fucntion to do the repetitive tasks
def draw_rectangle(pt, width, length):
    dx = width / 2.0
    dy = length / 2.0
    corners = [
        cg.Point(pt.x - dx, pt.y - dy, pt.z),
        cg.Point(pt.x + dx, pt.y - dy, pt.z),
        cg.Point(pt.x + dx, pt.y + dy, pt.z),
        cg.Point(pt.x - dx, pt.y + dy, pt.z),
        cg.Point(pt.x - dx, pt.y - dy, pt.z)  # close the loop
    ]
    return cg.Polyline(corners)

def remap(val, old_min, old_max, min, max):
    #remap a number from a given range to another range
    return (max - min)*(val - old_min) / (old_max - old_min) + min

#we can iterate through the points and create rectangle at each point
rectangles = []
for i,pt in enumerate(in_pts):
    angle = remap(i, 0, len(in_pts)-1, 0, 90)
    axis = cg.Vector(0,0,1)
    center = pt
    rect = draw_rectangle(pt, width, length)
    rect.rotate(math.radians(angle), axis, center)
    rectangles.append(rect)
# ---------- end py3_10 ----------
py3_11 = Python3Script(cg=py3_9.rectangles)  # -> rg; same code as py3_7
py3_12 = Python3Script(cg=py3_10.rectangles)  # -> rg; same code as py3_7
py3_13 = Python3Script(cg=py3_8.rectangles)  # -> rg; same code as py3_7
