# Grasshopper definition 102_tutorial_rectangles.ghx (Grasshopper 1.0.8)
# plug-ins: Bifocals

# Create a grid of rectangles and rotate them similar to reference artwork
number_slider = Slider(5, range=0..10)
python_3_script = Python3Script(x_size=Slider(10, range=0..10), y_size=Slider(19, range=0..20), size=Slider(9, range=0..10))  # -> out, rectangles, RED; inputs x_size: Int32, y_size: Int32
# ---------- python_3_script: Python ----------
import Rhino.Geometry as rg
import math
import random


rectangles = []
RED = []

def remap(old_val, old_min, old_max, new_min, new_max):
    # Remap a number from a given range to a new one
    return (new_max - new_min)*(old_val - old_min) / (old_max - old_min) + new_min

# Create a grid of rectangles
for i in range(x_size):
    for j in range(y_size):
        # Create a rectangle for every I and J
        plane = rg.Plane(rg.Point3d(i*size, j*size, 0), rg.Vector3d.ZAxis)
        rect = rg.Rectangle3d(plane, size, size)
        # Create rotation transformation
        angle = math.radians(j*random.random()*5)
        R = rg.Transform.Rotation(angle, rg.Vector3d.ZAxis, rect.Center)
        rect.Transform(R)

        # Create translation randomly as we go up
        Tx = rg.Transform.Translation(rg.Vector3d.XAxis * j * random.randint(-1,1))
        Ty = rg.Transform.Translation(rg.Vector3d.YAxis * j * random.randint(-1,1))

        rect.Transform(Tx*Ty)
        # Append to a list
        rectangles.append(rect)
        # i + j
        cred = (i*j) # based on index
        # i*j min possible number? 0 max possible number? (x_size-1)*(y_size-1)
        remapped_red = remap(cred, 0, (x_size-1)*(y_size-1), 0, 255)
        # randomred = random.randint(0,255) # random color
        RED.append(remapped_red)
# ---------- end python_3_script ----------
colour_rgb = ColourRGB(Alpha=255, Red=python_3_script.RED, Green=Slider(0, range=0..1000), Blue=Slider(0, range=0..1000))
python_3_script_2 = Python3Script(x=Slider(10, range=0..10), y=Slider(5, range=0..10), z=number_slider)  # -> out, point, sphere
# ---------- python_3_script_2: Python ----------
import Rhino.Geometry as rg

point = rg.Point3d(x,y,z)

sphere = rg.Sphere(point, 10.0)
# ---------- end python_3_script_2 ----------
text_tag_3d = TextTag3D(Location=python_3_script.rectangles, Text=python_3_script.RED, Size=1, Justification=7)
surface = Surface(python_3_script.rectangles)
colour_swatch = ColourSwatch(SwatchColor=RGB(43, 43, 43))
custom_preview = CustomPreview(Geometry=surface, Material=colour_rgb)
