# Grasshopper definition 101_transforming_primitives_exercize.ghx (Grasshopper 1.0.8)

# ----
# Create your primitive shape
number_slider = Slider(5.4, range=0..10)
# COMPAS GEOMETRY
number_slider_2 = Slider(5.2, range=0..10)
py3 = Python3Script(x=number_slider, y=Slider(5, range=0..10), z=number_slider_2)  # -> out, my_box; inputs x: Double, y: Double, z: Double
# ---------- py3: Python ----------
import compas.geometry as cg

my_box = cg.Box(x,y,z)
# ---------- end py3 ----------
py3_2 = Python3Script(cg=py3.my_box)  # -> rg
# ---------- py3_2: Python ----------
"""
Draws COMPAS geometry in Grasshopper.
"""

from ghpythonlib.componentbase import executingcomponent as component

from compas.scene import SceneObject


class CompasToRhinoGeometry(component):
    def RunScript(self, cg):
        if not cg:
            return None

        return SceneObject(item=cg).draw()
# ---------- end py3_2 ----------
# Translate box to given list of points
# and transform each version with a different transformation
target_points = Point([Point(40.45457365, 50.14680384, 0), Point(50.45457365, 50.14680384, 0), Point(60.45457365, 50.14680384, 0), Point(70.45457365, 50.14680384, 0), Point(80.45457365, 50.14680384, 0), Point(90.45457365, 50.14680384, 0), Point(100.4545736, 50.14680384, 0), Point(110.4545736, 50.14680384, 0)])
py3_3 = Python3Script(targets=target_points, shape=py3.my_box)  # -> out, centers, my_shapes; inputs targets: list of Point3d
# ---------- py3_3: Python ----------
import compas.geometry as cg

my_shapes = []
centers = []

for i,point in enumerate(targets):
    # convert target points to compas
    compas_pt = cg.Point(*point)
    # move(translate) given shape to each point
    # hint: use translated..... (automaticatly copies the object)
    vector = 
    new_box = 
    #can you apply different transformations for each shape?
    
    
    #save new shapes into my_shapes list
    

    #save target points for later
    centers.append(compas_pt)
# ---------- end py3_3 ----------
py3_4 = Python3Script(cg=py3_3.my_shapes)  # -> rg; same code as py3_2
py3_5 = Python3Script(cg=py3_3.centers)  # -> rg; same code as py3_2
py3_6 = Python3Script(my_shapes=py3_3.my_shapes)  # -> new_shapes; inputs my_shapes: list
# ---------- py3_6: Python ----------
import compas.geometry as cg

new_shapes = []

# transform box to brep
for shape in my_shapes:
    new_shape = shape.to_brep()
    new_shapes.append(new_shape)
# ---------- end py3_6 ----------
# Project to world XY plane and transform the result to fit in the given rectangle
py3_7 = Python3Script(my_shapes=py3_6)  # -> out, projected_shapes; inputs my_shapes: list
# ---------- py3_7: Python ----------
import compas.geometry as cg

projected_shapes = []
centers = []

for shape in my_shapes:
    #Project shapes into a plan, use class Projection from compas
    T_projection = 
    #print(T_projection)
    new_shapes = shape.transformed(T_projection)
    projected_shapes.append(new_shapes)
# ---------- end py3_7 ----------
py3_8 = Python3Script(cg=py3_7.projected_shapes)  # -> rg; same code as py3_2
poster_boundary = Curve(<curve referenced from the Rhino model>)
py3_9 = Python3Script(boundary=poster_boundary, centers=py3_3.centers, projected_shapes=py3_7.projected_shapes)  # -> out, poster, center_shapes, center_rectangle; inputs boundary: Polyline, centers: list, projected_shapes: list
# ---------- py3_9: Python ----------
import compas.geometry as cg
from compas_rhino.conversions import polyline_to_compas

#create transformation from center of all shapes 
#to the center of poster box

#find center of all shapes
center_shapes = cg.Point(*cg.centroid_points(centers))

#find center of the rhino rectangle
#first convert to compas
rect = polyline_to_compas(boundary)
#then get the points from polyline and repeat find the center from a list of points
rectangle_points = rect.points
rectangle_points.pop(-1)
print(rectangle_points)
center_rectangle = cg.Point(*cg.centroid_points(rectangle_points))

# create vector for transformation(translation)
vector = center_rectangle - center_shapes

# move shapes to poster area
poster = []
for shape in projected_shapes:
    moved_shape = shape.translated(vector)
    poster.append(moved_shape)
# ---------- end py3_9 ----------
py3_10 = Python3Script(cg=py3_9.poster)  # -> rg; same code as py3_2
py3_11 = Python3Script(cg=py3_9.center_rectangle)  # -> rg; same code as py3_2
py3_12 = Python3Script(cg=py3_9.center_shapes)  # -> rg; same code as py3_2

# ----
# RHINO GEOMETRY
number_slider_3 = Slider(5, range=0..10)
py3_13 = Python3Script(x=Slider(5.4, range=0..10), y=Slider(5, range=0..10), z=number_slider_3)  # -> out, my_box
# ---------- py3_13: Python ----------
import Rhino.Geometry as rg

plane = rg.Plane.WorldXY

x_size = rg.Interval(-x/2,x/2)
y_size = rg.Interval(-y/2,y/2)
z_size = rg.Interval(-z/2,z/2)


my_box = rg.Box(plane, x_size, y_size, z_size)
# ---------- end py3_13 ----------
target_points_2 = Point([Point(40.45457365, 50.14680384, 0), Point(50.45457365, 50.14680384, 0), Point(60.45457365, 50.14680384, 0), Point(70.45457365, 50.14680384, 0), Point(80.45457365, 50.14680384, 0), Point(90.45457365, 50.14680384, 0), Point(100.4545736, 50.14680384, 0), Point(110.4545736, 50.14680384, 0)])
py3_14 = Python3Script(targets=target_points_2, shape=py3_13.my_box)  # -> out, my_shapes; inputs targets: list of Point3d, shape: Box
# ---------- py3_14: Python ----------
import Rhino.Geometry as rg

my_shapes = []
for i,point in enumerate(targets):
    print(i, point)
    # move(translate) given shape to each point
    # hint: use rg.Transform.....
    vector = 
    T_translate = 
    #can you apply different transformations for each shape?
    T_rotate_y = 
    T_rotate_x = 
    T_rotate = T_rotate_x * T_rotate_y
    T = T_translate * T_rotate

    # Copy the plane of the original box
    new_plane = rg.Plane(shape.Plane)  
    new_plane.Transform(T)             

    # Recreate the box using the same intervals
    new_box = rg.Box(new_plane, shape.X, shape.Y, shape.Z)
    my_shapes.append(new_box.ToBrep())


#output list of my_shapes with all transformed shapes
# ---------- end py3_14 ----------
py3_15 = Python3Script(my_shapes=py3_14.my_shapes)  # -> out, projected_shapes; inputs my_shapes: list of Brep
# ---------- py3_15: Python ----------
import Rhino.Geometry as rg


projected_shapes = []

for shape in my_shapes:
    # Define the Transformation
    # hint: use rg.Transform.ProjectAlong
    T_projection = 
    
    new_box = shape.Duplicate()
    new_box.Transform(T_projection)

    #save new boxes to the empty list projected_shapes
# ---------- end py3_15 ----------
poster_boundary_2 = Curve(<curve referenced from the Rhino model>)
py3_16 = Python3Script(boundary=poster_boundary_2, projected_shapes=py3_15.projected_shapes)  # -> out, poster, center_shapes, pts; inputs boundary: Rectangle3d, projected_shapes: list of Curve
# ---------- py3_16: Python ----------
import Rhino.Geometry as rg

def create_crv_pts(crvs):
    pts = []
    for crv in crvs:
        pts.append(crv.PointAtStart)
        pts.append(crv.PointAtEnd)
    return pts

# create transformation from center of all shapes to the center of poster box
# 1st discover center of all shapes
pts = create_crv_pts(projected_shapes)
bbox_shapes = rg.BoundingBox(pts)
center_shapes = bbox_shapes.Center
# 2nd discover center of poster
center_poster = boundary.Center
# 3rd calculate vector
vector = center_poster - center_shapes
# create the transformation
T = rg.Transform.Translation(vector)

# apply transformation to all shapes
poster = []
for shape in projected_shapes:
    to_transform = shape.Duplicate()
    to_transform.Transform(T)
    poster.append(to_transform)
# ---------- end py3_16 ----------
geo = Geometry(py3_16.poster)
geo_2 = Geometry(py3_16.pts)
geo_3 = Geometry(py3_16.center_shapes)
