# Grasshopper definition 102_tutorial_rectangles.ghx (Grasshopper 1.0.8)
# plug-ins: Bifocals

# ----
# RHINO GEOMETRY
number_slider = Slider(27, range=0..200)
py3 = Python3Script(
    x=Slider(11, range=0..100),
    y=number_slider,
    gap=Slider(68, range=0..100),
    angle=Slider(4, range=0..100),
    size=Slider(308, range=0..1000))  # -> out, rects, R, G, B; inputs x: Int32, y: Int32, gap: Int32, angle: Int32, size: Int32
# ---------- py3: Python ----------
import Rhino.Geometry as rg
import math

rects = []
R = []
G = []
B = []

def remap(val, old_min, old_max, min, max):
    return (max - min)*(val - old_min) / (old_max - old_min) + min

for i in range(x):
    for j in range(y):
        r = rg.Rectangle3d(rg.Plane.WorldXY, 
                            rg.Interval(i*size + i*gap, (i+1)*size + i*gap),
                            rg.Interval(j*size + j*gap, (j+1)*size + j*gap))
        T = rg.Transform.Rotation(math.radians(i+j*angle), r.Center)
        r.Transform(T)
        rects.append(r)
        r_value = int(remap(val=i*j, old_min=0, old_max=(x-1)*(y-1), min=0, max=255))
        R.append(r_value)
        G.append(70)
        B.append(125)
# ---------- end py3 ----------
rectangle = Rectangle(py3.rects)
colour_rgb = ColourRGB(Alpha=255, Red=py3.R, Green=py3.G, Blue=py3.B)
surface = Surface(rectangle)
custom_preview = CustomPreview(Geometry=surface, Material=colour_rgb)

# ----
# COMPAS GEOMETRY
number_slider_2 = Slider(68, range=0..100)
py3_2 = Python3Script(
    x=Slider(11, range=0..100),
    y=Slider(27, range=0..200),
    gap=number_slider_2,
    angle=Slider(4, range=0..100),
    size=Slider(308, range=0..1000))  # -> out, rects, R, G, B; inputs x: Int32, y: Int32, gap: Int32, angle: Int32, size: Int32
# ---------- py3_2: Python ----------
import compas.geometry as cg
import math

rects = []
R = []
G = []
B = []

def remap(val, old_min, old_max, min, max):
    return (max - min)*(val - old_min) / (old_max - old_min) + min

for i in range(x):
    for j in range(y):
        pt = cg.Point(i*size +(gap*i), j*size +(gap*j), 0)
        r = cg.Polygon.from_rectangle(pt, size, size)
        r.rotate(math.radians(i+j*angle), cg.Vector(0,0,1), r.centroid)
        rects.append(r)
        r_value = int(remap(val=i*j, old_min=0, old_max=(x-1)*(y-1), min=0, max=255))
        R.append(r_value)
        G.append(70)
        B.append(125)
# ---------- end py3_2 ----------
py3_3 = Python3Script(cg=py3_2.rects)  # -> rg
# ---------- py3_3: Python ----------
"""
Draws COMPAS geometry in Grasshopper.
"""

from ghpythonlib.componentbase import executingcomponent as component

from compas.scene import SceneObject


class CompasToRhinoGeometry(component):
    def RunScript(self, cg):
        if not cg:
            return None

        return SceneObject(item=cg).draw()
# ---------- end py3_3 ----------
colour_rgb_2 = ColourRGB(Alpha=255, Red=py3_2.R, Green=py3_2.G, Blue=py3_2.B)
custom_preview_2 = CustomPreview(Geometry=py3_3, Material=colour_rgb_2)
