# Grasshopper definition 201_procedural_design_inputs&outputs.ghx (Grasshopper 1.0.8)

# ----
# Creating a grid with a given x and y size
number_slider = Slider(50, range=1..200)
number_slider_2 = Slider(50, range=1..200)
size = Slider(3, range=0..10)
py3 = Python3Script(x_range=number_slider, y_range=number_slider_2, size=size)  # -> out, points_r, points_c; inputs x_range: Int32, y_range: Int32, size: Double
# ---------- py3: Python ----------
import Rhino.Geometry as rg
import compas.geometry as cg
#we import an inbuilt conversion
from ghpythonlib.treehelpers import list_to_tree

points_rhino = []
points_compas = []

z = 0 #Let's draw points at the base plane(z=0)

for x in range(x_range):
    points_row_r = []
    points_row_c = []
    for y in range(y_range):
        points_row_r.append(rg.Point3d(x*size, y*size, z))
        points_row_c.append(cg.Point(x*size, y*size, z))
    points_rhino.append(points_row_r)
    points_compas.append(points_row_c)

points_r = list_to_tree(points_rhino)
points_c = list_to_tree(points_compas)
# ---------- end py3 ----------

panel = Panel(py3.points_r)
panel_2 = Panel(py3.points_c)

# ----
# Modulating based on index(using trigonometric functions)
number_slider_3 = Slider(-0.449, range=-3.1..3.1)
py3_2 = Python3Script(x_size=number_slider, y_size=number_slider_2, period=number_slider_3)  # -> out, sizes, max_value, min_value; inputs x_size: Int32, y_size: Int32, period: Double
# ---------- py3_2: Python ----------
import math
from ghpythonlib.treehelpers import list_to_tree as _tree

sizes = []
max_value = -99999
min_value = 99999


for y in range(x_size):
    s_row = []
    for x in range(y_size):
        value = math.sin(period * x) + math.cos(period * y)
        s_row.append(value)
        if value > max_value:
            max_value = value
        if value < min_value:
            min_value = value
    sizes.append(s_row)

sizes = _tree(sizes)
# ---------- end py3_2 ----------
rhino = Python3Script(in_pts=py3.points_r, values=py3_2.sizes, in_min=py3_2.max_value, in_max=py3_2.min_value, out_min="0.1", out_max="1.5")  # -> out, circles; inputs in_pts: tree of Point3d, values: tree, in_min: Double, in_max: Double, out_min: Double, out_max: Double
# ---------- rhino: Python ----------
import Rhino.Geometry as rg
import math
print(type(in_pts))

from ghpythonlib.treehelpers import tree_to_list, list_to_tree
points = tree_to_list(in_pts)
values = tree_to_list(values)


def remap(val, old_min, old_max, min, max):
    #remap a number from a given range to another range
    return (max - min)*(val - old_min) / (old_max - old_min) + min


circles = []
#Now we iterate through it
for i,p_row in enumerate(points):
    for j,pt in enumerate(p_row):
        print(("row {}, point {} = ".format(i,j)),pt)
        #Let's create a circle at each point
        #We need a plane and radius to make a circle
        plane = rg.Plane(pt, rg.Vector3d.XAxis, rg.Vector3d.YAxis)
        size = remap(values[i][j], in_min, in_max, out_min, out_max)
        circle = rg.Circle(plane, size)
        #add it to our list
        circles.append(circle)
# ---------- end rhino ----------
compas = Python3Script(in_pts=py3.points_c, values=py3_2.sizes, in_min=py3_2.min_value, in_max=py3_2.max_value, out_min="0.1", out_max="1.5")  # -> out, circles; inputs in_pts: tree, values: tree, in_min: Double, in_max: Double, out_min: Double, out_max: Double
# ---------- compas: Python ----------
import compas.geometry as cg
import math
print(type(in_pts))

from ghpythonlib.treehelpers import tree_to_list, list_to_tree
points = tree_to_list(in_pts)
values = tree_to_list(values)


def remap(val, old_min, old_max, min, max):
    #remap a number from a given range to another range
    return (max - min)*(val - old_min) / (old_max - old_min) + min


circles = []
#Now we iterate through it
for i,p_row in enumerate(points):
    for j,pt in enumerate(p_row):
        print(("row {}, point {} = ".format(i,j)),pt)
        #Let's create a circle at each point
        #We need a plane and radius to make a circle
        frame = cg.Frame(pt, cg.Vector.Xaxis(), cg.Vector.Yaxis())
        size = remap(values[i][j], in_min, in_max, out_min, out_max)
        circle = cg.Circle(size, frame)
        #add it to our list
        circles.append(circle)
# ---------- end compas ----------
py3_3 = Python3Script(cg=compas.circles)  # -> rg
# ---------- py3_3: Python ----------
"""
Draws COMPAS geometry in Grasshopper.
"""

from ghpythonlib.componentbase import executingcomponent as component

from compas.scene import SceneObject


class CompasToRhinoGeometry(component):
    def RunScript(self, cg):
        if not cg:
            return None

        return SceneObject(item=cg).draw()
# ---------- end py3_3 ----------
hsl = ColourHSL(Alpha=1, Hue=flatten(0), Saturation=flatten(1), Luminance=0.5)
preview = CustomPreview(Geometry=py3_3, Material=hsl)

# ----
# Modulating based on noise
number_slider_4 = Slider(13.2, range=1..20)
slide = Slider(18, range=1..512)
py3_4 = Python3Script(x_size=number_slider, y_size=number_slider_2, scale=number_slider_4, seed=Slider(324, range=1..512), slide=slide)  # -> out, sizes, max_value, min_value; inputs x_size: Int32, y_size: Int32, scale: Double
# ---------- py3_4: Python ----------
import random
import math
from ghpythonlib.treehelpers import list_to_tree as _tree

random.seed(seed)

def fade(t):
    return t * t * t * (t * (t * 6 - 15) + 10)

def lerp(t, a, b):
    return a + t * (b - a)

def grad(hash, x, y):
    h = hash & 7
    grad = ((h & 1) * x + (h & 2) * -x + (h & 4) * y) / 7.0
    if h & 1:
        grad = -grad
    return grad

def perlin_noise(x, y):
    X = int(math.floor(x)) & 255
    Y = int(math.floor(y)) & 255
    x -= math.floor(x)
    y -= math.floor(y)
    u = fade(x)
    v = fade(y)
    A = p[X] + Y
    AA = p[A]
    AB = p[A + 1]
    B = p[X + 1] + Y
    BA = p[B]
    BB = p[B + 1]

    return lerp(v, lerp(u, grad(AA, x, y), grad(BA, x - 1, y)), lerp(u, grad(AB, x, y - 1), grad(BB, x - 1, y - 1)))

# Generate a permutation table
p = list(range(256))
random.shuffle(p)
p += p  # Duplicate the table to avoid overflow


sizes = []
max_value = -99999
min_value = 99999

for y in range(x_size):
    s_row = []
    for x in range(y_size):
        value = perlin_noise((x + slide)/ scale , (y + slide) / scale)
        s_row.append(value)
        if value > max_value:
            max_value = value
        if value < min_value:
            min_value = value
    sizes.append(s_row)

sizes = _tree(sizes)
# ---------- end py3_4 ----------
rhino_2 = Python3Script(in_pts=py3.points_r, values=py3_4.sizes, in_min=py3_4.min_value, in_max=py3_4.max_value, out_min="0.1", out_max="1.5")  # -> out, circles; inputs in_pts: tree of Point3d, values: tree, in_min: Double, in_max: Double, out_min: Double, out_max: Double; same code as rhino
compas_2 = Python3Script(in_pts=py3.points_c, values=py3_4.sizes, in_min=py3_4.max_value, in_max=py3_4.min_value, out_min="0.1", out_max="1.5")  # -> out, circles; inputs in_pts: tree, values: tree, in_min: Double, in_max: Double, out_min: Double, out_max: Double; same code as compas
py3_5 = Python3Script(cg=compas_2.circles)  # -> rg; same code as py3_3
hsl_2 = ColourHSL(Alpha=1, Hue=flatten(0), Saturation=flatten(1), Luminance=0.5)
preview_2 = CustomPreview(Geometry=py3_5, Material=hsl_2)

# ----
# Modulating based on attractor Point
number_slider_5 = Slider(0.268, range=-3.1..3.1)
pt = Point(Point(95.24734634, 99.32493506, 0))
py3_6 = Python3Script(attractor=pt, grid=py3.points_r, period=number_slider_5)  # -> out, sizes, max_value, min_value; inputs attractor: Point3d, grid: tree of Point3d, period: Double
# ---------- py3_6: Python ----------
import math
from ghpythonlib.treehelpers import list_to_tree, tree_to_list

grid = tree_to_list(grid)

sizes = []

max_value = -99999
min_value = 99999


for point_row in grid:
    s_row = []
    for point in point_row:
        value = point.DistanceTo(attractor)
        s_row.append(value)
        if value > max_value:
            max_value = value
        if value < min_value:
            min_value = value
    sizes.append(s_row)

sizes = list_to_tree(sizes)
# ---------- end py3_6 ----------
rhino_3 = Python3Script(in_pts=py3.points_r, values=py3_6.sizes, in_min=py3_6.min_value, in_max=py3_6.max_value, out_min="0.1", out_max="1.5")  # -> out, circles; inputs in_pts: tree of Point3d, values: tree, in_min: Double, in_max: Double, out_min: Double, out_max: Double; same code as rhino
compas_3 = Python3Script(in_pts=py3.points_c, values=py3_6.sizes, in_min=py3_6.max_value, in_max=py3_6.min_value, out_min="0.1", out_max="1.5")  # -> out, circles; inputs in_pts: tree, values: tree, in_min: Double, in_max: Double, out_min: Double, out_max: Double; same code as compas
py3_7 = Python3Script(cg=compas_3.circles)  # -> rg; same code as py3_3

# ----
# Modulating based on index
py3_8 = Python3Script(x_size=number_slider, y_size=number_slider_2)  # -> out, sizes, max_value, min_value; inputs x_size: Int32, y_size: Int32
# ---------- py3_8: Python ----------
import math
from ghpythonlib.treehelpers import list_to_tree as _tree

sizes = []

max_value = -99999
min_value = 99999


for y in range(x_size):
    s_row = []
    for x in range(y_size):
        value = x + y
        s_row.append(value)
        if value > max_value:
            max_value = value
        if value < min_value:
            min_value = value
    sizes.append(s_row)

sizes = _tree(sizes)
# ---------- end py3_8 ----------
rhino_4 = Python3Script(in_pts=py3.points_r, values=py3_8.sizes, in_min=py3_8.max_value, in_max=py3_8.min_value, out_min="0.1", out_max="1.5")  # -> out, circles; inputs in_pts: tree of Point3d, values: tree, in_min: Double, in_max: Double, out_min: Double, out_max: Double; same code as rhino
compas_4 = Python3Script(in_pts=py3.points_c, values=py3_8.sizes, in_min=py3_8.max_value, in_max=py3_8.min_value, out_min="0.1", out_max="1.5")  # -> out, circles; inputs in_pts: tree, values: tree, in_min: Double, in_max: Double, out_min: Double, out_max: Double; same code as compas
py3_9 = Python3Script(cg=compas_4.circles)  # -> rg; same code as py3_3
