# Grasshopper definition isthisgrass.ghx (Grasshopper 1.0.8)

number_slider = Slider(8, range=0..10)
number_slider_2 = Slider(80, range=0..100)
number_slider_3 = Slider(8, range=0..10)
number_slider_4 = Slider(80, range=0..100)
number_slider_5 = Slider(3, range=0..10)
py3 = Python3Script(
    Cols=number_slider_2,
    Rows=number_slider_2,
    Spacing=Slider(10, range=0..10),
    BaseLen=Slider(50, range=0..100),
    Jitter=Slider(10, range=0..10),
    AngleNoise=Slider(0, range=0..1),
    Mode="sine")  # -> out, Lines; inputs Cols: Int32, Rows: Int32, Spacing: Double, AngleNoise: Double, Mode: String
# ---------- py3: Python ----------
"""
GhPython / COMPAS – Generative line field (no image)

Inputs (create these inputs on the GhPython component):
    Cols (int)           e.g. 80
    Rows (int)           e.g. 60
    Spacing (float)      e.g. 10.0   # distance between grid points
    BaseLen (float)      e.g. 8.0    # base line length
    Jitter (float)       e.g. 2.0    # random offset for seed points
    AngleNoise (float)   e.g. 0.15   # random wobble (radians)
    LengthNoise (float)  e.g. 0.25   # 0..1 (fraction of BaseLen)
    Mode (text)          "sine" | "swirl" | "radial" | "curl"
    Seed (int)           e.g. 42
    ThickMin (int)       e.g. 1
    ThickMax (int)       e.g. 2

Outputs:
    Lines   (list of compas.geometry.Line)
    Thick   (list of int)  # per-line thickness you can feed to a Display pipeline
"""

import math
import random
import compas
import compas.geometry as cg

# ---- defaults (used if you leave inputs unconnected) ----
Cols         = Cols         if 'Cols'         in globals() else 80
Rows         = Rows         if 'Rows'         in globals() else 60
Spacing      = Spacing      if 'Spacing'      in globals() else 10.0
BaseLen      = BaseLen      if 'BaseLen'      in globals() else 8.0
Jitter       = Jitter       if 'Jitter'       in globals() else 2.0
AngleNoise   = AngleNoise   if 'AngleNoise'   in globals() else 0.15
LengthNoise  = LengthNoise  if 'LengthNoise'  in globals() else 0.25
Mode         = Mode         if 'Mode'         in globals() else "sine"
Seed         = Seed         if 'Seed'         in globals() else 42
ThickMin     = ThickMin     if 'ThickMin'     in globals() else 1
ThickMax     = ThickMax     if 'ThickMax'     in globals() else 2
# ---------------------------------------------------------

rnd = random.Random(Seed)

# Center the grid around (0,0)
cx = 0.5 * (Cols - 1)
cy = 0.5 * (Rows - 1)

# --- vector field (angle) definitions ---
def angle_field(x, y, mode="sine"):
    """
    Return an orientation angle (radians) for a 2D position (x, y).
    x, y are in model units (already scaled by Spacing).
    """
    if mode == "sine":
        # Smooth waving field using a few low frequencies
        f1, f2 = 0.06, 0.04
        a = math.sin(f1 * x + 0.7 * f2 * y) + 0.6 * math.sin(0.5 * f2 * x - 1.2 * f1 * y)
        # Map 'a' to angle range
        return a * math.pi * 0.75  # (-~2.3 .. +~2.3 rad)

    elif mode == "swirl":
        # Tangent to circles around the origin
        theta = math.atan2(y, x) + math.pi * 0.5
        return theta

    elif mode == "radial":
        # Rays pointing outward from the origin
        return math.atan2(y, x)

    elif mode == "curl":
        # Simple curl-ish combination (not true curl noise, but smooth & interesting)
        f = 0.05
        u = math.sin(f * x) + math.cos(0.6 * f * y)
        v = math.cos(0.6 * f * x) - math.sin(f * y)
        return math.atan2(v, u)

    else:
        # default fallback
        return 0.0

# --- generate lines ---
Lines = []
Thick = []

for i in range(Rows):
    for j in range(Cols):
        # grid position centered
        gx = (j - cx) * Spacing
        gy = (i - cy) * Spacing

        # jitter the seed to break the lattice look
        jx = gx + rnd.uniform(-Jitter, Jitter)
        jy = gy + rnd.uniform(-Jitter, Jitter)

        # local direction with some random wobble
        theta = angle_field(jx, jy, Mode) + rnd.uniform(-AngleNoise, AngleNoise)

        # length variation
        L = BaseLen * (1.0 + LengthNoise * rnd.uniform(-1.0, 1.0))

        # endpoints
        dx = 0.5 * L * math.cos(theta)
        dy = 0.5 * L * math.sin(theta)

        p0 = cg.Point(jx - dx, jy - dy, 0.0)
        p1 = cg.Point(jx + dx, jy + dy, 0.0)

        Lines.append(cg.Line(p0, p1))
        Thick.append(rnd.randint(int(ThickMin), int(ThickMax)))

# GhPython will pick up Lines & Thick as outputs
# ---------- end py3 ----------
py3_2 = Python3Script(
    Cols=number_slider_4,
    Rows=number_slider_4,
    Spacing=Slider(10, range=0..10),
    BaseLen=Slider(50, range=0..100),
    Jitter=Slider(10, range=0..10),
    AngleNoise=Slider(0.37, range=0..1),
    Mode="sine",
    Density=Slider(0.4, range=0..1))  # -> out, Lines, Thick; inputs Cols: Int32, Rows: Int32, Spacing: Double, AngleNoise: Double, Mode: String, Density: Double
# ---------- py3_2: Python ----------
"""
GhPython / COMPAS – Generative line field (no image)

Inputs (create these inputs on the GhPython component):
    Cols (int)           e.g. 80
    Rows (int)           e.g. 60
    Spacing (float)      e.g. 10.0   # distance between grid points
    BaseLen (float)      e.g. 8.0    # base line length
    Jitter (float)       e.g. 2.0    # random offset for seed points
    AngleNoise (float)   e.g. 0.15   # random wobble (radians)
    LengthNoise (float)  e.g. 0.25   # 0..1 (fraction of BaseLen)
    Mode (text)          "sine" | "swirl" | "radial" | "curl"
    Seed (int)           e.g. 42
    ThickMin (int)       e.g. 1
    ThickMax (int)       e.g. 2

Outputs:
    Lines   (list of compas.geometry.Line)
    Thick   (list of int)  # per-line thickness you can feed to a Display pipeline
"""

import math
import random
import compas
import compas.geometry as cg

# ---- defaults (used if you leave inputs unconnected) ----
Cols         = Cols         if 'Cols'         in globals() else 80
Rows         = Rows         if 'Rows'         in globals() else 60
Spacing      = Spacing      if 'Spacing'      in globals() else 10.0
BaseLen      = BaseLen      if 'BaseLen'      in globals() else 8.0
Jitter       = Jitter       if 'Jitter'       in globals() else 2.0
AngleNoise   = AngleNoise   if 'AngleNoise'   in globals() else 0.15
LengthNoise  = LengthNoise  if 'LengthNoise'  in globals() else 0.25
Mode         = Mode         if 'Mode'         in globals() else "sine"
Seed         = Seed         if 'Seed'         in globals() else 42
ThickMin     = ThickMin     if 'ThickMin'     in globals() else 1
ThickMax     = ThickMax     if 'ThickMax'     in globals() else 2
# ---------------------------------------------------------

rnd = random.Random(Seed)

# Perlin noise helpers (classic Ken Perlin 2002)
p = list(range(256))
rnd.shuffle(p)
p = p * 2

def fade(t):
    return t * t * t * (t * (t * 6 - 15) + 10)

def lerp(t, a, b):
    return a + t * (b - a)

def grad(hash, x, y):
    h = hash & 3
    u = x if h < 2 else y
    v = y if h < 2 else x
    return (u if (h & 1) == 0 else -u) + (v if (h & 2) == 0 else -v)

def perlin_noise(x, y):
    X = int(math.floor(x)) & 255
    Y = int(math.floor(y)) & 255
    x -= math.floor(x)
    y -= math.floor(y)
    u = fade(x)
    v = fade(y)
    A = p[X] + Y
    AA = p[A]
    AB = p[A + 1]
    B = p[X + 1] + Y
    BA = p[B]
    BB = p[B + 1]
    return lerp(v, 
                lerp(u, grad(AA, x, y), grad(BA, x - 1, y)), 
                lerp(u, grad(AB, x, y - 1), grad(BB, x - 1, y - 1)))

# Center grid
cx = 0.5 * (Cols - 1)
cy = 0.5 * (Rows - 1)

Lines = []
Thick = []
NoiseV = []

scale_noise = 0.002  # controls "patch" size; smaller = bigger patches

for i in range(Rows):
    for j in range(Cols):
        gx = (j - cx) * Spacing
        gy = (i - cy) * Spacing

        # jitter the point
        jx = gx + rnd.uniform(-Jitter, Jitter)
        jy = gy + rnd.uniform(-Jitter, Jitter)

        # sample noise field
        nval = perlin_noise(jx * scale_noise, jy * scale_noise)
        nval = (nval + 1) * 0.5  # map to 0..1
        NoiseV.append(nval)

        # density control: skip points below threshold
        if nval < (1.0-Density):
            continue

        # orientation: use noise as angle seed
        theta = nval * math.pi * 2.0
        theta += rnd.uniform(-AngleNoise, AngleNoise)

        # length variation: modulated by noise + randomness
        L = BaseLen * (0.5 + nval) * (1.0 + LengthNoise * rnd.uniform(-1.0, 1.0))

        dx = 0.5 * L * math.cos(theta)
        dy = 0.5 * L * math.sin(theta)

        p0 = cg.Point(jx - dx, jy - dy, 0.0)
        p1 = cg.Point(jx + dx, jy + dy, 0.0)

        Lines.append(cg.Line(p0, p1))
        Thick.append(rnd.randint(int(ThickMin), int(ThickMax)))
# ---------- end py3_2 ----------
py3_3 = Python3Script(cg=py3.Lines)  # -> rg
# ---------- py3_3: Python ----------
"""
Draws COMPAS geometry in Grasshopper.
"""

from ghpythonlib.componentbase import executingcomponent as component

from compas.scene import SceneObject


class CompasToRhinoGeometry(component):
    def RunScript(self, cg):
        if not cg:
            return None

        return SceneObject(item=cg).draw()
# ---------- end py3_3 ----------
py3_4 = Python3Script(cg=py3_2.Lines)  # -> rg; same code as py3_3
