# Grasshopper definition 101_move_robot_urscript.ghx (Grasshopper 1.0.8)

panel = Panel("""def ur_script():
 
 set_tcp(p[0.0, 0.0, 0.0, 0.0, 3.14159, 0.0])
 
 movel(p[0.400, 0.400, 0.400, 0.000, 0.000, 0.000], a = 0.1, v = 0.1)

 sleep(0.5) 
 
 movel(p[0.400, 0.200, 0.400, 0.000, 0.000, 0.000], a = 0.1, v = 0.1)
 
 sleep(0.5) 

 movel(p[0.400, 0.400, 0.400, 0.000, 0.000, 0.000], a = 0.1, v = 0.1)
 
 sleep(0.5) 
 
 end
 
ur_script()""")
send_to_robot = IronPython2Script(script=panel, execute=Toggle(False))  # -> out, a; inputs execute: Boolean
# ---------- send_to_robot: IronPython ----------
import socket                   # module for network comunication

#A network socket is a software structure within a network node of a computer network that serves as an endpoint for sending and receiving data across the network. 

robot_ip = '192.168.10.10'      # numerical label assigned to the UR robotic arm
UR_SERVER_PORT = 30002          # identifier for the socket comunication


def send_script(ur_ip, script):
    global UR_SERVER_PORT
    s = socket.create_connection((ur_ip, UR_SERVER_PORT), timeout=2) #creates a connection between this computer and the robot. This computer must have an ip number that is the same except for the last two numbers. 
    s.send(script)
    print ("Script sent to %s on port %i" % (ur_ip, UR_SERVER_PORT))
    s.close()


if execute:
    send_script(robot_ip,script)
# ---------- end send_to_robot ----------
