# Grasshopper definition 202_applying_strokes.ghx (Grasshopper 1.0.8)

number_slider = Slider(99, range=75..100)
# Generate Geometry
pt = ConstructPoint(XCoordinate="50", YCoordinate="50", ZCoordinate=0)
compas = Python3Script(origin=pt, square_size=number_slider)  # -> out, my_way_planes; inputs origin: Point3d, square_size: Double
# ---------- compas: Python ----------
import compas.geometry as cg

def create_square_way_planes(origin, size):
    """
    Define a square with a point3d as origin and 
    size as a float for the width and length
    """
    # Calculate the coordinates for the four corners of the square
    x, y = origin.X, origin.Y

    # Define the four corners of the square
    corner1 = cg.Point(x - size / 2, y - size / 2, 0)
    corner2 = cg.Point(x + size / 2, y - size / 2, 0)
    corner3 = cg.Point(x + size / 2, y + size / 2, 0)
    corner4 = cg.Point(x - size / 2, y + size / 2, 0)
    
    # Make plane from corner points
    plane1 = cg.Frame(corner1, cg.Vector.Xaxis(), cg.Vector.Yaxis())
    plane2 = cg.Frame(corner2, cg.Vector.Xaxis(), cg.Vector.Yaxis())
    plane3 = cg.Frame(corner3, cg.Vector.Xaxis(), cg.Vector.Yaxis())
    plane4 = cg.Frame(corner4, cg.Vector.Xaxis(), cg.Vector.Yaxis())

    # Add the corners to the list of square planes
    square_planes = [plane1, plane2, plane3, plane4, plane1]

    # Return the list of square points
    return square_planes

my_way_planes = create_square_way_planes(origin, square_size)
# ---------- end compas ----------
rhino = Python3Script(
    origin=pt,
    square_size=number_slider,
    zh=Slider(50, range=0..100),
    n_lines=Slider(6, range=0..100),
    dist=Slider(61, range=0..100))  # -> out, my_way_planes; inputs origin: Point3d, square_size: Double, zh: Double, n_lines: Int32, dist: Double
# ---------- rhino: Python ----------
import Rhino.Geometry as rg

def create_line(origin, size):
    """
    Define a square with a point3d as origin and 
    size as a float for the width and length
    """
    # Calculate the coordinates for the four corners of the square
    x, y = origin.X, origin.Y

    # Define the four corners of the square
    corner0 = rg.Point3d(x , y , zh)
    corner1 = rg.Point3d(x , y , 0)
    corner2 = rg.Point3d(x + size, y, 0)
    corner3 = rg.Point3d(x + size, y , zh)
    
    # Make plane from corner points
    plane0 = rg.Plane(corner0, rg.Vector3d.XAxis, rg.Vector3d.YAxis)
    plane1 = rg.Plane(corner1, rg.Vector3d.XAxis, rg.Vector3d.YAxis)
    plane2 = rg.Plane(corner2, rg.Vector3d.XAxis, rg.Vector3d.YAxis)
    plane3 = rg.Plane(corner3, rg.Vector3d.XAxis, rg.Vector3d.YAxis)

    # Add the corners to the list of square planes
    line_planes = [plane0, plane1, plane2, plane3]

    # Return the list of square points
    return line_planes


my_way_planes = []
for i in range(n_lines):
    line = create_line(rg.Point3d(origin.X,origin.Y+(i*dist),0), square_size)
    if i % 2 == 0:
        line.reverse()
    print(line)
    my_way_planes.extend(line)
# ---------- end rhino ----------
pline = PolyLine(Vertices=rhino.my_way_planes, Closed=False)
fine_adjust_z_mm = Slider(0.8, range=-5..10)
pt_2 = ConstructPoint(XCoordinate="535.90", YCoordinate="101.40", ZCoordinate="-9.39")
pt_3 = ConstructPoint(XCoordinate="246.86", YCoordinate="-314.78", ZCoordinate="-10.85")
# Transform from Rhino to Robot Space
pt_4 = ConstructPoint(XCoordinate="534.35", YCoordinate="-315.60", ZCoordinate="-9.96")
rhino_2 = Python3Script(way_planes=rhino.my_way_planes, wobj_origin=pt_4, wobj_xaxis=pt_2, wobj_xypoint=pt_3, z_safe_margin=fine_adjust_z_mm)  # -> out, transformed_planes; inputs way_planes: list of Plane, wobj_origin: Point3d, wobj_xaxis: Point3d, wobj_xypoint: Point3d, z_safe_margin: Double
# ---------- rhino_2: Python ----------
import Rhino.Geometry as rg

#in this step we transform our way planes to robot space
#the rhino co-ordinate system is rather abstract in the physical world
#the robot base plane assumed the base frame of robot is the origin
#but rhino does not know that
#thus we transform things from our design space(Rhino World XY) to Robot Base Plane that we measure

def set_robot_base(origin, xaxis, xypoint):
    """
    set a base plane representing the robot working object plane
    """
    robot_base = rg.Plane(origin, xaxis - origin, xypoint - origin)
    print (robot_base)
    return (robot_base)

def rhino_to_robot_space(rhino_plane,robot_base_plane):
    """
    Transform the objects from Rhino world XY plane to robot work object plane
    """
    T_matrix = rg.Transform.PlaneToPlane(rg.Plane.WorldXY,robot_base_plane)
    robot_plane = rhino_plane.Clone()
    robot_plane.Transform(T_matrix)
    return robot_plane

def set_z_safe_margin(planes_to_adjust, safety_margin):
    adjusted_way_planes = []
    for plane in planes_to_adjust:
        plane.OriginZ += safety_margin
        adjusted_way_planes.append(plane)
    return adjusted_way_planes

# ===== Robot base is set =====
robot_base =  set_robot_base(wobj_origin, wobj_xaxis, wobj_xypoint)

# ===== Set safety margin for Z height ======
safer_planes = set_z_safe_margin(way_planes, z_safe_margin)

# ===== Transforming the rhino planes into robot planes =====
transformed_planes = []
for plane in way_planes: 
    transformed_planes.append(rhino_to_robot_space(plane, robot_base))
# ---------- end rhino_2 ----------
compas_2 = Python3Script(way_planes=compas.my_way_planes, wobj_origin=pt_4, wobj_xaxis=pt_2, wobj_xypoint=pt_3, z_safe_margin=fine_adjust_z_mm)  # -> out, transformed_planes; inputs way_planes: list, wobj_origin: Point3d, wobj_xaxis: Point3d, wobj_xypoint: Point3d, z_safe_margin: Double
# ---------- compas_2: Python ----------
import compas.geometry as cg

#in this step we transform our way planes to robot space
#the rhino co-ordinate system is rather abstract in the physical world
#the robot base plane assumed the base frame of robot is the origin
#but rhino does not know that
#thus we transform things from our design space(Rhino World XY) to Robot Base Plane that we measure

def set_robot_base(origin, xaxis, xypoint):
    """
    set a base plane representing the robot working object plane
    """
    robot_base = cg.Frame(origin, xaxis - origin, xypoint - origin)
    print (robot_base)
    return (robot_base)

def rhino_to_robot_space(rhino_plane,robot_base_plane):
    """
    Transform the objects from Rhino world XY plane to robot work object plane
    """
    T_matrix = cg.Transformation.from_frame_to_frame(cg.Frame.worldXY(), robot_base_plane)
    robot_plane = rhino_plane.transformed(T_matrix)
    return robot_plane

def set_z_safe_margin(planes_to_adjust, safety_margin):
    adjusted = []
    T = cg.Translation.from_vector(cg.Vector(0, 0, safety_margin))
    for f in planes_to_adjust:
        adjusted.append(f.transformed(T))
    return adjusted

# ===== Robot base is set =====
robot_base =  set_robot_base(wobj_origin, wobj_xaxis, wobj_xypoint)
print(robot_base)

# ===== Set safety margin for Z height ======
safer_planes = set_z_safe_margin(way_planes, z_safe_margin)

# ===== Transforming the rhino planes into robot planes =====
transformed_planes = []
for plane in way_planes: 
    transformed_planes.append(rhino_to_robot_space(plane, robot_base))
# ---------- end compas_2 ----------
py3 = Python3Script(cg=compas_2.transformed_planes)  # -> rg
# ---------- py3: Python ----------
"""
Draws COMPAS geometry in Grasshopper.
"""

from ghpythonlib.componentbase import executingcomponent as component

from compas.scene import SceneObject


class CompasToRhinoGeometry(component):
    def RunScript(self, cg):
        if not cg:
            return None

        return SceneObject(item=cg).draw()
# ---------- end py3 ----------
number_slider_2 = Slider(0.1, range=0..0.1)
number_slider_3 = Slider(0.1, range=0..0.1)
# Convert Planes to URScript
pt_5 = ConstructPoint(XCoordinate="0.07", YCoordinate="-0.06", ZCoordinate="74.33")
rhino_3 = Python3Script(way_planes=rhino_2.transformed_planes, tcp_measured=pt_5, acceleration=number_slider_2, velocity=number_slider_3)  # -> out, script; inputs way_planes: list of Plane, tcp_measured: Point3d, acceleration: Double, velocity: Double
# ---------- rhino_3: Python ----------
from imp import reload
import sys

sys.path.append("C:\\Users\\jfrancisco\\Documents\\2526_prep\\2526_T1\\02_RoboticDrawing\\src")

import simple_ur_script as ur
reload(ur)

import utils 
reload(utils)

import simple_comm as com
reload(com)

import Rhino.Geometry as rg
import math as m

script = "" #create empty string

#if value given for tcp measured, then add line to script, otherwise it will take current tcp from robot
if tcp_measured is not None:
    script += ur.set_tcp_by_angles(tcp_measured.X, tcp_measured.Y, tcp_measured.Z, m.radians(0.0),m.radians(-180.0),m.radians(0))

#calculate blend
blend_radii = utils.calculate_blend_radius(way_planes, 25.0)
#add move_l commands to script for each way plane
for plane, radius in zip(way_planes, blend_radii):
    script += ur.move_l_blend(plane, acceleration, velocity, radius)


#format the script to make it sendable
script = com.concatenate_script(script)
# ---------- end rhino_3 ----------
compas_3 = Python3Script(way_planes=compas_2.transformed_planes, tcp_measured=pt_5, acceleration=number_slider_2, velocity=number_slider_3)  # -> out, script; inputs way_planes: list, tcp_measured: Point3d, acceleration: Double, velocity: Double
# ---------- compas_3: Python ----------
from imp import reload
import sys

sys.path.append("C:\\Users\\jfrancisco\\Documents\\2526_prep\\2526_T1\\02_RoboticDrawing\\src\\compas")

import simple_ur_script as ur
reload(ur)

import utils 
reload(utils)

import simple_comm as com
reload(com)

import Rhino.Geometry as rg
import math as m

script = "" #create empty string

#if value given for tcp measured, then add line to script, otherwise it will take current tcp from robot
if tcp_measured is not None:
    script += ur.set_tcp_by_angles(tcp_measured.X, tcp_measured.Y, tcp_measured.Z, m.radians(0.0),m.radians(-180.0),m.radians(0))

#calculate blend
blend_radii = utils.calculate_blend_radius(way_planes, 25.0)
#add move_l commands to script for each way plane
for plane, radius in zip(way_planes, blend_radii):
    script += ur.move_l_blend(plane, acceleration, velocity, radius)


#format the script to make it sendable
script = com.concatenate_script(script)
# ---------- end compas_3 ----------

# ---- group: Send UR script to Robot!
py3_2 = Python3Script(script=rhino_3.script, ip_address="192.168.10.10", send=Button())  # -> out, a; inputs script: String, ip_address: String, send: Boolean
# ---------- py3_2: Python ----------
import simple_comm as com

if send:
    com.send_script(script,ip_address)
# ---------- end py3_2 ----------

# ----
# Send to Robot!
panel = Panel(compas_3.script)
