# Grasshopper definition 301_applying_strokes.ghx (Grasshopper 1.0.8)

number_slider = Slider(80, range=75..100)
# Generate Geometry
pt = ConstructPoint(XCoordinate="100", YCoordinate="100", ZCoordinate=0)
rhino = Python3Script(origin=pt, radius=number_slider, stroke_count=Slider(6, range=0..10))  # -> out, my_way_planes; inputs origin: Point3d, radius: Int32, stroke_count: Int32
# ---------- rhino: Python ----------
import Rhino.Geometry as rg
from ghpythonlib.treehelpers import list_to_tree, tree_to_list

def draw_stroke(pt, len, height):
    #create start plane
    start_plane = rg.Plane(pt, rg.Vector3d.XAxis, rg.Vector3d.YAxis)
    #create transform for modifiers
    vector_for_length = start_plane.XAxis * len
    T_length = rg.Transform.Translation(vector_for_length)
    vector_for_height = start_plane.ZAxis * height
    T_height = rg.Transform.Translation(vector_for_height)
    end_plane = start_plane.Clone()
    end_plane.Transform(T_length * T_height)
    my_stroke = [start_plane, end_plane]
    return my_stroke

def remap(val, old_min, old_max, min, max):
    #remap a number from a given range to another range
    return (max - min)*(val - old_min) / (old_max - old_min) + min

def create_safe_plane(plane, height):
    safe_plane = plane.Clone()
    T = rg.Transform.Translation(safe_plane.ZAxis * height)
    safe_plane.Transform(T)
    return safe_plane

my_curve = rg.Circle(origin, radius)
nurbs_circle = my_curve.ToNurbsCurve()

parameters = rg.Curve.DivideByCount(nurbs_circle, stroke_count, True)

points = []
for param in parameters:
    point = nurbs_circle.PointAt(param)
    points.append(point)

#create simple two point strokes
my_strokes = []
for i,point in enumerate(points):
    length_remapped = remap(i, 0, len(points)-1, 5, 25)
    height_remapped = remap(i, 0, len(points)-1, -3, 5)
    my_stroke = draw_stroke(point, length_remapped, height_remapped)
    my_strokes.append(my_stroke)

#add lift 
my_safe_strokes = []
for sub_list in my_strokes:
    end_plane = sub_list[-1]
    start_plane = sub_list[0]
    safe_plane_start = create_safe_plane(start_plane, 100.0)
    safe_plane_end = create_safe_plane(end_plane, 100.0)
    safer_stroke = [safe_plane_start,start_plane, end_plane, safe_plane_end]
    my_safe_strokes.append(safer_stroke)



my_way_planes = list_to_tree(my_safe_strokes)
# ---------- end rhino ----------
compas = Python3Script(origin=pt, square_size=number_slider)  # -> out, my_way_planes; inputs origin: Point3d, square_size: Double
# ---------- compas: Python ----------
import compas.geometry as cg

def create_square_way_planes(origin, size):
    """
    Define a square with a point3d as origin and 
    size as a float for the width and length
    """
    # Calculate the coordinates for the four corners of the square
    x, y = origin.X, origin.Y

    # Define the four corners of the square
    corner1 = cg.Point(x - size / 2, y - size / 2, 0)
    corner2 = cg.Point(x + size / 2, y - size / 2, 0)
    corner3 = cg.Point(x + size / 2, y + size / 2, 0)
    corner4 = cg.Point(x - size / 2, y + size / 2, 0)
    
    # Make plane from corner points
    plane1 = cg.Frame(corner1, cg.Vector.Xaxis(), cg.Vector.Yaxis())
    plane2 = cg.Frame(corner2, cg.Vector.Xaxis(), cg.Vector.Yaxis())
    plane3 = cg.Frame(corner3, cg.Vector.Xaxis(), cg.Vector.Yaxis())
    plane4 = cg.Frame(corner4, cg.Vector.Xaxis(), cg.Vector.Yaxis())

    # Add the corners to the list of square planes
    square_planes = [plane1, plane2, plane3, plane4, plane1]

    # Return the list of square points
    return square_planes

my_way_planes = create_square_way_planes(origin, square_size)
# ---------- end compas ----------
fine_adjust_z_mm = Slider(0.8, range=-5..10)
pt_2 = ConstructPoint(XCoordinate="535.90", YCoordinate="101.40", ZCoordinate="-9.39")
pt_3 = ConstructPoint(XCoordinate="246.86", YCoordinate="-314.78", ZCoordinate="-10.85")
# Transform from Rhino to Robot Space
pt_4 = ConstructPoint(XCoordinate="534.35", YCoordinate="-315.60", ZCoordinate="-9.96")
rhino_2 = Python3Script(way_planes=rhino.my_way_planes, wobj_origin=pt_4, wobj_xaxis=pt_2, wobj_xypoint=pt_3, z_safe_margin=fine_adjust_z_mm)  # -> out, transformed_planes; inputs way_planes: list of Plane, wobj_origin: Point3d, wobj_xaxis: Point3d, wobj_xypoint: Point3d, z_safe_margin: Double
# ---------- rhino_2: Python ----------
import Rhino.Geometry as rg
from ghpythonlib.treehelpers import list_to_tree, tree_to_list

#in this step we transform our way planes to robot space
#the rhino co-ordinate system is rather abstract in the physical world
#the robot base plane assumed the base frame of robot is the origin
#but rhino does not know that
#thus we transform things from our design space(Rhino World XY) to Robot Base Plane that we measure

def set_robot_base(origin, xaxis, xypoint):
    """
    set a base plane representing the robot working object plane
    """
    robot_base = rg.Plane(origin, xaxis - origin, xypoint - origin)
    print (robot_base)
    return (robot_base)

def rhino_to_robot_space(rhino_plane,robot_base_plane):
    """
    Transform the objects from Rhino world XY plane to robot work object plane
    """
    T_matrix = rg.Transform.PlaneToPlane(rg.Plane.WorldXY,robot_base_plane)
    robot_plane = rhino_plane.Clone()
    robot_plane.Transform(T_matrix)
    return robot_plane

def set_z_safe_margin(planes_to_adjust, safety_margin):
    adjusted_way_planes = []
    for plane in planes_to_adjust:
        plane.OriginZ += safety_margin
        adjusted_way_planes.append(plane)
    return adjusted_way_planes

# ===== Robot base is set =====
robot_base =  set_robot_base(wobj_origin, wobj_xaxis, wobj_xypoint)

# ===== Set safety margin for Z height ======
safer_planes = set_z_safe_margin(way_planes, z_safe_margin)

# ===== Transforming the rhino planes into robot planes =====
transformed_planes = []
for plane in way_planes: 
    transformed_planes.append(rhino_to_robot_space(plane, robot_base))


transformed_planes = list_to_tree(transformed_planes)
# ---------- end rhino_2 ----------
compas_2 = Python3Script(way_planes=compas.my_way_planes, wobj_origin=pt_4, wobj_xaxis=pt_2, wobj_xypoint=pt_3, z_safe_margin=fine_adjust_z_mm)  # -> out, transformed_planes; inputs way_planes: list, wobj_origin: Point3d, wobj_xaxis: Point3d, wobj_xypoint: Point3d, z_safe_margin: Double
# ---------- compas_2: Python ----------
import compas.geometry as cg

#in this step we transform our way planes to robot space
#the rhino co-ordinate system is rather abstract in the physical world
#the robot base plane assumed the base frame of robot is the origin
#but rhino does not know that
#thus we transform things from our design space(Rhino World XY) to Robot Base Plane that we measure

def set_robot_base(origin, xaxis, xypoint):
    """
    set a base plane representing the robot working object plane
    """
    robot_base = cg.Frame(origin, xaxis - origin, xypoint - origin)
    print (robot_base)
    return (robot_base)

def rhino_to_robot_space(rhino_plane,robot_base_plane):
    """
    Transform the objects from Rhino world XY plane to robot work object plane
    """
    T_matrix = cg.Transformation.from_frame_to_frame(cg.Frame.worldXY(), robot_base_plane)
    robot_plane = rhino_plane.transformed(T_matrix)
    return robot_plane

def set_z_safe_margin(planes_to_adjust, safety_margin):
    adjusted = []
    T = cg.Translation.from_vector(cg.Vector(0, 0, safety_margin))
    for f in planes_to_adjust:
        adjusted.append(f.transformed(T))
    return adjusted

# ===== Robot base is set =====
robot_base =  set_robot_base(wobj_origin, wobj_xaxis, wobj_xypoint)
print(robot_base)

# ===== Set safety margin for Z height ======
safer_planes = set_z_safe_margin(way_planes, z_safe_margin)

# ===== Transforming the rhino planes into robot planes =====
transformed_planes = []
for plane in way_planes: 
    transformed_planes.append(rhino_to_robot_space(plane, robot_base))
# ---------- end compas_2 ----------
py3 = Python3Script(cg=compas_2.transformed_planes)  # -> rg
# ---------- py3: Python ----------
"""
Draws COMPAS geometry in Grasshopper.
"""

from ghpythonlib.componentbase import executingcomponent as component

from compas.scene import SceneObject


class CompasToRhinoGeometry(component):
    def RunScript(self, cg):
        if not cg:
            return None

        return SceneObject(item=cg).draw()
# ---------- end py3 ----------

pt_5 = ConstructPoint(XCoordinate="447.60", YCoordinate="-44.98", ZCoordinate="-1.78")
rhino_3 = Python3Script(way_planes=rhino_2.transformed_planes, paint_point=pt_5, frequency=Slider(6, range=0..10))  # -> out, all_planes; inputs way_planes: tree, paint_point: Point3d, frequency: Int32
# ---------- rhino_3: Python ----------
import Rhino.Geometry as rg
import math
from ghpythonlib.treehelpers import list_to_tree, tree_to_list


#We want to add a point where brush can go to dip the paint

def dip_brush(point):
    """
    Function to take a point and create a list of planes around dip point
    these are - safe plane before dip, 
                dip plane, 
                and safe plane after dip
    point : point(x,y,z) in robot base co-ordinates(measured)
    """
    paint_planes_in_order = []
    paint_plane = rg.Plane(paint_point, rg.Vector3d.XAxis, rg.Vector3d.YAxis)
    #create plane in desired orientation and rotate it as you want brush to be
    #paint_plane.Rotate(math.radians(-30), paint_plane.XAxis, paint_plane.Origin)
    #take the paint plane and create a safety plane for the travel movement
    safe_plane = paint_plane.Clone()
    safe_plane.Translate(rg.Vector3d(0,0,100))
    paint_planes_in_order.append(safe_plane)
    paint_planes_in_order.append(paint_plane)
    paint_planes_in_order.append(safe_plane)
    return paint_planes_in_order



way_planes = tree_to_list(way_planes)

#we add the whole dip movement before every row of strokes
all_planes = []
#we know that our way planes are a list
#so we create a new list, add the paint points to the beginning 
#and later add all our way planes to it
#now all planes are in a flat list
all_planes.extend(dip_brush(paint_point))
for i, sub_list in enumerate(way_planes):
    all_planes.extend(sub_list)
    if i%frequency == 0:
        all_planes.extend(dip_brush(paint_point))
# ---------- end rhino_3 ----------
points = PointList(Points=rhino_3.all_planes, Size=Slider(15, range=0..100))

number_slider_2 = Slider(0.1, range=0..0.1)
number_slider_3 = Slider(0.1, range=0..0.1)

# ---- group: Preview robot path
pline = PolyLine(Vertices=rhino_3.all_planes, Closed=False)

# ----
# Convert Planes to URScript
pt_6 = ConstructPoint(XCoordinate="0.07", YCoordinate="-0.06", ZCoordinate="74.33")
rhino_4 = Python3Script(way_planes=rhino_3.all_planes, tcp_measured=pt_6, acceleration=number_slider_2, velocity=number_slider_3)  # -> out, script; inputs way_planes: list of Plane, tcp_measured: Point3d, acceleration: Double, velocity: Double
# ---------- rhino_4: Python ----------
from imp import reload
import sys

sys.path.append("C:\\Users\\jfrancisco\\Documents\\2526_prep\\2526_T1\\02_RoboticDrawing\\src")

import simple_ur_script as ur
reload(ur)

import utils 
reload(utils)

import simple_comm as com
reload(com)

import Rhino.Geometry as rg
import math as m

script = "" #create empty string

#if value given for tcp measured, then add line to script, otherwise it will take current tcp from robot
if tcp_measured is not None:
    script += ur.set_tcp_by_angles(tcp_measured.X, tcp_measured.Y, tcp_measured.Z, m.radians(0.0),m.radians(-180.0),m.radians(0))

#calculate blend
blend_radii = utils.calculate_blend_radius(way_planes, 25.0)
#add move_l commands to script for each way plane
for plane, radius in zip(way_planes, blend_radii):
    script += ur.move_l_blend(plane, acceleration, velocity, radius)


#format the script to make it sendable
script = com.concatenate_script(script)
# ---------- end rhino_4 ----------
compas_3 = Python3Script(way_planes=compas_2.transformed_planes, tcp_measured=pt_6, acceleration=number_slider_2, velocity=number_slider_3)  # -> out, script; inputs way_planes: list, tcp_measured: Point3d, acceleration: Double, velocity: Double
# ---------- compas_3: Python ----------
from imp import reload
import sys

sys.path.append("C:\\Users\\jfrancisco\\Documents\\2526_prep\\2526_T1\\02_RoboticDrawing\\src\\compas")

import simple_ur_script as ur
reload(ur)

import utils 
reload(utils)

import simple_comm as com
reload(com)

import Rhino.Geometry as rg
import math as m

script = "" #create empty string

#if value given for tcp measured, then add line to script, otherwise it will take current tcp from robot
if tcp_measured is not None:
    script += ur.set_tcp_by_angles(tcp_measured.X, tcp_measured.Y, tcp_measured.Z, m.radians(0.0),m.radians(-180.0),m.radians(0))

#calculate blend
blend_radii = utils.calculate_blend_radius(way_planes, 25.0)
#add move_l commands to script for each way plane
for plane, radius in zip(way_planes, blend_radii):
    script += ur.move_l_blend(plane, acceleration, velocity, radius)


#format the script to make it sendable
script = com.concatenate_script(script)
# ---------- end compas_3 ----------

# ---- group: Send UR script to Robot!
py3_2 = Python3Script(script=rhino_4.script, ip_address="192.168.10.10", send=Button())  # -> out, a; inputs script: String, ip_address: String, send: Boolean
# ---------- py3_2: Python ----------
import simple_comm as com

if send:
    com.send_script(script,ip_address)
# ---------- end py3_2 ----------

# ----
# Send to Robot!
panel = Panel(compas_3.script)
