# Grasshopper definition 101_one_brick_two_brick_ex.ghx (Grasshopper 1.0.8)

# Step 1: Generate brick wall
ironpython_2_script = IronPython2Script()  # -> out, a
# ---------- ironpython_2_script: IronPython ----------
#import brick class as a module from python file in same folder


#import compas_geometry


#call create wall function


#create geometry and sequence of frames
# ---------- end ironpython_2_script ----------
