# Grasshopper definition 201_create_curve_wall.ghx (Grasshopper 1.0.8)

panel = Panel("C:\Users\jfrancisco\Documents\2526_prep\2526_T1\04_RoboticBricks")
o_x = Slider(100, range=10..100)
o_y = Slider(100, range=10..100)
gap = Slider(2.5, range=0..10)
geo = Geometry([Point(4.77806632, 14.10038295, 0), Point(37.66029753, 37.95157883, 0), Point(82.8154742, 13.86881795, 0), Point(102.7300649, 38.18314384, 0)])
# Generate Geometry
py3 = Python3Script(
    origin_x=o_x,
    origin_y=o_y,
    num_layers=Slider(17, range=0..100),
    num_per_layer=Slider(100, range=0..100),
    gap=gap,
    points=geo)  # -> out, bricks, ccurve, bricks_geo, sequence_frames; inputs origin_x: Int32, origin_y: Int32, num_layers: Int32, num_per_layer: Int32, gap: Double, points: list of Point3d
# ---------- py3: Python ----------
#import brick class as a module from python file in same folder
import Brick_class_ex as bc

#import compas_geometry
import compas.geometry as cg
from compas_rhino import conversions

import Rhino.Geometry as rg
from imp import reload



#call create wall function
bricks = bc.create_wall(origin =cg.Point(origin_x, origin_y, 0),
                        num_layers = num_layers,
                        num_bricks_per_layer = num_per_layer,
                        gap = gap)


#convert points to compas
ccpoints = [conversions.point_to_compas(pt) for pt in points]
print(ccpoints)
#create a curve
ccurve = cg.NurbsCurve.from_points(ccpoints, 3)

curve_wall = bc.create_curved_wall(ccurve, num_layers, gap)

#create geometry and sequence of frames
bricks_geo = [brick.geometry() for brick in curve_wall]
sequence_frames = [brick.get_pick_frame() for brick in curve_wall]
# ---------- end py3 ----------
py3_2 = Python3Script(bricks_path=panel)  # -> out, a; inputs bricks_path: String
# ---------- py3_2: Python ----------
import sys

if bricks_path not in sys.path:
    sys.path.append(bricks_path)

print(sys.path)

try:
    import Brick_class_ex
except ImportError as e:
    print("Error importing bricks: {e}")
# ---------- end py3_2 ----------
py3_3 = Python3Script(cg=py3.sequence_frames)  # -> rg
# ---------- py3_3: Python ----------
"""
Draws COMPAS geometry in Grasshopper.
"""

from ghpythonlib.componentbase import executingcomponent as component

from compas.scene import SceneObject


class CompasToRhinoGeometry(component):
    def RunScript(self, cg):
        if not cg:
            return None

        return SceneObject(item=cg).draw()
# ---------- end py3_3 ----------
py3_4 = Python3Script(cg=py3.bricks_geo)  # -> rg; same code as py3_3
py3_5 = Python3Script(mypath=py3.sequence_frames, save=Button())  # -> out, a; inputs save: Boolean
# ---------- py3_5: Python ----------
import sys
import os

#get current file path
path = ghenv.Component.OnPingDocument().FilePath
#get parent directory of the parent directory
parentdir = os.path.dirname(path)
#get src folder which contains classes

folderpath = os.path.join(parentdir,'scale-up\send_to_robot\data')
sys.path.append(folderpath)

name = 'pickplace_bricks.json'
file_path = os.path.join(folderpath, name)
print(file_path)

data = mypath


###########################exportJSON######################################
from compas import json_dump

if save:
    json_dump(data, file_path, pretty=True)
# ---------- end py3_5 ----------
pline = PolyLine(Vertices=py3_3, Closed=False)
fine_adjust_z_mm = Slider(4.8, range=-5..10)
pt = ConstructPoint(XCoordinate="535.90", YCoordinate="101.40", ZCoordinate="-9.39")
pt_2 = ConstructPoint(XCoordinate="246.86", YCoordinate="-314.78", ZCoordinate="-10.85")
# Transform from Rhino to Robot Space
pt_3 = ConstructPoint(XCoordinate="534.35", YCoordinate="-315.60", ZCoordinate="-9.96")
compas = Python3Script(way_planes=py3.sequence_frames, wobj_origin=pt_3, wobj_xaxis=pt, wobj_xypoint=pt_2, z_safe_margin=fine_adjust_z_mm)  # -> out, transformed_planes; inputs way_planes: list, wobj_origin: Point3d, wobj_xaxis: Point3d, wobj_xypoint: Point3d, z_safe_margin: Double
# ---------- compas: Python ----------
import compas.geometry as cg

#in this step we transform our way planes to robot space
#the rhino co-ordinate system is rather abstract in the physical world
#the robot base plane assumed the base frame of robot is the origin
#but rhino does not know that
#thus we transform things from our design space(Rhino World XY) to Robot Base Plane that we measure

def set_robot_base(origin, xaxis, xypoint):
    """
    set a base plane representing the robot working object plane
    """
    robot_base = cg.Frame(origin, xaxis - origin, xypoint - origin)
    print (robot_base)
    return (robot_base)

def rhino_to_robot_space(rhino_plane,robot_base_plane):
    """
    Transform the objects from Rhino world XY plane to robot work object plane
    """
    T_matrix = cg.Transformation.from_frame_to_frame(cg.Frame.worldXY(), robot_base_plane)
    robot_plane = rhino_plane.transformed(T_matrix)
    return robot_plane

def set_z_safe_margin(planes_to_adjust, safety_margin):
    adjusted = []
    T = cg.Translation.from_vector(cg.Vector(0, 0, safety_margin))
    for f in planes_to_adjust:
        adjusted.append(f.transformed(T))
    return adjusted

# ===== Robot base is set =====
robot_base =  set_robot_base(wobj_origin, wobj_xaxis, wobj_xypoint)
print(robot_base)

# ===== Set safety margin for Z height ======
safe_planes = set_z_safe_margin(way_planes, z_safe_margin)

# ===== Transforming the rhino planes into robot planes =====
transformed_planes = []
for plane in safe_planes: 
    transformed_planes.append(rhino_to_robot_space(plane, robot_base))
# ---------- end compas ----------
py3_6 = Python3Script(cg=compas.transformed_planes)  # -> rg; same code as py3_3
py3_7 = Python3Script(x="-6.77", y="445.68", z="62.67", rx="0.9101", ry="0.7456", rz="1.6288")  # -> out, pick_frame; inputs x: Double, y: Double, z: Double, rx: Double, ry: Double, rz: Double
# ---------- py3_7: Python ----------
from compas.geometry import Frame, Point
from compas.geometry import Rotation
import compas.geometry as cg

#define pick frame
pick_frame = Frame.from_axis_angle_vector(axis_angle_vector = [rx, ry, rz], point =[x,y,z])

#new_frame = Frame(Point(180.05, -628.67, 163.53), Point(180.05, -640.14, 163.84), Point(215.08, -629.50, 207.67))

origin = cg.Point(183.11, -627.52, 163.50)
xaxis = cg.Point(182.30, -639.40, 163.80)
xypoint = cg.Point(202.01, -634.30, 188.46)

new_frame = Frame(origin, xaxis - origin, xypoint - origin)

#f1 = new_frame
#R = Rotation.from_frame(new_frame)
#f2 = Frame.from_rotation(R, point=f1.point)
#f1 == f2

new_frames = []
new_frames.append(new_frame)
# ---------- end py3_7 ----------
number_slider = Slider(0.1, range=0..0.1)
number_slider_2 = Slider(0.1, range=0..0.1)
# Convert Planes to URScript
pt_4 = ConstructPoint(XCoordinate="0.07", YCoordinate="-0.06", ZCoordinate="74.33")
compas_2 = Python3Script(
    way_frames=compas.transformed_planes,
    tcp_measured=pt_4,
    acceleration=number_slider,
    velocity=number_slider_2,
    pick_frame=py3_7.pick_frame)  # -> out, vis_frames, vis_planes, script; inputs way_frames: list, tcp_measured: Point3d, acceleration: Double, velocity: Double
# ---------- compas_2: Python ----------
from imp import reload
import sys
import os

#get current file path
path = ghenv.Component.OnPingDocument().FilePath
#get parent directory of the parent directory
parentdir = os.path.dirname(path)
#get src folder which contains classes
dire = os.path.join(parentdir,'src')

sys.path.append(dire)

import simple_ur_script as ur
reload(ur)

import utils 
reload(utils)

import simple_comm as com
reload(com)

import compas.geometry as cg
import math as m

# ===== Set global constants =======

IO = 0 #Global constant
SAFE_DIST = 50

# =================================

script = "" #create empty string

def pickup_brick(script,pick_up_frame):
    frames = []
    
    safe_pick_up_frame = pick_up_frame.translated(pick_up_frame.normal*SAFE_DIST)
    
    ## add to the path: go to the safe plane
    script += ur.move_l(safe_pick_up_frame, acceleration, velocity)
    frames.append(safe_pick_up_frame)
    
    ## add to the path: go to the pick up plane
    script += ur.move_l(pick_up_frame, acceleration, velocity)
    frames.append(pick_up_frame)
    
    ## add to the path: turn on the vacuum and wait 1 sec.
    script += ur.set_digital_out(IO,True)
    script += ur.sleep(1)

    # add to the path: go back to the safe_plane
    script += ur.move_l(safe_pick_up_frame, acceleration, velocity)
    frames.append(safe_pick_up_frame)
    
    return script, frames


def place_brick(script, place_frame):
    
    frames = []
    
    safe_place_frame = place_frame.translated(cg.Vector(0,0,1)*SAFE_DIST)
    
    # add to the path: go to the safe plane
    script += ur.move_l(safe_place_frame, acceleration, velocity)
    frames.append(safe_place_frame)
    
    # add to the path: go to the place plane
    script += ur.move_l(place_frame, acceleration, velocity)
    frames.append(place_frame)
    
    ## add to the path: turn off the vacuum and wait 1 second (hold the brick)
    script += ur.set_digital_out(IO,False)
    script += ur.sleep(1)
    
    # add to the path: go back to the safe plane
    script += ur.move_l(safe_place_frame, acceleration, velocity)
    frames.append(safe_place_frame)
    
    return script,frames


#if value given for tcp measured, then add line to script, otherwise it will take current tcp from robot
if tcp_measured is not None:
    script += ur.set_tcp_by_angles(tcp_measured.X, tcp_measured.Y, tcp_measured.Z, m.radians(0.0),m.radians(-180.0),m.radians(0))


vis_frames = []
#add move_l commands in sequence to script for each way plane
for brick_frame in way_frames:
    script, p = pickup_brick(script,pick_frame)
    vis_frames.extend(p) #only to visualize the planes
    script, p = place_brick(script,brick_frame)
    vis_frames.extend(p)


#format the script to make it sendable
script = com.concatenate_script(script)

from compas_rhino import conversions
import Rhino.Geometry as rg

vis_planes = [conversions.frame_to_rhino(frame) for frame in vis_frames]
# ---------- end compas_2 ----------
pline_2 = PolyLine(Vertices=compas_2.vis_planes, Closed=False)
points = PointList(Points=compas_2.vis_planes, Size=Slider(7, range=0..100))
py3_8 = Python3Script(cg=compas_2.vis_frames)  # -> rg; same code as py3_3
panel_2 = Panel(compas_2.script)

# ---- group: Send UR script to Robot!
# Send to Robot!
panel_3 = Panel("192.168.10.10")
py3_9 = Python3Script(script=compas_2.script, ip_address=panel_3, send=Button())  # -> out, a; inputs script: String, ip_address: String, send: Boolean
# ---------- py3_9: Python ----------
import simple_comm as com

if send:
    com.send_script(script,ip_address)
# ---------- end py3_9 ----------
