# Grasshopper definition 201_primitives_and_subdivisions_examples.ghx (Grasshopper 1.0.8)

# ----
# mesh from scratch
ghpython_script = GhPythonScript(num_corners=Slider(6, range=0..10), radius=Slider(10, range=0..10))  # -> out, my_mesh; inputs num_corners: Int32
# ---------- ghpython_script: Python ----------
import mola
from mola import module_rhino

import math

# create a new empty mesh
mesh = mola.Mesh()
z = 0

# add a ring of vertices using polar coordinates(equation of a circle)
theta = 2*math.pi / num_corners
for i in range(num_corners):
    angle = i * theta
    x = radius * math.cos(angle)
    y = radius * math.sin(angle)
    mesh.add_vertex(x, y, z)


# create a center vertex at the origin
cen = mola.Vertex(0,0,0)
mesh.vertices.append(cen)

# add triangular faces
for i in range(num_corners):
    # walk along the ring
    # v0 is the current vertex, v1 the next
    # if v1 is the last, v2 is the first again
    # i goes from 0 to num_corners-1, if i+1 == num_corners -> 0
    v0 = mesh.vertices[i]
    vnext = mesh.vertices[(i+1)%num_corners]
    print(v0, vnext, cen, i)
    f = mola.Face([v0, vnext, cen])
    mesh.faces.append(f)

my_mesh = module_rhino.display_mesh(mesh)
# ---------- end ghpython_script ----------
mesh = Mesh(ghpython_script.my_mesh)

add_path = GhPythonScript(mola_path="C:\Users\akango\Documents\github", reload=Button())  # inputs reload: Boolean
# ---------- add_path: Python ----------
import sys
import imp

if mola_path not in sys.path:
    sys.path.append(mola_path)


import mola
import math
from mola import module_rhino

if reload:
    print("reloaded")
    imp.reload(mola)
# ---------- end add_path ----------

# ----
# primitives
number_slider = Slider(-5, range=-5..5)
icosahedron = GhPythonScript(radius=Slider(16, range=0..100))  # -> out, my_mesh, my_mesh_rhino
# ---------- icosahedron: Python ----------
import mola
from mola import module_rhino

# construct a icosahedron
my_mesh = mola.construct_icosahedron(radius)

my_mesh_rhino = module_rhino.display_mesh(my_mesh)
# ---------- end icosahedron ----------
cone = GhPythonScript(
    z1=Slider(-5, range=-10..10),
    z2=Slider(10, range=-10..10),
    r1=Slider(10, range=-10..10),
    r2=Slider(6, range=0..10),
    nSegments=Slider(9, range=0..10))  # -> out, my_mesh_rhino, my_mesh; inputs nSegments: Int32
# ---------- cone: Python ----------
import mola
from mola import module_rhino

# construct a truncated cone using the z-heights and radii of the bottom and top.
my_mesh = mola.construct_cone(z1,z2,r1,r2,nSegments)
# color mesh faces by their area
mola.color_faces_by_area(my_mesh.faces)


my_mesh_rhino = module_rhino.display_mesh(my_mesh)
# ---------- end cone ----------
box = GhPythonScript(
    x1=number_slider,
    y1=Slider(-4, range=-5..5),
    z1=Slider(-3, range=-5..5),
    x2=Slider(5, range=-5..5),
    y2=Slider(4, range=-5..5),
    z2=Slider(3, range=-5..5))  # -> out, my_mesh_rhino, my_mesh
# ---------- box: Python ----------
import mola
from imp import reload
from mola import module_rhino

#construct a Box Mesh using two corners that represent a box
my_mesh = mola.construct_box(x1, y1, z1, x2, y2, z2)

my_mesh_rhino = module_rhino.display_mesh(my_mesh)
# ---------- end box ----------
mesh_2 = Mesh(icosahedron.my_mesh_rhino)
mesh_3 = Mesh(box.my_mesh_rhino)
mesh_4 = Mesh(cone.my_mesh_rhino)

ghpython_script_2 = GhPythonScript(mesh=icosahedron.my_mesh, numberOfIterations=Slider(3, range=0..10))  # -> out, my_mesh, my_mesh_rhino; inputs numberOfIterations: Int32
# ---------- ghpython_script_2: Python ----------
import mola
from mola import module_rhino

for i in range(numberOfIterations):
    newMesh = mola.Mesh()
    for face in mesh.faces:
    # the height of the roof is dependent on the current iteration index
        roofHeight = 3 / (i * 2 + 1)
        resultingfaces = mola.subdivide_face_split_roof(face,roofHeight)
        newMesh.faces.extend(resultingfaces)
    mesh = newMesh

my_mesh = mesh
mola.color_faces_by_area(my_mesh.faces)

my_mesh_rhino = module_rhino.display_mesh(my_mesh)
# ---------- end ghpython_script_2 ----------
ghpython_script_3 = GhPythonScript(mesh=cone.my_mesh, numberOfIterations=Slider(5, range=0..10))  # -> out, my_mesh, my_mesh_rhino; inputs numberOfIterations: Int32
# ---------- ghpython_script_3: Python ----------
import mola
from mola import module_rhino

for i in range(numberOfIterations):
    newMesh=mola.Mesh()
    for face in mesh.faces:
    # the extrusion height is dependent on the current iteration index
        resultingfaces=mola.subdivide_face_extrude_to_point_center(face,1/(i+1))
        newMesh.faces.extend(resultingfaces)
    mesh=newMesh

my_mesh = mesh
mola.color_faces_by_vertical_angle(my_mesh.faces)

my_mesh = module_rhino.display_mesh(my_mesh)
# ---------- end ghpython_script_3 ----------
ghpython_script_4 = GhPythonScript(mesh=box.my_mesh, numberOfIterations=Slider(0, range=0..10))  # -> out, my_mesh, my_mesh_rhino; inputs numberOfIterations: Int32
# ---------- ghpython_script_4: Python ----------
import mola
from mola import module_rhino

for i in range(numberOfIterations):
    newMesh = mola.Mesh()
    for face in mesh.faces:
        resultingfaces = mola.subdivide_face_extrude_tapered(face,3,0.5,doCap=False)
        newMesh.faces.extend(resultingfaces)
    mesh = newMesh

my_mesh = mesh

mola.color_faces_by_area(my_mesh.faces)

my_mesh_rhino = module_rhino.display_mesh(my_mesh)
# ---------- end ghpython_script_4 ----------
# subdivision
ghpython_script_5 = GhPythonScript(mesh=box.my_mesh)  # -> out, my_mesh, my_mesh_rhino
# ---------- ghpython_script_5: Python ----------
import mola
from mola import module_rhino

extrusion = 4

newMesh = mola.Mesh()
for face in mesh.faces:
    resultingFaces = mola.subdivide_face_extrude(face,extrusion)
    newMesh.faces.extend(resultingFaces)

my_mesh = newMesh
mola.color_faces_by_area(my_mesh.faces)

my_mesh_rhino = module_rhino.display_mesh(my_mesh)
# ---------- end ghpython_script_5 ----------
