# Grasshopper definition 201_primitives_and_subdivisions_solution.ghx (Grasshopper 1.0.8)

# ----
# Rhino v 8.0
number_slider = Slider(10, range=0..10)
py3 = Python3Script(radius=Slider(4, range=0..100), num_sides=number_slider)  # -> out, new_mesh_rhino; inputs radius: Double, num_sides: Int32
# ---------- py3: Python ----------
import math
import Rhino.Geometry as rg
import mola
from mola import module_rhino

step_theta = (2*math.pi)/num_sides
z = 0

points = []

new_mesh = mola.Mesh()

#print(math.degrees(step_theta))
for i in range(num_sides):
    theta = i* step_theta
    x = radius*math.cos(theta)
    y = radius*math.sin(theta)
    pt = rg.Point3d(x,y,z)
    points.append(pt)
    #v = mola.Vertex(x,y,z)
    new_mesh.add_vertex(x,y,z)

#points.append(rg.Point3d(0,0,0))
#new_mesh.add_vertex(0,0,10)


new_mesh.add_face(new_mesh.vertices)

new_mesh_rhino = module_rhino.display_mesh(new_mesh)
# ---------- end py3 ----------
geo = Geometry(py3.new_mesh_rhino)

py3_2 = Python3Script(radius=Slider(4, range=0..100), num_sides=Slider(10, range=0..10))  # -> out, new_mesh_rhino; inputs radius: Double, num_sides: Int32
# ---------- py3_2: Python ----------
import math
import Rhino.Geometry as rg
import mola
from mola import module_rhino

step_theta = (2*math.pi)/num_sides
#print(math.degrees(step_theta))
z = 0

points = []

new_mesh = mola.Mesh()

for i in range(num_sides):
    theta = i* step_theta
    x = radius*math.cos(theta)
    y = radius*math.sin(theta)
    pt = rg.Point3d(x,y,z)
    points.append(pt)
    #v = mola.Vertex(x,y,z)
    new_mesh.add_vertex(x,y,z)

#points.append(rg.Point3d(0,0,0))
new_mesh.add_vertex(0,0,10)

for i in range(num_sides):
    v0 = new_mesh.vertices[i]
    v1 = new_mesh.vertices[(i+1)%num_sides]
    cen = new_mesh.vertices[-1]
    new_mesh.add_face([v0,v1,cen])

new_mesh_rhino = module_rhino.display_mesh(new_mesh)
# ---------- end py3_2 ----------
geo_2 = Geometry(py3_2.new_mesh_rhino)

# ----
# mesh from scratch
py3_3 = Python3Script(mola_path="C:\\Users\\jfrancisco\\Documents\\GitHub")  # -> out, a; inputs mola_path: String
# ---------- py3_3: Python ----------
import sys

if mola_path not in sys.path:
    sys.path.append(mola_path)

print(sys.path)

try:
    import mola
    from mola import module_rhino
except ImportError as e:
    print("Error importing mola: {e}")
# ---------- end py3_3 ----------

number_slider_2 = Slider(5, range=0..10)
number_slider_3 = Slider(-7, range=-10..10)
# primitives
py3_4 = Python3Script(x=number_slider_2, y=number_slider_2, z=number_slider_2, x1=number_slider_3, y1=number_slider_3, z1=number_slider_3)  # -> out, my_mesh, my_mesh_rhino
# ---------- py3_4: Python ----------
import mola
from mola import module_rhino

my_mesh = mola.construct_box(x,y,z,x1,y1,z1)

my_mesh_rhino = module_rhino.display_mesh(my_mesh)
# ---------- end py3_4 ----------
# subdivision
py3_5 = Python3Script(mesh=py3_4.my_mesh, r=Slider(3, range=0..10))  # -> out, new_mesh, my_mesh_rhino; inputs r: Int32
# ---------- py3_5: Python ----------
import mola
from mola import module_rhino

for i in range(r):
    new_mesh = mola.Mesh()
    for f in mesh.faces:
        resulting_faces = mola.subdivide_face_extrude_to_point_center(f, i/2)
        new_mesh.faces.extend(resulting_faces)
    mesh = new_mesh

new_mesh.update_topology()
my_mesh_rhino = module_rhino.display_mesh(new_mesh)
# ---------- end py3_5 ----------
py3_6 = Python3Script(mesh=py3_5.new_mesh)  # -> out, new_mesh, my_mesh_rhino
# ---------- py3_6: Python ----------
import mola
from mola import module_rhino

new_mesh = mesh
for i in range(1):
    new_mesh = mola.subdivide_mesh_catmull(new_mesh)
    

mola.color_faces_by_area(new_mesh.faces)

my_mesh_rhino = module_rhino.display_mesh(new_mesh)
# ---------- end py3_6 ----------

py3_7 = Python3Script(r=Slider(5, range=0..10))  # -> out, new_mesh, my_mesh_rhino; inputs r: Int32
# ---------- py3_7: Python ----------
import mola
from mola import module_rhino

my_mesh = mola.construct_sphere(r,3,3)

for v in my_mesh.vertices:
    if v.z>0:
        v.z *= 1.5

my_mesh = mola.subdivide_mesh_catmull(my_mesh)

my_properties = my_mesh.face_properties(mola.face_center_z)


mola.color_faces_by_vertical_angle(my_mesh.faces)

heights = mola.math_map_list(my_properties, 0.0, 2.0)

new_mesh = mola.Mesh()
for i, f in enumerate(my_mesh.faces):
    if heights[i] > 0.5:
        doCap = False
    else: 
        doCap = True
    resulting_faces = mola.subdivide_face_extrude_tapered(f, heights[i], 0.6, doCap)
    new_mesh.faces.extend(resulting_faces)

new_mesh.update_topology()
new_mesh = mola.mesh_offset(new_mesh,0.2)

for i in range(1):
    new_mesh = mola.subdivide_mesh_catmull(new_mesh)

props = new_mesh.face_properties(mola.face_center_z)
color_scheme = [(0,0,1),(1,0,1), (0.5,0.5,0.5), (1,1,1)]
colors = mola.color_map(props , color_scheme)
mola.color_faces_by_map(new_mesh.faces,colors)


new_mesh.update_topology()
my_mesh_rhino = module_rhino.display_mesh(new_mesh)
# ---------- end py3_7 ----------
geo_3 = Geometry(py3_7.my_mesh_rhino)
