# Grasshopper definition 202_parametric_flowers.ghx (Grasshopper 1.0.8)

panel = Panel("C:\Users\jfrancisco\Documents\GitHub")
button = Button()
add_path = GhPythonScript(mola_path=panel, reload=button)  # inputs reload: Boolean
# ---------- add_path: Python ----------
import sys
import imp

if mola_path not in sys.path:
    sys.path.append(mola_path)


import mola
import math
from mola import module_rhino

if reload:
    print("reloaded")
    imp.reload(mola)
# ---------- end add_path ----------

number_slider = Slider(60, range=0..100)

# ----
# Create primitives
number_slider_2 = Slider(5, range=0..100)
octahedron = GhPythonScript(sides=number_slider_2)  # -> out, mmy_mesh, my_mesh_rhino, points, faces; inputs sides: Int32
# ---------- octahedron: Python ----------
import mola
import math
from Rhino.Geometry import Point3d
from mola import module_rhino, Vertex
from mola.core_face import Face

# construct a octahedron
z1 = 0
z2 = 5
radius1 = 10
radius2 = 10
my_mesh = mola.construct_cone(z1,z2,radius1,radius2,sides)


delaAngle = math.radians(360.0 / sides)
angle = 0
center_v = []
points = []
for i in range(sides):
    radius = radius2/4
    x1 = radius * math.cos(angle)
    y1 = radius * math.sin(angle)
    h = z2/2
    center_v.append(Vertex(x1, y1, h))
    pt = Point3d(x1,y1,z2)
    points.append(pt)
    angle += delaAngle

new_mesh = mola.Mesh()

for i, f in enumerate(my_mesh.faces):
    if i == sides:
        f.group = 0
        new_mesh.faces.append(f)
    if i <= (sides-1):
        f.group = 1
        new_mesh.faces.append(f)

for i in range(sides):
    v0 = my_mesh.faces[-1].vertices[i]
    v1 = my_mesh.faces[-1].vertices[(i+1)%sides]
    v2 = center_v[i]
    v3 = center_v[(i+1)%sides]
    new_face = Face([v0,v1,v3,v2])
    new_face.group = 2
    new_mesh.faces.append(new_face)
    

center_face = Face(center_v)
center_face.group = 3
new_mesh.faces.append(center_face)




mmy_mesh = new_mesh
mmy_mesh.update_topology()

my_mesh_rhino = module_rhino.display_mesh(mmy_mesh)
# ---------- end octahedron ----------
mesh = Mesh(octahedron.my_mesh_rhino)

py3 = Python3Script(mola_path=panel, reload=button)  # inputs mola_path: String, reload: Boolean; same code as add_path
# Subdivide extrude tapered
number_slider_3 = Slider(30, range=0..100)
number_slider_4 = Slider(2, range=0..10)

# ----
# Subdivide extrude tapered
ghpython_script = GhPythonScript(
    mesh=octahedron.mmy_mesh,
    lenght=Slider(8, range=0..10),
    height=Slider(3, range=0..10),
    center=Slider(4, range=0..10),
    flower_tip=Slider(0.79, range=0.1..0.9))  # -> out, my_mesh, my_mesh_rhino; inputs lenght: Int32, height: Int32, center: Int32, flower_tip: Boolean
# ---------- ghpython_script: Python ----------
import mola
from mola import module_rhino

#first step
new_mesh = mola.Mesh()
for i, f in enumerate(mesh.faces):
    if f.group != 0:
        new_faces = mola.subdivide_face_extrude_tapered(f, lenght, 0.4)
        new_mesh.faces.extend(new_faces)
    if f.group == 0:
        new_mesh.faces.append(f)

my_mesh = new_mesh
my_mesh.update_topology()

#display
my_mesh_rhino = module_rhino.display_mesh(my_mesh)
# ---------- end ghpython_script ----------

mesh_2 = Mesh()
ghpython_script_2 = GhPythonScript(mesh=ghpython_script.my_mesh)  # -> out, my_mesh, my_mesh_rhino
# ---------- ghpython_script_2: Python ----------
import mola
from mola import module_rhino

#final smoothing
my_mesh = mola.subdivide_mesh_catmull(mesh)

#display
my_mesh_rhino = module_rhino.display_mesh(my_mesh)
# ---------- end ghpython_script_2 ----------

# ----
# Smoothing
ghpython_script_3 = GhPythonScript(mesh=ghpython_script.my_mesh)  # -> out, my_mesh, my_mesh_rhino
# ---------- ghpython_script_3: Python ----------
import mola
from mola import module_rhino

#sixth step
mesh.update_topology()
my_mesh = mola.subdivide_mesh_catmull(mesh)
properties = my_mesh.face_properties(mola.face_curvature)
#cmap = mola.color_map(properties)
#color faces by a color map
#mola.color_faces_by_map(my_mesh.faces, cmap)


# seventh step
my_mesh.update_topology()
my_mesh = mola.subdivide_mesh_catmull(my_mesh, properties)

#display
my_mesh_rhino = module_rhino.display_mesh(my_mesh)
# ---------- end ghpython_script_3 ----------
ghpython_script_4 = GhPythonScript(mesh=ghpython_script_2.my_mesh)  # -> out, my_mesh, my_mesh_rhino; same code as ghpython_script_2

ghpython_script_5 = GhPythonScript(mesh=ghpython_script_4.my_mesh)  # -> out, my_mesh, my_mesh_rhino; same code as ghpython_script_2
ghpython_script_6 = GhPythonScript(mesh=ghpython_script_5.my_mesh)  # -> out, my_mesh, my_mesh_rhino; same code as ghpython_script_2
py3_2 = Python3Script(
    sides=Slider(5, range=0..10),
    exterior_radius=Slider(70, range=0..100),
    interior_radius=Slider(36, range=0..1000),
    z2=Slider(81, range=0..100),
    z=Slider(10, range=0..100),
    center_radius=Slider(15, range=0..100))  # -> out, mmy_mesh, my_mesh_rhino, points; inputs sides: Int32, exterior_radius: Int32, interior_radius: Int32, z2: Double, z: Int32, center_radius: Int32
# ---------- py3_2: Python ----------
import mola
import math
from Rhino.Geometry import Point3d
from mola import module_rhino, Vertex
from mola.core_face import Face

# construct a octahedron
z1 = 65

radius1 = exterior_radius
radius2 = interior_radius
my_mesh = mola.construct_cone(z1,z2,radius1,radius2,sides)


delaAngle = math.radians(360.0 / sides)
angle = 0
center_v = []
points = []
for i in range(sides):
    radius = center_radius
    x1 = radius * math.cos(angle)
    y1 = radius * math.sin(angle)
    h = z1 + z*2
    center_v.append(Vertex(x1, y1, h))
    pt = Point3d(x1,y1,z2)
    points.append(pt)
    angle += delaAngle

new_mesh = mola.Mesh()

for i, f in enumerate(my_mesh.faces):
    if i == sides:
        f.group = 0
        new_mesh.faces.append(f)
    if i <= (sides-1):
        f.group = 1
        new_mesh.faces.append(f)

for i in range(sides):
    v0 = my_mesh.faces[-1].vertices[i]
    v1 = my_mesh.faces[-1].vertices[(i+1)%sides]
    v2 = center_v[i]
    v3 = center_v[(i+1)%sides]
    new_face = Face([v0,v1,v3,v2])
    new_face.group = 2
    new_mesh.faces.append(new_face)
    

center_face = Face(center_v)
center_face.group = 3
new_mesh.faces.append(center_face)




mmy_mesh = new_mesh
mmy_mesh.update_topology()

my_mesh_rhino = module_rhino.display_mesh(mmy_mesh)
# ---------- end py3_2 ----------
geo = Geometry(py3_2.points)

mesh_3 = Mesh(py3_2.my_mesh_rhino)

py3_3 = Python3Script(
    mesh=py3_2.mmy_mesh,
    first_layer=number_slider_3,
    second_layer=Slider(11, range=0..100),
    center=Slider(10, range=0..100),
    flower_tip=Slider(0.14, range=0.1..0.9))  # -> out, base_mesh, middle_mesh, new_mesh, my_mesh_rhino; inputs first_layer: Int32, second_layer: Int32, center: Int32, flower_tip: Double
# ---------- py3_3: Python ----------
import mola
from compas.geometry import Vector, Translation

from mola import module_rhino

#first step
new_mesh = mola.Mesh()


for i, f in enumerate(mesh.faces):
    if f.group == 0:
        new_mesh.faces.append(f)
    if f.group == 1:
        new_faces = mola.subdivide_face_extrude_tapered(f,first_layer, flower_tip)
        new_faces[-1].group = 4
        new_mesh.faces.extend(new_faces)
    if f.group == 2:
        more_faces = mola.subdivide_face_split_rel(f, 0, 0.5)
        for face in more_faces:
            new_faces = mola.subdivide_face_extrude_tapered(face,-second_layer, 0.9)
            new_mesh.faces.extend(new_faces)
    if f.group == 3:
        new_faces = mola.subdivide_face_extrude_tapered(f, center, 0.4)
        new_mesh.faces.extend(new_faces)


new_mesh.update_topology()

my_mesh_rhino = module_rhino.display_mesh(new_mesh)
# ---------- end py3_3 ----------
# Smoothing
py3_4 = Python3Script(mesh=py3_3.new_mesh)  # -> out, my_mesh, my_mesh_rhino
# ---------- py3_4: Python ----------
import mola
from mola import module_rhino

#final smoothing


my_mesh = mola.subdivide_mesh_catmull(mesh)



#display
my_mesh_rhino = module_rhino.display_mesh(my_mesh)
# ---------- end py3_4 ----------
py3_5 = Python3Script(mesh=py3_4.my_mesh)  # -> out, my_mesh, my_mesh_rhino; same code as py3_4
py3_6 = Python3Script(mesh=py3_5.my_mesh)  # -> out, my_mesh, my_mesh_rhino
# ---------- py3_6: Python ----------
import mola
from mola import module_rhino

#sixth step
mesh.update_topology()
my_mesh = mola.subdivide_mesh_catmull(mesh)
properties = my_mesh.face_properties(mola.face_curvature)
cmap = mola.color_map(properties)

#color faces by a color map
mola.color_faces_by_map(my_mesh.faces, cmap)


# seventh step
my_mesh.update_topology()
my_mesh = mola.subdivide_mesh_catmull(my_mesh, properties)

#display
my_mesh_rhino = module_rhino.display_mesh(my_mesh)
# ---------- end py3_6 ----------
mesh_4 = Mesh(py3_6.my_mesh_rhino)
