# Grasshopper definition 203_column_generator.ghx (Grasshopper 1.0.8)
# plug-ins: RhinoCodePluginGH

point = Point(Point(0, -1.005445762, 0))

# ----
# Starting mesh
crv = Curve(<curve referenced from the Rhino model>)
ipy2 = IronPython2Script(
    crv=crv,
    center_pt=point,
    sides_num=Slider(5, range=3..20),
    radius=Slider(12.5, range=0..100),
    total_h=Slider(181, range=0..1000),
    h_subdivisions=Slider(7, range=0..10))  # -> out, point_list, new_pts, column_mesh, column_mesh_rhino; inputs crv: Polyline, center_pt: Point3d, sides_num: Int32, radius: Double, total_h: Int32, h_subdivisions: Int32
# ---------- ipy2: IronPython ----------
import Rhino.Geometry as rg
from copy import deepcopy
import mola
import math
from mola import module_rhino
from ghpythonlib.treehelpers import list_to_tree, tree_to_list

z = 0

def points_from_polygon(sides_num, radius):
    point_list = []
    theta = 2*math.pi / sides_num
    for i in range(sides_num):
        angle = i * theta
        x = radius * math.cos(angle)
        y = radius * math.sin(angle)
        point_list.append([x, y, z])
    point_list.append(point_list[0])
    return point_list 

def points_from_curve(curve):
    point_list = []
    for c in curve:
        #print c
        pt = rg.Point3d(c)
        point_list.append(c)
    return point_list


if crv is not None:
    point_list = points_from_curve(crv)
else:
    point_list = points_from_polygon(sides_num, radius)


# Initialize the new_point_list and column_mesh
column_mesh = mola.Mesh()
new_pts = []

for layer_no in range(h_subdivisions + 1):
    z = total_h / h_subdivisions * layer_no
    for p in point_list:
        pt = deepcopy(p)
        pt[2] = z
        new_pts.append(pt)
        column_mesh.add_vertex(pt[0],pt[1],pt[2])

points_per_layer = len(point_list)

for layer_no in range(h_subdivisions):
    offset = layer_no * points_per_layer
    next_offset = (layer_no + 1) * points_per_layer

    for i in range(points_per_layer-1):
        # % to get index 0 in the last iteration or do the if condition like yesterday
        next_i = (i + 1) % points_per_layer

        # Get the vertex indices for the current quad face
        v0 = column_mesh.vertices[offset + i]
        v1 = column_mesh.vertices[offset + next_i]
        v2 = column_mesh.vertices[next_offset + next_i]
        v3 = column_mesh.vertices[next_offset + i]

        # Add the face to the mesh
        column_mesh.add_face([v0, v1, v2, v3])

column_mesh.update_topology()
column_mesh_rhino = module_rhino.display_mesh(column_mesh)
# ---------- end ipy2 ----------
geo = Geometry(ipy2.column_mesh_rhino)
geo_2 = Geometry(ipy2.new_pts)

number_slider = Slider(2.4, range=0..10)
ipy2_2 = IronPython2Script(mola_path="C:\\Users\\jfrancisco\\Documents\\GitHub")  # -> out, a; inputs mola_path: String
# ---------- ipy2_2: IronPython ----------
import sys

if mola_path not in sys.path:
    sys.path.append(mola_path)

print(sys.path)

try:
    import mola
    from mola import module_rhino
except ImportError as e:
    print("Error importing mola: {e}")
# ---------- end ipy2_2 ----------
pt = Point(<point referenced from the Rhino model>)
ipy2_3 = IronPython2Script(point=pt, mesh=ipy2.column_mesh, factor=Slider(3, range=0..10))  # -> out, my_mesh, my_mesh_rhino; inputs point: Vector3d, factor: Int32
# ---------- ipy2_3: IronPython ----------
import Rhino.Geometry as rg
import mola
from mola import module_rhino
import copy


x1 = point[0]
y1 = point[1]
z1 = point[2]


center_ver = mola.Vertex(x1,y1,z1)

bottom_ver = mesh.vertices[0:8]

top_ver = mesh.vertices[-8:]

factor = 1.0  # Scale factor to control how far to move the points

for v in mesh.vertices[0:8]:
    vec = mola.vertex_subtract(v,center_ver)
    vec *= -factor
    new_v = mola.vertex_scale(v,vec)
    print vec

distances = []
for face in mesh.faces:
    dis = mola.vertex_distance(center_ver,face.center())
# ---------- end ipy2_3 ----------
ipy2_4 = IronPython2Script(mesh=ipy2.column_mesh)  # -> out, my_mesh, my_mesh_rhino
# ---------- ipy2_4: IronPython ----------
import mola
from mola import module_rhino

#first step
new_mesh = mola.Mesh()
for i,f in enumerate(mesh.faces):
    if i <= 7:
        #bottom
        f.group = 1
        new_mesh.faces.append(f)
    elif i >= len(mesh.faces)-8:
        #top
        f.group = 2
        new_mesh.faces.append(f)
    else:
        f.group = 3
        new_faces = mola.subdivide_face_extrude_tapered(f, 2, 0.4)
        
        new_mesh.faces.extend(new_faces)

my_mesh = new_mesh
my_mesh.update_topology()

#display
my_mesh_rhino = module_rhino.display_mesh(my_mesh)
# ---------- end ipy2_4 ----------
ipy2_5 = IronPython2Script(mesh=ipy2_4.my_mesh)  # -> out, my_mesh, my_mesh_rhino
# ---------- ipy2_5: IronPython ----------
import mola
from mola import module_rhino

#second step
new_mesh = mola.Mesh()
for f in mesh.faces:
    if f.group == 1 or f.group == 2:
        new_mesh.faces.append(f)
    elif f.group == 3:
        new_faces = mola.subdivide_face_extrude_tapered(f, -2, 0.4)
        new_faces[-1].group = 4
        new_mesh.faces.extend(new_faces)
    


my_mesh = new_mesh
my_mesh.update_topology()

#display
my_mesh_rhino = module_rhino.display_mesh(my_mesh)
# ---------- end ipy2_5 ----------
ipy2_6 = IronPython2Script(mesh=ipy2_5.my_mesh)  # -> out, my_mesh, my_mesh_rhino
# ---------- ipy2_6: IronPython ----------
import mola
from mola import module_rhino

#third step
new_mesh = mola.Mesh()
for f in mesh.faces:
  if f.group == 4:
    new_faces = mola.subdivide_face_split_grid(f, 4, 1)
    new_faces[-1].group = 5
    new_faces[0].group = 6
    new_mesh.faces.append(new_faces[-1])
    new_mesh.faces.append(new_faces[0])
 
  else:
    new_mesh.faces.append(f)
my_mesh = new_mesh
my_mesh.update_topology()

#display
my_mesh_rhino = module_rhino.display_mesh(my_mesh)
# ---------- end ipy2_6 ----------
ipy2_7 = IronPython2Script(mesh=ipy2_6.my_mesh, iterations=Slider(2, range=0..10))  # -> out, my_mesh, my_mesh_rhino; inputs iterations: Int32
# ---------- ipy2_7: IronPython ----------
import mola
from mola import module_rhino

import mola
from mola import module_rhino

#fifth step
for i in range(iterations):
    new_mesh = mola.Mesh()
    for f in mesh.faces:
        if f.group == 3 or f.group == 6:
          new_faces = mola.subdivide_face_extrude_tapered(f, 1/(i+1.5), 0.4)
          new_mesh.faces.extend(new_faces)
        else:
          new_mesh.faces.append(f)
    mesh = new_mesh

my_mesh = mesh
#color faces by group
values = [f.group for f in my_mesh.faces]
cmap = mola.color_map(values)

my_mesh.update_topology()

#display
my_mesh_rhino = module_rhino.display_mesh(my_mesh)
# ---------- end ipy2_7 ----------
ipy2_8 = IronPython2Script(mesh=ipy2_7.my_mesh)  # -> out, my_mesh, my_mesh_rhino
# ---------- ipy2_8: IronPython ----------
import mola
from mola import module_rhino

#sixth step
mesh.update_topology()
my_mesh = mola.subdivide_mesh_catmull(mesh)
properties = my_mesh.face_properties(mola.face_curvature)
cmap = mola.color_map(properties)

#color faces by a color map
mola.color_faces_by_map(my_mesh.faces, cmap)


# seventh step
my_mesh.update_topology()
my_mesh = mola.subdivide_mesh_catmull(my_mesh, properties)

#display
my_mesh_rhino = module_rhino.display_mesh(my_mesh)
# ---------- end ipy2_8 ----------
geo_3 = Geometry(ipy2_8.my_mesh_rhino)
