# Grasshopper definition 203_column_generator_radii.ghx (Grasshopper 1.0.8)
# plug-ins: RhinoCodePluginGH, RADii

point = Point(Point(0, -1.005445762, 0))

# ----
# Starting mesh
crv = Curve(<curve referenced from the Rhino model>)
ipy2 = IronPython2Script(
    crv=crv,
    center_pt=point,
    sides_num=Slider(8, range=3..20),
    radius=Slider(1.5, range=0..100),
    total_h=Slider(10, range=0..1000),
    h_subdivisions=Slider(5, range=0..10))  # -> out, point_list, new_pts, column_mesh, column_mesh_rhino; inputs crv: Polyline, center_pt: Point3d, sides_num: Int32, radius: Double, total_h: Int32, h_subdivisions: Int32
# ---------- ipy2: IronPython ----------
import Rhino.Geometry as rg
from copy import deepcopy
import mola
import math
from mola import module_rhino
from ghpythonlib.treehelpers import list_to_tree, tree_to_list

z = 0

def points_from_polygon(sides_num, radius):
    point_list = []
    theta = 2*math.pi / sides_num
    for i in range(sides_num):
        angle = i * theta
        x = radius * math.cos(angle)
        y = radius * math.sin(angle)
        point_list.append([x, y, z])
    point_list.append(point_list[0])
    return point_list 

def points_from_curve(curve):
    point_list = []
    for c in curve:
        #print c
        pt = rg.Point3d(c)
        point_list.append(c)
    return point_list


if crv is not None:
    point_list = points_from_curve(crv)
else:
    point_list = points_from_polygon(sides_num, radius)


# Initialize the new_point_list and column_mesh
column_mesh = mola.Mesh()
new_pts = []

for layer_no in range(h_subdivisions + 1):
    z = total_h / h_subdivisions * layer_no
    for p in point_list:
        pt = deepcopy(p)
        pt[2] = z
        new_pts.append(pt)
        column_mesh.add_vertex(pt[0],pt[1],pt[2])

points_per_layer = len(point_list)

for layer_no in range(h_subdivisions):
    offset = layer_no * points_per_layer
    next_offset = (layer_no + 1) * points_per_layer

    for i in range(points_per_layer-1):
        # % to get index 0 in the last iteration or do the if condition like yesterday
        next_i = (i + 1) % points_per_layer

        # Get the vertex indices for the current quad face
        v0 = column_mesh.vertices[offset + i]
        v1 = column_mesh.vertices[offset + next_i]
        v2 = column_mesh.vertices[next_offset + next_i]
        v3 = column_mesh.vertices[next_offset + i]

        # Add the face to the mesh
        column_mesh.add_face([v0, v1, v2, v3])

column_mesh.update_topology()
column_mesh_rhino = module_rhino.display_mesh(column_mesh)
# ---------- end ipy2 ----------
geo = Geometry(ipy2.column_mesh_rhino)

path = FilePath("C:\\Users\\jfrancisco\\Downloads\\test_import.3dm")
_3dm = Import3DM(File=path, Layer="*", Name="*")
ipy2_2 = IronPython2Script(mola_path="C:\\Users\\jfrancisco\\Documents\\GitHub")  # -> out, a; inputs mola_path: String
# ---------- ipy2_2: IronPython ----------
import sys

if mola_path not in sys.path:
    sys.path.append(mola_path)

print(sys.path)

try:
    import mola
    from mola import module_rhino
except ImportError as e:
    print("Error importing mola: {e}")
# ---------- end ipy2_2 ----------
item = ListItem(List=_3dm, Index=0, Wrap=True)
toggle = BooleanToggle(False)
object = ModelObject()
file = ReadFile(PerLineParse=True)
import = ImportContent()  # -> ModelTransform, Objects, Layers, Linetypes, HatchPatterns, AnnotationStyles, Materials, BlockDefinitions
ipy2_3 = IronPython2Script(mesh=ipy2.column_mesh)  # -> out, my_mesh, my_mesh_rhino
# ---------- ipy2_3: IronPython ----------
import mola
from mola import module_rhino

new_mesh = mola.Mesh()

for i, f in enumerate(mesh.faces):
    if i <= 7:
        #bottom
        f.group = 1
        new_mesh.faces.append(f)
    elif i >= len(mesh.faces)-8:
        #top
        f.group = 2
        new_mesh.faces.append(f)
    else:
        f.group = 3
        new_faces = mola.subdivide_face_extrude_tapered(f, 2, 0.4)
        new_mesh.faces.extend(new_faces)

my_mesh = new_mesh
my_mesh.update_topology()
my_mesh_rhino = module_rhino.display_mesh(my_mesh)
# ---------- end ipy2_3 ----------
geo_2 = Geometry(ipy2_3.my_mesh_rhino)
ipy2_4 = IronPython2Script(mesh=ipy2_3.my_mesh)  # -> out, my_mesh, my_mesh_rhino
# ---------- ipy2_4: IronPython ----------
import mola
from mola import module_rhino

new_mesh = mola.Mesh()

for f in mesh.faces:
    if f.group == 1 or f.group == 2:
        resulting_faces = mola.subdivide_face_extrude_to_point_center(f, 2.0)
        new_mesh.faces.extend(resulting_faces)
    elif f.group == 3:
        new_faces = mola.subdivide_face_extrude_tapered(f, -1.5, 0.4)
        new_faces[-1].group = 4
        new_mesh.faces.extend(new_faces)

my_mesh = new_mesh
my_mesh.update_topology()
my_mesh_rhino = module_rhino.display_mesh(my_mesh)
# ---------- end ipy2_4 ----------

crv_2 = Curve(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)
cp = ControlPoints(Curve=crv_2)  # -> Points, Weights, Knots
pt = Point(<point referenced from the Rhino model>)
subtraction = Subtraction(A=pt, B=cp.Points)
pdecon = Deconstruct(Point=subtraction)  # -> XComponent, YComponent, ZComponent
vec = VectorXYZ(XComponent=pdecon.XComponent, YComponent=pdecon.YComponent, ZComponent=pdecon.ZComponent)  # -> Vector, Length
vec_2 = Vector(vec.Vector)
Z = UnitZ(Factor=1)

ipy2_5 = IronPython2Script(mesh=ipy2_4.my_mesh)  # -> out, my_mesh, my_mesh_rhino
# ---------- ipy2_5: IronPython ----------
import mola
from mola import module_rhino

new_mesh = mola.Mesh()

for f in mesh.faces:
    if f.group == 4:
        new_faces = mola.subdivide_face_split_grid(f,4,1)
        new_faces[-1].group = 5
        new_faces[0].group = 6
        new_mesh.faces.append(new_faces[-1])
        new_mesh.faces.append(new_faces[0])
    else:
        new_mesh.faces.append(f)


my_mesh = new_mesh
my_mesh.update_topology()
my_mesh_rhino = module_rhino.display_mesh(my_mesh)
# ---------- end ipy2_5 ----------
ipy2_6 = IronPython2Script(mesh=ipy2_5.my_mesh, iterations=Slider(3, range=0..10))  # -> out, my_mesh, my_mesh_rhino; inputs iterations: Int32
# ---------- ipy2_6: IronPython ----------
import mola
from mola import module_rhino

new_mesh = mola.Mesh()

for i in range(iterations):
    new_mesh = mola.Mesh()
    for f in mesh.faces:
        if f.group == 3 or f.group == 6:
            new_faces = mola.subdivide_face_extrude_tapered(f, 1/(i+1.5), 0.4)
            new_mesh.faces.extend(new_faces)
        else:
            new_mesh.faces.append(f)
    mesh = new_mesh

my_mesh = new_mesh
my_mesh.update_topology()
my_mesh = mola.subdivide_mesh_catmull(my_mesh)

#color faces by group
values = [f.group for f in my_mesh.faces]
properties = my_mesh.face_properties(mola.face_curvature)

colors = [(0,0,1), (0.5,0,0),(0.5,0.5,0.5)]
cmap = mola.color_map(properties, colors)
mola.color_faces_by_map(my_mesh.faces,cmap)


my_mesh.update_topology()
my_mesh_rhino = module_rhino.display_mesh(my_mesh)
# ---------- end ipy2_6 ----------
mesh = Mesh(item)
connect_global = ConnectGlobal(
    Connect=Toggle(True),
    PointTo=False,
    Follow=Toggle(False),
    DomainId=2,
    Password="masdfabJTO24",
    SubChannel="test",
    UserName="j1020")
rad = Radians(Degrees=Slider(90, range=0..100))
pl = ConstructPlane(Origin=cp.Points, XAxis=vec_2, YAxis=Z)
Z_2 = UnitZ(Factor=1)
mesh_2 = Mesh(_3dm)
publishgeometry = PublishGeometry(Connection=connect_global, Geometry=flatten(mesh))  # -> Log, Content
rotate = Rotate(Geometry=pl, Angle=rad, Plane=cp.Points)  # -> Geometry, Transform
pl_2 = ConstructPlane(Origin=Point(0, 0, 0), XAxis=Vector(1, 0, 0), YAxis=Z_2)
entwine = Entwine(Branch00=publishgeometry.Content, FlattenInputs=True)
publishmaterial = PublishMaterial(Connection=connect_global)  # -> Log, Save
publishview = PublishView(Connection=connect_global, CameraPlane=pl_2, LensLength=Slider(3, range=0..100))  # -> Log, Content
publishsection = PublishSection(Connection=connect_global, SectionPlane=pl_2)  # -> Log, Content
publish_animation = PublishAnimation(Connection=connect_global, AnimationPlanes=rotate.Geometry, LensLength=25, Content=entwine)  # -> Log, Content
content = Content([publishgeometry.Content, publishmaterial.Save, publishsection.Content, publishview.Content])
savecontent = SaveContent(Connection=connect_global, Content=content)
