# Grasshopper definition Boscoboinik_LLM_Image to Model.gh (Grasshopper 1.0.8)
# plug-ins: RhinoCodePluginGH

panel = Panel("Generate a simple python code using Rhino.geometries library for grasshopper. The output should be a")
panel_2 = Panel("Genereate a topographic mesh with variable input x and y parameters and analyse values in output b")
panel_3 = Panel("Generate a simple python code using Rhino.geometries library for grasshopper. The output should be a")
panel_4 = Panel("https://upload.wikimedia.org/wikipedia/en/3/3c/VillaSavoye.jpg")
bot = Python3Script(request=Toggle(True), content=panel, message=panel_2)  # -> out, a; inputs content: String, message: String
# ---------- bot: Python ----------
# venv: llm

import langchain
import re

from langchain_core.messages import HumanMessage, SystemMessage
from langchain_core.output_parsers import StrOutputParser
from langchain_openai import ChatOpenAI

MODEL = "gpt-4o-mini"
# openai model
model = ChatOpenAI(model=MODEL, temperature = 0.7)

# string output parser
parser = StrOutputParser()

# make a chain from the model and the parser
chain = model | parser


# Extract code part if present
def extract_code(text):
    """Extract code enclosed in triple backticks."""
    code_blocks = re.findall(r"```(?:python)?\n(.*?)```", text, re.DOTALL)
    return "\n".join(code_blocks) if code_blocks else text

if request:
    messages = [SystemMessage(
        content=content
    ),
        HumanMessage(content=message),
    ]
    result = chain.invoke(messages)

    print(result)

    a = extract_code(result)
# ---------- end bot ----------
py3 = Python3Script(request=Toggle(False), content=panel_3, message="Do a box")  # -> out, a; inputs content: String, message: String; same code as bot
bot_2 = Python3Script(request=Toggle(True), image=panel_4)  # -> out, a; inputs image: String
# ---------- bot_2: Python ----------
# venv: llm

import langchain
import re
import base64
import httpx

from langchain_core.messages import HumanMessage, SystemMessage
from langchain_core.output_parsers import StrOutputParser
from langchain_openai import ChatOpenAI

MODEL = "gpt-4o-mini"
# openai model
model = ChatOpenAI(model=MODEL, temperature = 0.7)

# string output parser
parser = StrOutputParser()

# make a chain from the model and the parser
chain = model | parser

if request:
    image_url = image
    image_data = base64.b64encode(httpx.get(image_url).content).decode("utf-8")

    message = HumanMessage(
    content=[
        {"type": "text", "text": "Please analyze the geometry of the building in the provided image and describe the key architectural elements (e.g., walls, floors, roof, windows, doors, and any other relevant features)."},
        {
            "type": "image_url",
            "image_url": {"url": f"data:image/jpeg;base64,{image_data}"},
            },
        ],
    )

    response = model.invoke([message])

    a = response.content
# ---------- end bot_2 ----------
viewport_display = ViewportDisplay(Visible=Toggle(False), Left=0, Top=0, Width=Slider(800, range=0..1000), Height=Slider(500, range=0..1000))
panel_5 = Panel(""""Please provide a Python script for Grasshopper that replicates the description of a building using only basic geometries such as boxes, spheres, and cylinders from the latest Rhino.Geometry library. The code should generate geometry corresponding to the described structure (e.g., walls, floors, roof, windows, doors, and additional features). Each output should be separated and clearly labeled into respective categories: walls, floors, roof, windows, doors, and additional features. The final outputs of the generated geometry should be stored in separate variables as follows:

a for walls,
b for floors,
c for the roof,
d for windows,
e for doors,
f for additional features (e.g., columns)DONT USE CYLINDER""")
panel_6 = Panel(bot.a)
panel_7 = Panel(py3.a)
py3_2 = Python3Script(script=py3.a)  # -> out, a; unedited script template
panel_8 = Panel(bot_2.a)
py3_3 = Python3Script(script=bot.a, x=Slider(100, range=0..100), y=Slider(100, range=0..100))  # -> out, a, b; inputs x: Int32, y: Int32; unedited script template
geo = Geometry(py3_2.a)
bot_3 = Python3Script(request=Toggle(True), content=panel_5, message=bot_2.a)  # -> out, a; inputs content: String, message: String; same code as bot
average_height = Panel(py3_3.b)
geo_2 = Geometry(py3_3.a)
panel_9 = Panel(bot_3.a)
py3_4 = Python3Script(script=bot_3.a)  # -> out, a, b, c, d, e, f; inputs x: Int32, y: Int32; unedited script template
geo_3 = Geometry(py3_4.a)
geo_4 = Geometry(py3_4.b)
geo_5 = Geometry(py3_4.c)
geo_6 = Geometry(py3_4.d)
geo_7 = Geometry(py3_4.e)
geo_8 = Geometry(py3_4.f)
preview = CustomPreview(Geometry=geo_3, Material=ColourSwatch(SwatchColor=RGBA(255, 128, 128, 150)))
preview_2 = CustomPreview(Geometry=geo_4, Material=ColourSwatch(SwatchColor=RGBA(233, 255, 122, 150)))
preview_3 = CustomPreview(Geometry=geo_5, Material=ColourSwatch(SwatchColor=RGB(122, 228, 255)))
preview_4 = CustomPreview(Geometry=geo_6, Material=ColourSwatch(SwatchColor=RGB(158, 122, 255)))
preview_5 = CustomPreview(Geometry=geo_7, Material=ColourSwatch(SwatchColor=RGB(255, 122, 215)))
preview_6 = CustomPreview(Geometry=geo_8, Material=ColourSwatch(SwatchColor=RGB(168, 81, 81)))
