# Grasshopper definition 20241122_Trial_01.gh (Grasshopper 1.0.8)
# plug-ins: RhinoCodePluginGH

# ----
# Normal columns
panel = Panel("make a series of boxes of length 240mm, width 125mm and height 50mm with ghpython with radii to emulate bricks, each 55mm apart in z axis.then copy them 10 times in the x direction (each copy separated the previous separation plus 240mm), and arrange them so they make a wall with sine function and 1000mm height. Output variable called a")
py3 = Python3Script(message=panel)  # -> out, a
# ---------- py3: Python ----------
# venv: llms

import langchain
import re

from langchain_core.messages import HumanMessage, SystemMessage
from langchain_core.output_parsers import StrOutputParser
from langchain_openai import ChatOpenAI

MODEL = "gpt-4o-mini"
# openai model
model = ChatOpenAI(model=MODEL, temperature = 0.7)

# string output parser
parser = StrOutputParser()

# make a chain from the model and the parser
chain = model | parser


# Extract code part if present___________________________________
def extract_code(text):
    """Extract code enclosed in triple backticks."""
    code_blocks = re.findall(r"```(?:python)?\n(.*?)```", text, re.DOTALL)
    return "\n".join(code_blocks) if code_blocks else text

# Messages________________________________________________________
messages = [SystemMessage(
    content="Keep it short and simple."
),
    HumanMessage(content=message),
]
result = chain.invoke(messages)

print(result)

a = extract_code(result)
# ---------- end py3 ----------
panel_2 = Panel(py3.a)
py3_2 = Python3Script(script=py3.a)  # -> out, a; unedited script template

# ----
# Topography_grass
panel_3 = Panel("Make a mesh in the xyz plane that emulates a topography, in ghpython. The dimentions are x=1000mm, y=1000mm, and the z varies depending on the point, up to a maximum height of 200mm. Everything has to be in the positive z axis. Output variable called a")
py3_3 = Python3Script(message=panel_3)  # -> out, a; same code as py3
panel_4 = Panel(py3_3.a)
py3_4 = Python3Script(script=py3_3.a)  # -> out, a; unedited script template

# ----
# Viewport in GH
number_slider = Slider(500, range=0..1000)
viewport_display = ViewportDisplay(Visible=Toggle(False), Left=0, Top=0, Width=Slider(500, range=0..1000), Height=number_slider)

# ----
# Topography_area
panel_5 = Panel("""Make a mesh in the xyz plane that emulates a topography, in ghpython. The dimentions are x=1000mm, y=1000mm, and the z varies depending on the point, up to a maximum height of max_height. Everything has to be over the xy plane, with no negative z values.
Input variable max_height is in mm, and caps is the number of points that should go up or down in the mesh. 
Output variable called a""")

# ----
# Example
py3_5 = Python3Script()  # -> out, a
# ---------- py3_5: Python ----------
#venv: llm

MODEL = "gpt-4o-mini"


from IPython.display import display_markdown
from langchain_core.messages import HumanMessage, SystemMessage
from langchain_core.output_parsers import StrOutputParser
from langchain_openai import ChatOpenAI

# openai model
model = ChatOpenAI(model=MODEL)

# string output parser
parser = StrOutputParser()

# make a chain from the model and the parser
chain = model | parser

# MESSAGES_____________________________________________________________

messages = [
    SystemMessage(content ="Answer precisely and to the point"),
    HumanMessage(content="What is architecture?"),
]
result = chain.invoke(messages)
# print(result)
display_markdown(result, raw=True)
# ---------- end py3_5 ----------

py3_6 = Python3Script(message=panel_5, max_height=Slider(200, range=1..500), caps=Slider(10, range=0..50))  # -> out, a; inputs max_height: Double, caps: Int32; same code as py3
panel_6 = Panel("""Generate a function to calculate the area of the input mesh. Output called a gives the function used,and output called result prints the actual area that comes from using the function with the input called mesh_1
Don't use the module numpy""")
panel_7 = Panel("""Generate a rendering image of the input_mesh given, similar to a van gogh painting, and at sunset. Show only the painting, not the measurements. Add one tower in this landscape.
Output variable called a""")
panel_8 = Panel(py3_6.a)
py3_7 = Python3Script(script=py3_6.a)  # -> out, a; unedited script template
py3_8 = Python3Script(mesh_1=py3_7.a, message=panel_6)  # -> out, a, b; inputs mesh_1: Mesh; same code as py3
py3_9 = Python3Script(my_mesh=py3_7.a, mesh_description=py3_6.a, message=panel_7)  # -> out, a; inputs my_mesh: Mesh
# ---------- py3_9: Python ----------
# venv: llms

import langchain
import re

from langchain_core.messages import HumanMessage, SystemMessage
from langchain_core.output_parsers import StrOutputParser
from langchain_openai import ChatOpenAI

MODEL = "gpt-4o-mini"
# openai model
model = ChatOpenAI(model=MODEL, temperature = 0.7)

# string output parser
parser = StrOutputParser()

# make a chain from the model and the parser
chain = model | parser

import rhinoscriptsyntax as rs
from openai import OpenAI

# Initialize OpenAI client
client = OpenAI()

# Function to generate an image based on a mesh and a custom prompt
def generate_image_from_mesh_and_prompt(mesh, custom_prompt, model="dall-e-3"):
    """
    Generates an image from a mesh and a custom prompt.
    
    mesh: The input mesh geometry.
    custom_prompt: The additional prompt to guide the image generation.
    """
    # Convert mesh to a descriptive prompt based on its geometry
    mesh_description = mesh_to_description(mesh)
    
    # Combine the mesh description with the custom prompt
    final_prompt = f"{custom_prompt}, featuring a {mesh_description}"
    
    # Generate the image using the combined prompt
    response = client.images.generate(
        model=model,
        prompt=final_prompt,
        size="1024x1024",
        quality="standard",
        n=1,
    )
    
    # Return the generated image URL
    return response.data[0].url


def mesh_to_description(mesh):
    """
    Describes the mesh in a high-level way based on its overall form or shape.
    """
    if rs.IsMesh(mesh):
        mesh_faces = rs.MeshFaces(mesh)
        num_faces = len(mesh_faces) if mesh_faces else 0
        
        if num_faces > 0:
            # High-level description 
            description = mesh_description
        else:
            description = "simple geometric shape"
    else:
        description = "non-mesh object"
    
    return description


input_mesh = my_mesh  # This should be your mesh object from Grasshopper
custom_prompt = message
if input_mesh:
    # Call the function to generate the image from both the mesh and the custom prompt
    a = generate_image_from_mesh_and_prompt(input_mesh, custom_prompt)
    
    print(a)
    # The image URL will be printed; you can use it in your workflow
# ---------- end py3_9 ----------
panel_9 = Panel(py3_9.a)
py3_10 = Python3Script(url=py3_9.a)  # -> out, img
# ---------- py3_10: Python ----------
import clr
import System.Drawing
from System.Net import WebClient
clr.AddReference("System.Drawing")

def download_image(url):
    """Downloads an image from the given URL."""
    try:
        client = WebClient()
        stream = client.OpenRead(url)
        img = System.Drawing.Image.FromStream(stream)
        stream.Close()
        return img
    except Exception as e:
        print(f"Error downloading image: {e}")
        return None

# Input URL (as a string)
img = download_image(url)

if img:
    # Output the downloaded image (returns System.Drawing.Image)
    output = img
else:
    output = None
# ---------- end py3_10 ----------
panel_10 = Panel(py3_8.a)
py3_11 = Python3Script(script=py3_8.a)  # -> out, a; unedited script template
panel_11 = Panel(py3_11.a)
