# Grasshopper definition 201_L-systems_solution.ghx (Grasshopper 1.0.8)

panel = Panel("Koch snowflake ")
ipy2 = IronPython2Script(
    num_sides=Slider(5, range=0..10),
    radius=Slider(5, range=0..10),
    iterations=Slider(3, range=0..10),
    angle=Slider(90, range=0..100))  # -> out, points, start_pts, koch_pts, koch_curve; inputs num_sides: Int32, radius: Int32, iterations: Int32, angle: Int32
# ---------- ipy2: IronPython ----------
import Rhino.Geometry as rg
import math

def subdivide_line(start, end):
    # Subdivide line into four segments, introducing a triangular bump
    direction = end - start
    length = direction.Length
    unit_direction = direction / length
    
    # Points for the Koch subdivision
    #point at 1/3 dist
    p1 = rg.Point3d(start + unit_direction * (length / 3))
    #point at 1/2 dist
    p2 = rg.Point3d(start + unit_direction * (length / 2))

    # Compute the point for the triangular bump (upwards)
    rotation = rg.Transform.Rotation(math.radians(angle), rg.Vector3d.ZAxis, p2)
    bump_direction = p2 + rg.Point3d(unit_direction * (-length / 6))
    bump_direction.Transform(rotation)
    #print(bump_direction)
    
    p3 = rg.Point3d(end - unit_direction * (length / 3))
    
    return [start, p1, bump_direction, p3, end]

def koch_snowflake(pts, iterations):
    for _ in range(iterations):
        new_pts = []
        for i in range(len(pts) - 1):
            segment_pts = subdivide_line(pts[i], pts[i + 1])
            if i > 0:
                new_pts.extend(segment_pts[1:])
            else:
                new_pts.extend(segment_pts)
        pts = new_pts
    return pts

#########################################################################
step_theta = (2*math.pi)/num_sides
step_theta = math.radians(360)/num_sides
z = 0

points = []

#print(math.degrees(step_theta))
for i in range(num_sides):
    theta = i* step_theta
    x = radius*math.cos(theta)
    y = radius*math.sin(theta)
    pt = rg.Point3d(x,y,z)
    points.append(pt)

#start_pts = [rg.Point3d(0, 0, 0), rg.Point3d(1, 0, 0), rg.Point3d(1, 1, 0), rg.Point3d(0, 1, 0),rg.Point3d(0, 0, 0)]

points.append(points[0])

# Generate Koch island points
koch_pts = koch_snowflake(points, iterations)
print len(koch_pts)

# Create a polyline from the generated points
koch_curve = rg.Polyline(koch_pts)
# ---------- end ipy2 ----------
geo = Geometry(ipy2.points)
geo_2 = Geometry(ipy2.start_pts)
geo_3 = Geometry(ipy2.koch_curve)
geo_4 = Geometry(ipy2.koch_pts)
panel_2 = Panel("Koch curve L-system")
ipy2_2 = IronPython2Script(iterations=Slider(2, range=0..10), step_size=Slider(3.41, range=0..10), angle=Slider(69, range=0..100))  # -> out, curve; inputs iterations: Int32, step_size: Double, angle: Int32
# ---------- ipy2_2: IronPython ----------
import Rhino.Geometry as rg
import math

# F means "draw forward" 
# + means "turn left 90°"
# and − means "turn right 90°"


# L-system parameters

axiom = "F"
rules = {"F": "F+F-F-F+F"}  # Rule for the Koch curve
iterations = iterations  # Number of L-system iterations
step_size = step_size  # Step size for drawing the curve
angle = angle  

# L-system generation function
def generate_lsystem(axiom, rules, iterations):
    lstring = axiom
    for _ in range(iterations):
        next_string = ""
        for char in lstring:
            next_string += rules.get(char, char)
        lstring = next_string
        #print lstring
    return lstring

# L-system interpretation function
def interpret_lsystem(lstring, step_size, angle):
    # Initial conditions
    current_pos = rg.Point3d(0, 0, 0)
    current_dir = rg.Vector3d(1, 0, 0)  # Initial direction is along the x-axis
    curve_lines = []
    
    for char in lstring:
        #print current_dir
        if char == "F":
            # Move forward and create a line segment
            new_pos = current_pos + (current_dir * step_size)
            curve_lines.append(rg.Line(current_pos, new_pos))
            current_pos = new_pos
        elif char == "+":
            # Turn left 90 degrees
            rotation = rg.Transform.Rotation(math.radians(angle), rg.Vector3d(0, 0, 1), current_pos)
            current_dir.Transform(rotation)
        elif char == "-":
            # Turn right 90 degrees
            rotation = rg.Transform.Rotation(math.radians(-angle), rg.Vector3d(0, 0, 1), current_pos)
            current_dir.Transform(rotation)
    
    return curve_lines

# Main function to create the Koch curve
def create_koch_curve():
    lstring = generate_lsystem(axiom, rules, iterations)
    lines = interpret_lsystem(lstring, step_size, angle)
    return lines


# Call the function to create and display the curve
curve = create_koch_curve()
# ---------- end ipy2_2 ----------
geo_5 = Geometry(ipy2_2.curve)
panel_3 = Panel(ipy2_2.curve)
panel_4 = Panel("dragon curve")
ipy2_3 = IronPython2Script(iterations=Slider(9, range=0..10), step_size=Slider(4.43, range=0..10), angle=Slider(90, range=0..100))  # -> out, curve; inputs iterations: Int32, step_size: Double, angle: Int32
# ---------- ipy2_3: IronPython ----------
import Rhino.Geometry as rg
import math

# F means "draw forward" 
# + means "turn left 90°"
# and − means "turn right 90°"


# L-system parameters

axiom = "F"
rules = {
    "F": "F+G",
    "G": "F-G"}  # Rule for dragon curve

iterations = iterations  # Number of L-system iterations
step_size = step_size  # Step size for drawing the curve
angle = angle  # Right angle for turns

# L-system generation function
def generate_lsystem(axiom, rules, iterations):
    lstring = axiom
    for _ in range(iterations):
        next_string = ""
        for char in lstring:
            next_string += rules.get(char, char)
        lstring = next_string
        #print lstring
    return lstring

# L-system interpretation function
def interpret_lsystem(lstring, step_size, angle):
    # Initial conditions
    current_pos = rg.Point3d(0, 0, 0)
    current_dir = rg.Vector3d(1, 0, 0)  # Initial direction is along the x-axis
    curve_lines = []
    
    for char in lstring:
        #print current_dir
        if char == "F" or char == "G":
            # Move forward and create a line segment
            new_pos = current_pos + (current_dir * step_size)
            curve_lines.append(rg.Line(current_pos, new_pos))
            current_pos = new_pos
        elif char == "+":
            # Turn left 90 degrees
            rotation = rg.Transform.Rotation(math.radians(angle), rg.Vector3d(0, 0, 1), current_pos)
            current_dir.Transform(rotation)
        elif char == "-":
            # Turn right 90 degrees
            rotation = rg.Transform.Rotation(math.radians(-angle), rg.Vector3d(0, 0, 1), current_pos)
            current_dir.Transform(rotation)
    
    return curve_lines

# Main function to create the Koch curve
def create_koch_curve():
    lstring = generate_lsystem(axiom, rules, iterations)
    lines = interpret_lsystem(lstring, step_size, angle)
    return lines


# Call the function to create and display the curve
curve = create_koch_curve()
# ---------- end ipy2_3 ----------
geo_6 = Geometry(ipy2_3.curve)
panel_5 = Panel(ipy2_3.curve)
panel_6 = Panel("fractal plant")
ipy2_4 = IronPython2Script(iterations=Slider(5, range=0..10), angle=Slider(22.5, range=0..100))  # -> out, a; inputs iterations: Int32, angle: Double
# ---------- ipy2_4: IronPython ----------
import Rhino.Geometry as rg
import math

# L-system parameters
axiom = "X"
rules = {
    "X": "F+[[X]-X]-F[-FX]+X",
    "F": "FF"
}
angle = angle
iterations = 5
step_size = 1.0  # step size for drawing the tree

# L-system generation function
def generate_lsystem(axiom, rules, iterations):
    lstring = axiom
    for i in range(iterations):
        next_string = ""
        for char in lstring:
            next_string += rules.get(char, char)
        lstring = next_string
    return lstring

# L-system interpretation function
def interpret_lsystem(lstring, step_size, angle):
    stack = []
    current_pos = rg.Point3d(0, 0, 0)
    current_dir = rg.Vector3d(0, 0, 1)  # Initial direction (upward)
    tree_branches = []

    for char in lstring:
        if char == "F":
            # Move forward in the current direction
            new_pos = current_pos + (current_dir * step_size)
            tree_branches.append(rg.Line(current_pos, new_pos))
            current_pos = new_pos
        elif char == "-":
            # Turn right (rotate by positive angle)
            rotation = rg.Transform.Rotation(math.radians(angle), rg.Vector3d(0, 1, 0), current_pos)
            current_dir.Transform(rotation)
        elif char == "+":
            # Turn left (rotate by negative angle)
            rotation = rg.Transform.Rotation(math.radians(-angle), rg.Vector3d(0, 1, 0), current_pos)
            current_dir.Transform(rotation)
        elif char == "[":
            # Save the current state (position and direction)
            stack.append((current_pos, rg.Vector3d(current_dir)))  # Save position and direction
        elif char == "]":
            # Restore the last state (position and direction)
            current_pos, current_dir = stack.pop()  # Restore position and direction
    return tree_branches

# Main function to generate the tree in Rhino
def create_tree():
    lstring = generate_lsystem(axiom, rules, iterations)
    branches = interpret_lsystem(lstring, step_size, angle)
    return branches

a = create_tree()
# ---------- end ipy2_4 ----------
geo_7 = Geometry(ipy2_4.a)
