# Grasshopper definition 102_stick_two_sticks.ghx (Grasshopper 1.0.8)

line_0 = Curve(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)
line_1 = Curve(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)
py3 = Python3Script(line_0=line_0, line_1=line_1)  # -> out, sticks; inputs line_0: Line, line_1: Line
# ---------- py3: Python ----------
#locate stick class file in the same folder
from compas_rhino import unload_modules
import sys
import os

#get current file path
path = ghenv.Component.OnPingDocument().FilePath
#get parent directory of the parent directory
parentdir = os.path.dirname(path)
#get src folder which contains classes
dire = os.path.join(parentdir,'scripts')

sys.path.append(dire)


unload_modules('stick')

import stick
from stick import Stick
from stickmodules import OStickModule
from compas.geometry import Line, Point, Vector
from compas_rhino.conversions import line_to_compas

Stick.RADIUS = 2

stick_assembly = []

line0 = line_to_compas(line_0)
stick0 = Stick(line0)
print (stick0.axis)
stick_assembly.append(stick0)

line1 = line_to_compas(line_1)
stick1 = Stick(line1)
stick_assembly.append(stick1)

stick_between = Stick.from_two_sticks(stick0, stick1, 0.1, 0.1, max_iterations = 50)
stick_assembly.append(stick_between)

sticks = [s.geometry for s in stick_assembly]


print("hello %2d worlkd" %(1.860986))
# ---------- end py3 ----------
py3_2 = Python3Script(cg=py3.sticks)  # -> rg
# ---------- py3_2: Python ----------
"""
Draws COMPAS geometry in Grasshopper.
"""

from ghpythonlib.componentbase import executingcomponent as component

from compas.scene import SceneObject


class CompasToRhinoGeometry(component):
    def RunScript(self, cg):
        if not cg:
            return None

        return SceneObject(item=cg).draw()
# ---------- end py3_2 ----------
