# Grasshopper definition 103_reciprocal_node_tutorial.ghx (Grasshopper 1.0.8)

number_slider = Slider(49.6, range=0..100)
py3 = Python3Script(
    num_sticks=Slider(3, range=3..10),
    length_stick=Slider(119.7, range=0..200),
    engagement_length=number_slider,
    shift_length=Slider(44, range=0..100))  # -> out, stick_assembly, geometry, e_lines, stick_axes, e_dist; inputs num_sticks: Int32, length_stick: Double, engagement_length: Double, shift_length: Double
# ---------- py3: Python ----------
from compas.geometry import Polygon, Frame, Vector, Scale
import math
import sys
import os

#get current file path
path = ghenv.Component.OnPingDocument().FilePath
#get parent directory of the parent directory
parentdir = os.path.dirname(path)
#get src folder which contains classes
dire = os.path.join(parentdir,'scripts')

sys.path.append(dire)


from stick import Stick

def create_polygon(sides, side_length):
    pass
    # create polygon
    
    # scale polygon
    
    # return lines

    
def get_eccentricities(sticks):
    pass
    # get eccentricity lines between stick and next stick
    
    # return e_lines and e_dist

# create engagement polygon

# create stick_assembly as empty list

# iterate over polygon lines

    # initiate Stick

    # adjust stick to reciprocal rotation

    # change stick parameters (length and shift)


    # addo to assembly


# get eccentricity line and eccentricity distance
# eccentricity distance should be 4.0 for a stick radius of 2.0


# return geometry

# return stick axes
# ---------- end py3 ----------
py3_2 = Python3Script(cg=py3.geometry)  # -> rg
# ---------- py3_2: Python ----------
"""
Draws COMPAS geometry in Grasshopper.
"""

from ghpythonlib.componentbase import executingcomponent as component

from compas.scene import SceneObject


class CompasToRhinoGeometry(component):
    def RunScript(self, cg):
        if not cg:
            return None

        return SceneObject(item=cg).draw()
# ---------- end py3_2 ----------
py3_3 = Python3Script(cg=py3.e_lines)  # -> rg; same code as py3_2
py3_4 = Python3Script(cg=py3.stick_axes)  # -> rg; same code as py3_2
panel = Panel(py3.e_dist)
py3_5 = Python3Script(module=py3.stick_assembly, engagement_length=number_slider)  # -> out, stick_assembly; inputs module: list, engagement_length: Double
# ---------- py3_5: Python ----------
from compas.geometry import Polygon, Frame, Vector, Scale, Translation, Point
import math

import sys
import os

#get current file path
path = ghenv.Component.OnPingDocument().FilePath
#get parent directory of the parent directory
parentdir = os.path.dirname(path)
#get src folder which contains classes
dire = os.path.join(parentdir,'scripts')

sys.path.append(dire)

from stick import Stick
from stickmodules import RStickModule

# create current module copy

# initiate stick assembly

# iterate over sticks in current module

# find new module center

# create new module

# flip stick angle direction

# move new module to new center

# rotate new module

# add new module to stick assembly
# ---------- end py3_5 ----------
py3_6 = Python3Script(cg=py3_5.stick_assembly)  # -> rg; same code as py3_2
