# Grasshopper definition 104_reciprocal_node.ghx (Grasshopper 1.0.8)

number_slider = Slider(49.6, range=0..100)
py3 = Python3Script(
    num_sticks=Slider(3, range=3..10),
    length_stick=Slider(119.7, range=0..200),
    engagement_length=number_slider,
    shift_length=Slider(44, range=0..100))  # -> out, stick_assembly, geometry, e_lines, stick_axes, e_dist; inputs num_sticks: Int32, length_stick: Double, engagement_length: Double, shift_length: Double
# ---------- py3: Python ----------
from compas.geometry import Polygon, Frame, Vector, Scale
import math
import sys
import os

#get current file path
path = ghenv.Component.OnPingDocument().FilePath
#get parent directory of the parent directory
parentdir = os.path.dirname(path)
#get src folder which contains classes
dire = os.path.join(parentdir,'scripts')

sys.path.append(dire)


from stick import Stick

def create_polygon(sides, side_length):
    polygon = Polygon.from_sides_and_radius_xy(sides, 1)
    T = Scale.from_factors([side_length/(polygon.length/sides)]*3)
    p = polygon.transformed(T)
    return p.lines
    
def get_eccentricities(sticks):
    e_lines = []
    for i in range(len(sticks)):
        stick1 = sticks[i]
        stick2 = sticks[(i+1) % len(sticks)]
        e_line = stick1.eccentricity(stick2)
        e_lines.append(e_line)
    return e_lines, e_line.length


engagement_polygon = create_polygon(num_sticks, engagement_length)

stick_assembly = []
for line in engagement_polygon:
    # initiate Stick
    stick = Stick(line)
    # adjust stick to reciprocal rotation
    stick.rotate_stick(stick.eccentricity_rotation_angle(alpha=((num_sticks-2)*math.pi)/(2*num_sticks)))
    # change stick parameters (length and shift)
    stick.set_length(length_stick)
    stick.shift(shift_length)
    # addo to assembly
    stick_assembly.append(stick)

# get eccentricity line and eccentricity distance
# eccentricity distance should be 4.0 for a stick radius of 2.0
e_lines, e_dist = get_eccentricities(stick_assembly)

geometry = [stick.geometry for stick in stick_assembly]
stick_axes = [stick.axis for stick in stick_assembly]
# ---------- end py3 ----------
py3_2 = Python3Script(cg=py3.geometry)  # -> rg
# ---------- py3_2: Python ----------
"""
Draws COMPAS geometry in Grasshopper.
"""

from ghpythonlib.componentbase import executingcomponent as component

from compas.scene import SceneObject


class CompasToRhinoGeometry(component):
    def RunScript(self, cg):
        if not cg:
            return None

        return SceneObject(item=cg).draw()
# ---------- end py3_2 ----------
py3_3 = Python3Script(cg=py3.e_lines)  # -> rg; same code as py3_2
py3_4 = Python3Script(cg=py3.stick_axes)  # -> rg; same code as py3_2
panel = Panel(py3.e_dist)
py3_5 = Python3Script(module=py3.stick_assembly, engagement_length=number_slider)  # -> out, stick_assembly; inputs module: list, engagement_length: Double
# ---------- py3_5: Python ----------
from compas.geometry import Polygon, Frame, Vector, Scale, Translation, Point
import math

import sys
import os

#get current file path
path = ghenv.Component.OnPingDocument().FilePath
#get parent directory of the parent directory
parentdir = os.path.dirname(path)
#get src folder which contains classes
dire = os.path.join(parentdir,'scripts')

sys.path.append(dire)

from stick import Stick
from stickmodules import RStickModule

new_module = module
current_module = RStickModule.from_stick_module(new_module)
stick_assembly = []
for stick in current_module.sticks:
    v1 = Point(stick.axis.start.x, stick.axis.start.y, 0) - Point(stick.axis.end.x, stick.axis.end.y, 0)
    v2 = v1.unitized() * (v1.length - engagement_length)
    v3 = current_module.mirror_center_along_stick(stick) - current_module.center
    v_move = v3 + v2
    next_module = current_module.copy()
    next_module.flip()
    next_module.move(v_move)
    next_module.rotate(math.radians(180))
    stick_assembly.extend(next_module.geometry)
# ---------- end py3_5 ----------
py3_6 = Python3Script(cg=py3_5.stick_assembly)  # -> rg; same code as py3_2
