# Grasshopper definition 201_stick_assembly.ghx (Grasshopper 1.0.8)

python = GhPythonScript(
    num_sticks=Slider(4, range=3..10),
    length_stick=Slider(98.5, range=0..200),
    engagement_length=Slider(65.9, range=0..250),
    shift_length=Slider(16, range=0..100))  # -> out, module, geometry, stick_axes; inputs num_sticks: Int32
# ---------- python: Python ----------
from compas.geometry import Polygon, Frame, Vector, Scale
import math
from compas_ghpython.utilities import unload_modules
import sys
import os

#get current file path
path = ghenv.Component.OnPingDocument().FilePath
#get parent directory of the parent directory
parentdir = os.path.dirname(path)
#get src folder which contains classes
dire = os.path.join(parentdir,'scripts')

sys.path.append(dire)

unload_modules('stick')
from stick import Stick

def create_polygon(sides, side_length):
    polygon = Polygon.from_sides_and_radius_xy(sides, 1)
    T = Scale.from_factors([side_length/(polygon.length/sides)]*3)
    p = polygon.transformed(T)
    return p.lines
    
def get_eccentricities(sticks):
    e_lines = []
    for i in range(len(sticks)):
        stick1 = sticks[i]
        stick2 = sticks[(i+1) % len(sticks)]
        e_line = stick1.eccentricity(stick2)
        e_lines.append(e_line)
    return e_lines, e_line.length


engagement_polygon = create_polygon(num_sticks, engagement_length)

module = []
for line in engagement_polygon:
    # initiate Stick
    stick = Stick(line)
    # adjust stick to reciprocal rotation
    stick.rotate_stick(stick.eccentricity_rotation_angle(alpha=((num_sticks-2)*math.pi)/(2*num_sticks)))
    # change stick parameters (length and shift)
    stick.set_length(length_stick)
    stick.shift(shift_length)
    # addo to assembly
    module.append(stick)

# get eccentricity line and eccentricity distance
# eccentricity distance should be 4.0 for a stick radius of 2.0
e_lines, e_dist = get_eccentricities(module)

geometry = [stick.geometry for stick in module]
stick_axes = [stick.axis for stick in module]
# ---------- end python ----------
py3 = Python3Script(
    num_sticks=Slider(4, range=3..10),
    length_stick=Slider(119.7, range=0..200),
    engagement_length=Slider(54.1, range=0..100),
    shift_length=Slider(44, range=0..100))  # -> out, stick_assembly, geometry, e_lines, stick_axes, e_dist; inputs num_sticks: Int32, length_stick: Double, engagement_length: Double, shift_length: Double
# ---------- py3: Python ----------
from compas.geometry import Polygon, Frame, Vector, Scale
import math
import sys
import os

#get current file path
path = ghenv.Component.OnPingDocument().FilePath
#get parent directory of the parent directory
parentdir = os.path.dirname(path)
#get src folder which contains classes
dire = os.path.join(parentdir,'scripts')

sys.path.append(dire)


from stick import Stick

def create_polygon(sides, side_length):
    polygon = Polygon.from_sides_and_radius_xy(sides, 1)
    T = Scale.from_factors([side_length/(polygon.length/sides)]*3)
    p = polygon.transformed(T)
    return p.lines
    
def get_eccentricities(sticks):
    e_lines = []
    for i in range(len(sticks)):
        stick1 = sticks[i]
        stick2 = sticks[(i+1) % len(sticks)]
        e_line = stick1.eccentricity(stick2)
        e_lines.append(e_line)
    return e_lines, e_line.length


engagement_polygon = create_polygon(num_sticks, engagement_length)

stick_assembly = []
for line in engagement_polygon:
    # initiate Stick
    stick = Stick(line)
    # adjust stick to reciprocal rotation
    stick.rotate_stick(stick.eccentricity_rotation_angle(alpha=((num_sticks-2)*math.pi)/(2*num_sticks)))
    # change stick parameters (length and shift)
    stick.set_length(length_stick)
    stick.shift(shift_length)
    # addo to assembly
    stick_assembly.append(stick)

# get eccentricity line and eccentricity distance
# eccentricity distance should be 4.0 for a stick radius of 2.0
e_lines, e_dist = get_eccentricities(stick_assembly)

geometry = [stick.geometry for stick in stick_assembly]
stick_axes = [stick.axis for stick in stick_assembly]
# ---------- end py3 ----------
draw = Draw(cg=python.stick_axes)  # -> rg
#   port cg: The COMPAS geometry or datastructure to be drawn.
#   port rg: The Rhino geometry object.
# ---------- draw: Python ----------
"""
Draws COMPAS geometry in Grasshopper.
"""
from ghpythonlib.componentbase import executingcomponent as component

from compas.artists import Artist


class CompasToRhinoGeometry(component):
    def RunScript(self, cg):
        if not cg:
            return None

        return Artist(cg).draw()
# ---------- end draw ----------
py3_2 = Python3Script(cg=py3.e_lines)  # -> rg
# ---------- py3_2: Python ----------
"""
Draws COMPAS geometry in Grasshopper.
"""

from ghpythonlib.componentbase import executingcomponent as component

from compas.scene import SceneObject


class CompasToRhinoGeometry(component):
    def RunScript(self, cg):
        if not cg:
            return None

        return SceneObject(item=cg).draw()
# ---------- end py3_2 ----------
py3_3 = Python3Script(cg=py3.stick_axes)  # -> rg; same code as py3_2
panel = Panel(py3.e_dist)
py3_4 = Python3Script(cg=py3.geometry)  # -> rg; same code as py3_2
length = Slider(601, range=0..1000)
py3_5 = Python3Script(module=py3.stick_assembly, height=Slider(244, range=0..1000), length=length)  # -> out, assembly, geometry, frames; inputs module: list, height: Int32, length: Int32
# ---------- py3_5: Python ----------
from compas.geometry import Polygon, Frame, Vector, Scale, Translation, Point, Polyhedron
import math

from compas.datastructures import Assembly
from compas.datastructures import Part
from compas import json_dump

import sys
import os

#get current file path
path = ghenv.Component.OnPingDocument().FilePath
#get parent directory of the parent directory
parentdir = os.path.dirname(path)
#get src folder which contains classes
dire = os.path.join(parentdir,'scripts')

sys.path.append(dire)

from stick import Stick
from stickmodules import RStickModule
from helpers import sort_sticks_by_z


stick_assembly = []

#create a rotated module on top of the first one
module0 = RStickModule.from_stick_module(module)
module0.generate_stick_frames()
module1 = module0.copy()
module1.move(Vector(0,0,height))
module1.rotate(math.pi/12)
module1.generate_stick_frames()

#add sticks to list
stick_assembly.extend(module0.sticks)
stick_assembly.extend(module1.sticks)

#create sticks between layers
#for i,(a,b) in enumerate(zip(module0.sticks, module1.sticks)):
#    print i
#    c0s0 = a
#    c0s1 = module0.sticks[(i+1)%len(module0.sticks)]
#    c1s0 = b
#    c1s1 = module1.sticks[(i+1)%len(module0.sticks)]
##    stick = Stick.from_two_corners(c0s0,c0s1,c1s0,c1s1, length = 150)
##    stick_assembly.append(stick)

for i in range(len(module0.sticks)):
    c0s0 = module0.sticks[i-1]
    c0s1 = module0.sticks[i]
    c1s0 = module1.sticks[i-1]
    c1s1 = module1.sticks[i]
    stick = Stick.from_two_corners(c0s0,c0s1,c1s0,c1s1, length = 150)
    stick.set_length(250)
    stick_assembly.append(stick)
    

#sort_sticks_by_z
stick_assembly = sort_sticks_by_z(stick_assembly)


assembly = Assembly()

#generate data for assembly
for stick in stick_assembly:
    stick_frame = stick.frame #generate a frame for stick
    stick_geo = Polyhedron(*stick.geometry.to_vertices_and_faces(triangulated=True))
    part = Part(frame=stick_frame, shape=stick_geo, line=stick.axis, midpoint=stick.axis.midpoint)
    assembly.add_part(part)

assembly.attributes["num_parts"] = len(stick_assembly)
print(assembly.parts())

# read from attributes instead of .shape
geometry = [p.attributes["shape"] for p in assembly.parts()]

frames = [part.frame for part in assembly.parts()]
# ---------- end py3_5 ----------
py3_6 = Python3Script(cg=py3_5.geometry)  # -> rg; same code as py3_2
button = Button()
py3_7 = Python3Script(assembly=py3_5.assembly, save=button)  # -> out, a; inputs save: Boolean
# ---------- py3_7: Python ----------
from compas import json_dump
import os, sys
from itertools import combinations
from compas_rhino import unload_modules
from compas.geometry import Line

#get current file path
path = ghenv.Component.OnPingDocument().FilePath
#get parent directory of the parent directory
parentdir = os.path.dirname(path)
#get src folder which contains classes
dire = os.path.join(parentdir,'scripts')

sys.path.append(dire)

unload_modules('helpers')
from helpers import shortest_distance

json_path = os.path.join(parentdir, 'data', 'stick_assembly.json')

tolerance = 4.2
connections = []

#generate connections between parts(optional)
for a,b in combinations(assembly.parts(), 2):
    linea = a.attributes["line"]
    lineb = b.attributes["line"]
    if shortest_distance(linea, lineb) < tolerance:
        assembly.add_connection(a,b)
        mid_a = a.attributes["midpoint"]
        mid_b = b.attributes["midpoint"]
        connections.append(Line(mid_a, mid_b))



if save:
    json_dump({'assembly': assembly}, fp = json_path, pretty = True)
# ---------- end py3_7 ----------
python_2 = GhPythonScript(save=button)  # -> connections, a; same code as py3_7
draw_2 = Draw(cg=python_2.connections)  # -> rg; same code as draw
