# Grasshopper definition WIP_Bezier_path_01.ghx (Grasshopper 1.0.7)

number_slider = Slider(27.7, range=0..100)

# ---- group: grid_parameters
number_slider_2 = Slider(3, range=0..10)
number_slider_3 = Slider(3, range=0..10)
number_slider_4 = Slider(3, range=0..10)
number_slider_5 = Slider(10, range=0..10)

# ----
crv = Curve(<curve referenced from the Rhino model>)
crv_2 = Curve([<curve referenced from the Rhino model> x4])
python = GhPythonScript(
    num_sticks=Slider(4, range=3..10),
    length_stick=Slider(69.2, range=0..200),
    engagement_length=number_slider,
    shift_length=Slider(-4.6, range=-100..101))  # -> out, stick_assembly, geometry, e_lines, stick_axes, e_dist; inputs num_sticks: Int32
# ---------- python: Python ----------
from compas.geometry import Polygon, Frame, Vector, Scale
import math
from compas_ghpython.utilities import unload_modules
import sys
import os

#get current file path
path = ghenv.Component.OnPingDocument().FilePath
#get parent directory of the parent directory
parentdir = os.path.dirname(path)
#get src folder which contains classes
dire = os.path.join(parentdir,'scripts')

sys.path.append(dire)

unload_modules('stick')
from stick import Stick

def create_polygon(sides, side_length):
    polygon = Polygon.from_sides_and_radius_xy(sides, 1)
    T = Scale.from_factors([side_length/(polygon.length/sides)]*3)
    p = polygon.transformed(T)
    return p.lines
    
def get_eccentricities(sticks):
    e_lines = []
    for i in range(len(sticks)):
        stick1 = sticks[i]
        stick2 = sticks[(i+1) % len(sticks)]
        e_line = stick1.eccentricity(stick2)
        e_lines.append(e_line)
    return e_lines, e_line.length


engagement_polygon = create_polygon(num_sticks, engagement_length)

stick_assembly = []
for line in engagement_polygon:
    # initiate Stick
    stick = Stick(line)
    # adjust stick to reciprocal rotation
    stick.rotate_stick(stick.eccentricity_rotation_angle(alpha=((num_sticks-2)*math.pi)/(2*num_sticks)))
    # change stick parameters (length and shift)
    stick.set_length(length_stick)
    stick.shift(shift_length)
    # addo to assembly
    stick_assembly.append(stick)

# get eccentricity line and eccentricity distance
# eccentricity distance should be 4.0 for a stick radius of 2.0
e_lines, e_dist = get_eccentricities(stick_assembly)

geometry = [stick.geometry for stick in stick_assembly]
stick_axes = [stick.axis for stick in stick_assembly]
# ---------- end python ----------
stick2stick = GhPythonScript(crv=crv)  # -> out, sticks, sticks_2, points, lines, connection_lines; inputs line_0: Line, line_1: Line, crv: Curve
# ---------- stick2stick: Python ----------
#locate stick class file in the same folder
from compas_rhino import unload_modules
import sys
import os

#get current file path
path = ghenv.Component.OnPingDocument().FilePath
#get parent directory of the parent directory
parentdir = os.path.dirname(path)
#get src folder which contains classes
dire = os.path.join(parentdir,'scripts')

sys.path.append(dire)


unload_modules('stick')

import stick
from stick import Stick
from compas.geometry import Line, Point, Vector, Curve
from compas_rhino.conversions import line_to_compas
from compas_rhino.conversions import curve
import Rhino.Geometry as rg
import compas.geometry as cg

line_length = 40.0
params = rg.Curve.DivideByLength(crv, line_length, True)

points = []



for param in params:
    
    pt = rg.Curve.PointAt(crv, param)
    points.append(pt)
    


lines = []
for i, pt in enumerate(points):
    if i%2 ==0:
        line = rg.Line(pt,points[i+1])
        crv_1 = rg.Line.ToNurbsCurve(line)
        normal = rg.Curve.TangentAt(crv,params[i])
        pln = rg.Plane(pt, normal)
#        print normal, pln

        translation_vector = rg.Vector3d(pln.ZAxis) * -line_length / 2
        pt2 = pt + translation_vector
        # Create a new line starting from the moved point
        scaled_line = rg.Line(pt2, pln.ZAxis, line_length * 2.5)
#        print scaled_crv_1
        lines.append(scaled_line)



Stick.RADIUS = 2.0

stick_assembly = []
stick_assembly_2 = []



for i, ln in enumerate(lines[:-1]):  # Use [:-1] to avoid index out of range error

    line0 = line_to_compas(ln)
    stick0 = Stick(line0)
    stick_assembly.append(stick0)
    
    line1 = line_to_compas(lines[i+1])
    stick1 = Stick(line1)
    stick_assembly.append(stick1)

    stick_between = Stick.from_two_sticks(stick0, stick1, 0.9, 0.9, max_iterations=50)
    stick_between_2 = Stick.from_two_sticks(stick0, stick1, 0.1, 0.1, max_iterations=50)
    stick_assembly.append(stick_between)
    stick_assembly_2.append(stick_between_2)


sticks = [s.geometry for s in stick_assembly]
sticks_2 = [s.geometry for s in stick_assembly_2]
# ---------- end stick2stick ----------
stick2stick_2 = GhPythonScript(crvs=crv_2)  # -> out, sticks, sticks_2, points, lines, connection_lines; inputs line_0: Line, line_1: Line, crvs: list of Curve
# ---------- stick2stick_2: Python ----------
#locate stick class file in the same folder
from compas_rhino import unload_modules
import sys
import os
from ghpythonlib import treehelpers as th


#get current file path
path = ghenv.Component.OnPingDocument().FilePath
#get parent directory of the parent directory
parentdir = os.path.dirname(path)
#get src folder which contains classes
dire = os.path.join(parentdir,'scripts')


sys.path.append(dire)


unload_modules('stick')

import stick
from stick import Stick
from compas.geometry import Line, Point, Vector, Curve
from compas_rhino.conversions import line_to_compas
from compas_rhino.conversions import curve
import Rhino.Geometry as rg
import compas.geometry as cg

line_length = 40.0


full_points_list =[]
for crv in crvs:
    params = rg.Curve.DivideByLength(crv, line_length, True)
    points = []
    for param in params:
        
        pt = rg.Curve.PointAt(crv, param)
        points.append(pt)
    full_points_list.append(points)


all_lines =[]
for points in full_points_list:
    lines = []
    for i, pt in enumerate(points):
        if i%2 ==0:
            line = rg.Line(pt,points[i+1])
            crv_1 = rg.Line.ToNurbsCurve(line)
            normal = rg.Curve.TangentAt(crv,params[i])
            pln = rg.Plane(pt, normal)
    #        print normal, pln
    
            translation_vector = rg.Vector3d(pln.ZAxis) * -line_length / 2
            pt2 = pt + translation_vector
            # Create a new line starting from the moved point
            scaled_line = rg.Line(pt2, pln.ZAxis, line_length * 2.5)
    #        print scaled_crv_1
            lines.append(scaled_line)
    all_lines.append(lines)



Stick.RADIUS = 2.0

all_stick_assembly =[]
for lines in all_lines:
    
    stick_assembly = []
    connection_lines =[]
    for i, ln in enumerate(lines[:-1]):  # Use [:-1] to avoid index out of range error
    
        line0 = line_to_compas(ln)
        stick0 = Stick(line0)
        stick_assembly.append(stick0)
        
        line1 = line_to_compas(lines[i+1])
        stick1 = Stick(line1)
        stick_assembly.append(stick1)
    
        stick_between = Stick.from_two_sticks(stick0, stick1, 0.9, 0.9, max_iterations=50)
        stick_assembly.append(stick_between)
    all_stick_assembly.append(stick_assembly)


sticks =[]
for stick_assembly in all_stick_assembly:
    sticks.extend(stick_assembly)
#    stickss =[]
#    for s in stick_assembly:
#        sticks.append(s)
        
sticks = [s.geometry for s in sticks]
#    sticks.append(all_stick_assembly)


#sticks = th.list_to_tree(sticks)
# ---------- end stick2stick_2 ----------
grid_sticks = GhPythonScript(x_range=number_slider_2, y_range=number_slider_3, z_range=number_slider_4, offset=number_slider_5)  # -> out, points, sticks; inputs x_range: Int32, y_range: Int32, z_range: Int32
# ---------- grid_sticks: Python ----------
#locate stick class file in the same folder
from compas_rhino import unload_modules
import sys
import os

#get current file path
path = ghenv.Component.OnPingDocument().FilePath
#get parent directory of the parent directory
parentdir = os.path.dirname(path)
#get src folder which contains classes
dire = os.path.join(parentdir,'scripts')



sys.path.append(dire)

unload_modules('stick')
unload_modules('stickmodules')




import stick, stickmodules


from stick import Stick
from compas.geometry import Line, Point, Vector
from stickmodules import OStickModule



stick_radius = 2
stick_length = 100

stick_assembly = []
points = []

for x in range(x_range):
    for y in range(y_range):
        for z in range(z_range):
            grid_size = stick_length -(2*offset)
            pt = Point(x*grid_size, y*grid_size, z*grid_size)
            points.append(pt)
            #type = 0 or 1 depending on odd or even
            #additionally type can be 2 for last item
            type_x = x%2 if x<x_range-1 else 2
            type_y = y%2 if y<y_range-1 else 2
            type_z = z%2 if z<z_range-1 else 2
            type = {"x":type_x, "y":type_y, "z":type_z}
            stick_module = OStickModule(pt, stick_length, stick_radius, offset, type)
            stick_assembly.extend(stick_module.stick_module)

sticks = [s.geometry  for s in stick_assembly]
# ---------- end grid_sticks ----------
draw = Draw(cg=python.geometry)  # -> rg
#   port cg: The COMPAS geometry or datastructure to be drawn.
#   port rg: The Rhino geometry object.
# ---------- draw: Python ----------
"""
Draws COMPAS geometry in Grasshopper.
"""
from ghpythonlib.componentbase import executingcomponent as component

from compas.artists import Artist


class CompasToRhinoGeometry(component):
    def RunScript(self, cg):
        if not cg:
            return None

        return Artist(cg).draw()
# ---------- end draw ----------
draw_2 = Draw(cg=python.e_lines)  # -> rg; same code as draw
draw_3 = Draw()  # -> rg; same code as draw
draw_4 = Draw(cg=python.stick_axes)  # -> rg; same code as draw
panel = Panel(python.e_dist)
draw_5 = Draw(cg=stick2stick.sticks)  # -> rg; same code as draw
pt = Point(stick2stick_2.points)
crv_3 = Curve(stick2stick_2.lines)
draw_6 = Draw(cg=stick2stick_2.sticks_2)  # -> rg; same code as draw
draw_7 = Draw(cg=stick2stick_2.sticks)  # -> rg; same code as draw
panel_2 = Panel(stick2stick_2.sticks)

# ---- group: sticks
draw_8 = Draw(cg=grid_sticks.points)  # -> rg; same code as draw
draw_9 = Draw(cg=grid_sticks.sticks)  # -> rg; same code as draw

# ----
panel_3 = Panel(crv_3)
python_2 = GhPythonScript(module=python.stick_assembly, engagement_length=number_slider)  # -> out, stick_assembly, next_stick; inputs module: list
# ---------- python_2: Python ----------
from compas.geometry import Polygon, Frame, Vector, Scale, Translation, Point
import math
from compas_ghpython.utilities import unload_modules
import copy

import sys
import os

#get current file path
path = ghenv.Component.OnPingDocument().FilePath
#get parent directory of the parent directory
parentdir = os.path.dirname(path)
#get src folder which contains classes
dire = os.path.join(parentdir,'scripts')

sys.path.append(dire)

unload_modules('stick')
unload_modules('stickmodules')
from stick import Stick
from stickmodules import RStickModule


current_module = RStickModule.from_stick_module(copy.deepcopy(module))
stick_assembly = []
for stick in current_module.sticks:
    v1 = Point(stick.axis.start.x, stick.axis.start.y, 0) - Point(stick.axis.end.x, stick.axis.end.y, 0)
    v2 = v1.unitized() * (v1.length - engagement_length)
    v3 = current_module.mirror_center_along_stick(stick) - current_module.center
    v_move = v3 + v2
    next_module = current_module.copy()
    next_module.flip()
    next_module.move(v_move)
    next_module.rotate(math.radians(180))
    stick_assembly.extend(next_module.geometry)
# ---------- end python_2 ----------
line_0 = Curve(<curve referenced from the Rhino model>)
line_1 = Curve(<curve referenced from the Rhino model>)
stick2stick_3 = GhPythonScript(line_0=line_0, line_1=line_1)  # -> out, sticks; inputs line_0: Line, line_1: Line
# ---------- stick2stick_3: Python ----------
#locate stick class file in the same folder
from compas_rhino import unload_modules
import sys
import os

#get current file path
path = ghenv.Component.OnPingDocument().FilePath
#get parent directory of the parent directory
parentdir = os.path.dirname(path)
#get src folder which contains classes
dire = os.path.join(parentdir,'scripts')

sys.path.append(dire)


unload_modules('stick')

import stick
from stick import Stick
from compas.geometry import Line, Point, Vector
from compas_rhino.conversions import line_to_compas

Stick.RADIUS = 2

stick_assembly = []

line0 = line_to_compas(line_0)
stick0 = Stick(line0)
stick_assembly.append(stick0)

line1 = line_to_compas(line_1)
stick1 = Stick(line1)
stick_assembly.append(stick1)

stick_between = Stick.from_two_sticks(stick0, stick1, 0.1, 0.1, max_iterations = 50)
stick_assembly.append(stick_between)

sticks = [s.geometry for s in stick_assembly]
# ---------- end stick2stick_3 ----------
draw_10 = Draw(cg=python_2.stick_assembly)  # -> rg; same code as draw
draw_11 = Draw(cg=stick2stick_3.sticks)  # -> rg; same code as draw
