# Grasshopper definition base_curve_pja.ghx (Grasshopper 1.0.7)
# plug-ins: Heteroptera

crv = Curve(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)
center = Center(Geometry=crv)  # -> Center, Dimension
scale = Scale(Geometry=crv, Center=center.Center, Factor=Slider(10, range=0..100))  # -> Geometry, Transform
ghpython_script = GhPythonScript(base_curve=crv, length_stick=Slider(86, range=0..200), extend_length=Slider(62, range=0..100))  # -> out, geometry, e_lines, e_dist, eccentricities; inputs base_curve: Curve, line: Line
# ---------- ghpython_script: Python ----------
from compas.geometry import NurbsCurve, Curve, Polygon, Frame, Vector, Scale, Translation, Point, Line
import compas_rhino
from compas_rhino.conversions import line_to_compas
import math
from compas_ghpython.utilities import unload_modules
import sys
import os
import Rhino.Geometry as rg

#get current file path
path = ghenv.Component.OnPingDocument().FilePath
#get parent directory of the parent directory
parentdir = os.path.dirname(path)
#get src folder which contains classes
dire = os.path.join(parentdir,'scripts')



sys.path.append(dire)

unload_modules('stick')
unload_modules('stickmodules')

from stick import Stick
from stickmodules import OStickModule, RStickModule

def get_eccentricities(sticks):
    e_lines = []
    e_len = []
    # get eccentricity lines between stick and next stick
    for i in range(len(sticks)):
        stick1 = sticks[i]
        stick2 = sticks[(i+1) % len(sticks)]
        e_line = stick1.eccentricity(stick2)
        e_lines.append(e_line)
        e_len.append(e_line.length)
    # return e_lines and e_dist
    return e_lines, e_len



#def from_path_polyline(curve, length):
#    points = []
#    params = curve.DivideByLength(length, True)
#    for p in params:
#        point = curve.PointAt(p)
#        points.append(point)
#    sticks = []
#    for i, pt in enumerate(points):
#        line = rg.Line(points[i], points[i+1])
#        stick = Stick(line, radius_stick=2.0)
#        stick.geometry()
#        sticks.append(stick)
#    return sticks

points = []
params = base_curve.DivideByLength(length_stick, True)
for p in params:
    point = base_curve.PointAt(p)
    points.append(point)


sticks = []
for i, pt in enumerate(points):
    if i < len(points) -1:
        line = rg.Line(points[i], points[i+1])
        #lines.append(line)
        #rg.Line.Extend(line, extend_length, extend_length)
        line_compas = line_to_compas(line)
        #line = rg.Line.ToNurbsCurve(line)
        #line = rg.Curve.ToNurbsCurve(line)
        stick = Stick(line_compas)
        sticks.append(stick)

e_lines, e_dist = get_eccentricities(sticks)


stick_assembly = []
for i, (stick, e_line) in enumerate(zip(sticks, e_lines)):
    if i < len(sticks)-1:
        cross_prod = sticks[i].axis.vector.cross(sticks[i+1].axis.vector)
        cross_prod.unitize()
        vec_len = 2*stick.RADIUS
        vec = cross_prod * vec_len
        T = Translation.from_vector(vec)
        new_end_point = stick.axis.end
        new_end_point.transform(T)
        old_end_point = stick.axis.start
        new_vector = new_end_point - old_end_point
        stick_vector = stick.axis.vector
        angle = stick_vector.angle(new_vector)
        stick.rotate_stick(math.radians(angle)/2)
        stick_assembly.append(stick)
    
    
    
#stick_assembly = []
#accentricities = []
#for i, line in enumerate(lines):
#    if i < len(sticks)-1:
#        eccentricity = Stick.eccentricity(sticks[i], sticks[i+1])
#        accentricities.append(eccentricity)
#        vec_len = 2*RADIUS$
#        
        #print(new_line)
#        stick = Stick(stick, radius_stick=2.0)
#        stick_assembly.append(stick)





geometry = [stick.geometry for stick in stick_assembly]
stick_axes = [stick.axis for stick in sticks]



#points = from_path_polyline(base_curve, 100)
# ---------- end ghpython_script ----------
panel = Panel(ghpython_script.e_lines)
draw = Draw(cg=ghpython_script.geometry)  # -> rg
#   port cg: The COMPAS geometry or datastructure to be drawn.
#   port rg: The Rhino geometry object.
# ---------- draw: Python ----------
"""
Draws COMPAS geometry in Grasshopper.
"""
from ghpythonlib.componentbase import executingcomponent as component

from compas.artists import Artist


class CompasToRhinoGeometry(component):
    def RunScript(self, cg):
        if not cg:
            return None

        return Artist(cg).draw()
# ---------- end draw ----------
