# Grasshopper definition 103_reciprocal_node_panos.ghx (Grasshopper 1.0.7)
# plug-ins: Chromodoris, Human

crv = Curve(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)
python = GhPythonScript(
    curve=crv,
    length_stick=Slider(200, range=0..300),
    engagement_length=Slider(64.8, range=0..100),
    shift_length=Slider(39.5, range=0..100))  # -> out, stick_lines, stick_assembly, e_lines, e_dist; inputs curve: Curve
# ---------- python: Python ----------
from compas.geometry import Polygon, Frame, Vector, Scale
import compas.geometry as cg
import math
from compas_ghpython.utilities import unload_modules
import sys
import os
import Rhino.Geometry as rg


#get current file path
path = ghenv.Component.OnPingDocument().FilePath
#get parent directory of the parent directory
parentdir1 = os.path.dirname(path)
parentdir = os.path.dirname(parentdir1)
#get src folder which contains classes
dire = os.path.join(parentdir,'scripts')
sys.path.append(dire)

unload_modules('stick')
from stick import Stick


def get_eccentricities(sticks):
    e_lines = []
    e_len = []
    # get eccentricity lines between stick and next stick
    for i in range(len(sticks)):
        stick1 = sticks[i]
        stick2 = sticks[(i+1) % len(sticks)]
        e_line = stick1.eccentricity(stick2)
        e_lines.append(e_line)
        e_len.append(e_line.length)
    # return e_lines and e_dist
    return e_lines, e_len




# create engagement polygon
stick_series = Stick.from_path_interpolation(curve, length_stick, Stick.RADIUS)
stick_assembly = []
stick_lines = []
for stick in stick_series:
    stick_rg = stick.geometry
    stick_assembly.append(stick_rg)
    stick_lines.append(stick.axis)

e_lines, e_dist = get_eccentricities(stick_series)

#for i, (stick, e_line) in enumerate(zip(stick_series, e_lines)):
#    if i < len(stick_series):
#        vec_len = 2*stick.RADIUS + e_line.length
#        vec = e_line.direction * vec_len
#        T = cg.Translation.from_vector(vec)
#        new_end_point = e_line.start
#        new_end_point.transform(T)
#        if i != 0:
#            old_end_point = e_line.end
#        else:
#            line = stick.axis
#            old_end_point = line.midpoint
#    
#        # new vector after moving down 2R + eccentricity.length
#        new_vector = old_end_point - new_end_point
#        # old stick vector
#        stick_vector = stick.axis.vector
#    
#        # calculate rotation angle and plane
#        angle = stick_vector.angle(new_vector)
#        rotation_plane = cg.Plane.from_point_and_two_vectors(old_end_point, stick_vector, new_vector)
#    
#        R = cg.Rotation.from_axis_and_angle(rotation_plane, angle)
#        new_sticks = stick.axis.Transform(R)
#    else:
#        pass



# create stick_assembly as empty list
#stick_assembly = []
## iterate over polygon lines
#for line in engagement_polygon:
#    # initiate Stick
#    stick = Stick(line)
#    # adjust stick to reciprocal rotation
#    stick.rotate_stick(stick.eccentricity_rotation_angle(alpha=(num_sticks-2)*math.pi/(2*num_sticks)))
#    # change stick parameters (length and shift)
#    stick.set_length(length_stick)
#    stick.shift(shift_length)
#
#    # addo to assembly
#    stick_assembly.append(stick)
#
## get eccentricity line and eccentricity distance
## eccentricity distance should be 4.0 for a stick radius of 2.0
#e_lines, e_dist = get_eccentricities(stick_assembly)
#
## return geometry
#geometry = [stick.geometry for stick in stick_assembly]
## return stick axes
#stick_axes = [stick.axis for stick in stick_assembly]
#
#
# ---------- end python ----------

# ---- group: stick_lines
draw = Draw(cg=python.stick_lines)  # -> rg
#   port cg: The COMPAS geometry or datastructure to be drawn.
#   port rg: The Rhino geometry object.
# ---------- draw: Python ----------
"""
Draws COMPAS geometry in Grasshopper.
"""
from ghpythonlib.componentbase import executingcomponent as component

from compas.artists import Artist


class CompasToRhinoGeometry(component):
    def RunScript(self, cg):
        if not cg:
            return None

        return Artist(cg).draw()
# ---------- end draw ----------

# ----
draw_2 = Draw(cg=python.stick_assembly)  # -> rg; same code as draw

# ---- group: eccentricities
draw_3 = Draw(cg=python.e_lines)  # -> rg; same code as draw

# ----
item = ListItem(List=draw, Index=0, Wrap=True)
shift = ShiftList(List=draw_3, Shift="-1", Wrap=invert(True))
curvepoint = PointOnCurve(item, parameter=1)
end = EndPoints(Curve=shift)  # -> Start, End
len = Length(Curve=draw_3)
unit = UnitVector(Vector=draw_3)
data = Data(end.End)
addition = Addition(A=Slider(4, range=0..10), B=len)
end_2 = EndPoints(Curve=draw_3)  # -> Start, End
merge = Merge(Data1=flatten(curvepoint), Data2=flatten(data))
amp = Amplitude(Vector=unit, Amplitude=addition)
pt = Point(end_2.Start)
move = Move(Geometry=pt, Motion=amp)  # -> Geometry, Transform
Z = UnitZ(Factor=1)  # disabled
vec2pt = Vector2Pt(PointA=move.Geometry, PointB=merge, Unitize=False)  # -> Vector, Length
vec2pt_2 = Vector2Pt(PointA=merge, PointB=move.Geometry, Unitize=False)  # -> Vector, Length
xprod = CrossProduct(VectorA=draw, VectorB=Z, Unitize=False)  # -> Vector, Length; disabled
angle = Angle(VectorA=draw, VectorB=vec2pt.Vector)  # -> Angle, Reflex
angle_2 = Angle(VectorA=draw, VectorB=vec2pt_2.Vector)  # -> Angle, Reflex
vdis = VectorDisplay(Anchor=merge, Vector=xprod.Vector)  # disabled
pl = ConstructPlane(Origin=merge, XAxis=draw, YAxis=vec2pt.Vector)
rot3d = Rotate3D(Geometry=draw, Angle=angle.Angle, Center=pl, Axis=pl)  # -> Geometry, Transform
mpipe = MeshPipe(Polylines=rot3d.Geometry, NumberOfSides=Slider(10, range=0..20), Radius=Slider(2, range=0..10), Cap=invert(False))
previewlw = CustomPreviewLineweights(Geometry=draw, Shader=ColourSwatch(SwatchColor=RGB(0, 255, 255)), Thickness=Slider(1, range=0..10), Absolute=False)
previewlw_2 = CustomPreviewLineweights(
    Geometry=rot3d.Geometry,
    Shader=ColourSwatch(SwatchColor=RGBA(255, 0, 255, 53)),
    Thickness=Slider(3, range=0..10),
    Absolute=False)
