# Grasshopper definition 231212_fromPath_Panos.ghx (Grasshopper 1.0.7)

crv = Curve(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)
python = GhPythonScript(curve=crv, length_stick=Slider(200, range=0..300))  # -> out, stick_lines, stick_geometries, e_lines, e_dist; inputs curve: Curve
# ---------- python: Python ----------
from compas.geometry import Polygon, Frame, Vector, Scale
import compas.geometry as cg
import math
from compas_ghpython.utilities import unload_modules
import sys
import os
import Rhino.Geometry as rg
import copy


#get current file path
path = ghenv.Component.OnPingDocument().FilePath
#get parent directory of the parent directory
parentdir1 = os.path.dirname(path)
parentdir = os.path.dirname(parentdir1)
#get src folder which contains classes
dire = os.path.join(parentdir,'scripts')
sys.path.append(dire)

unload_modules('stick')
from stick import Stick


def get_eccentricities(sticks):
    e_lines = []
    e_len = []
    # get eccentricity lines between stick and next stick
    for i in range(len(sticks)):
        stick1 = sticks[i]
        stick2 = sticks[(i+1) % len(sticks)]
        e_line = stick1.eccentricity(stick2)
        e_lines.append(e_line)
        e_len.append(e_line.length)
    # return e_lines and e_dist
    return e_lines, e_len




# create engagement polygon
sticks = Stick.from_path_interpolation(curve, length_stick, Stick.RADIUS)
e_lines, e_dist = get_eccentricities(sticks)





for i, (stick, e_line) in enumerate(zip(sticks, e_lines)):
    vec_len = 2*stick.RADIUS + e_line.length
    vec = e_line.direction * vec_len
    T = cg.Translation.from_vector(vec)
    new_end_point = copy.deepcopy(e_line.start)
    new_end_point.transform(T)
    if i != 0:
        old_end_point = e_lines[i-1].end
    else:
        line = stick.axis
        old_end_point = line.start

    # new vector after moving down 2R + eccentricity.length
    new_vector =  new_end_point - old_end_point 
    # old stick vector
    stick_vector = stick.axis.vector

    # calculate rotation angle and plane
    if i == len(sticks)-1:
        angle = 0
    else:
        angle = stick_vector.angle(new_vector)
    rotation_plane = cg.Plane.from_point_and_two_vectors(old_end_point, stick_vector, new_vector)
    R = cg.Rotation.from_axis_and_angle(rotation_plane.normal, angle, rotation_plane.point)
    stick.axis.transform(R)



# visualize stick lines & geometries
stick_geometries = []
stick_lines = []
for stick in sticks:
    stick_geometry = stick.geometry
    stick_geometries.append(stick_geometry)
    stick_lines.append(stick.axis)
# ---------- end python ----------
panel = Panel(python.e_dist)

# ---- group: stick_lines
draw = Draw(cg=python.stick_lines)  # -> rg
#   port cg: The COMPAS geometry or datastructure to be drawn.
#   port rg: The Rhino geometry object.
# ---------- draw: Python ----------
"""
Draws COMPAS geometry in Grasshopper.
"""
from ghpythonlib.componentbase import executingcomponent as component

from compas.artists import Artist


class CompasToRhinoGeometry(component):
    def RunScript(self, cg):
        if not cg:
            return None

        return Artist(cg).draw()
# ---------- end draw ----------

# ---- group: stick_geometries
draw_2 = Draw(cg=python.stick_geometries)  # -> rg; same code as draw

# ---- group: eccentricities
draw_3 = Draw(cg=python.e_lines)  # -> rg; same code as draw
