# Grasshopper definition 101_stick_to_it.ghx (Grasshopper 1.0.7)

number_slider = Slider(66.8, range=0..100)  # disabled
number_slider_2 = Slider(77.9, range=0..100)  # disabled

# ---- group: grid_parameters
number_slider_3 = Slider(16, range=0..20)  # disabled
number_slider_4 = Slider(10.9, range=0..20)  # disabled

# ----
number_slider_5 = Slider(5, range=-89..89)  # disabled
number_slider_6 = Slider(78, range=-90..90)  # disabled
number_slider_7 = Slider(169.6, range=0..200)  # disabled
number_slider_8 = Slider(5, range=3..10)  # disabled
python = GhPythonScript(num_sticks=number_slider_8, length_stick=number_slider_7, engagement_length=number_slider_2, shift_length=number_slider)  # -> out, stick_assembly, geometry, e_lines, stick_axes, e_dist; inputs num_sticks: Int32; disabled
# ---------- python: Python ----------
from compas.geometry import Polygon, Frame, Vector, Scale
import math
from compas_ghpython.utilities import unload_modules
import sys
import os

#get current file path
path = ghenv.Component.OnPingDocument().FilePath
#get parent directory of the parent directory
parentdir = os.path.dirname(path)
#get src folder which contains classes
dire = os.path.join(parentdir,'scripts')

sys.path.append(dire)

unload_modules('stick')
from stick import Stick

def create_polygon(sides, side_length):
    polygon = Polygon.from_sides_and_radius_xy(sides, 1)
    T = Scale.from_factors([side_length/(polygon.length/sides)]*3)
    p = polygon.transformed(T)
    return p.lines
    
def get_eccentricities(sticks):
    e_lines = []
    for i in range(len(sticks)):
        stick1 = sticks[i]
        stick2 = sticks[(i+1) % len(sticks)]
        e_line = stick1.eccentricity(stick2)
        e_lines.append(e_line)
    return e_lines, e_line.length


engagement_polygon = create_polygon(num_sticks, engagement_length)

stick_assembly = []
for line in engagement_polygon:
    # initiate Stick
    stick = Stick(line)
    # adjust stick to reciprocal rotation
    stick.rotate_stick(stick.eccentricity_rotation_angle(alpha=((num_sticks-2)*math.pi)/(2*num_sticks)))
    # change stick parameters (length and shift)
    stick.set_length(length_stick)
    stick.shift(shift_length)
    # addo to assembly
    stick_assembly.append(stick)

# get eccentricity line and eccentricity distance
# eccentricity distance should be 4.0 for a stick radius of 2.0
e_lines, e_dist = get_eccentricities(stick_assembly)

geometry = [stick.geometry for stick in stick_assembly]
stick_axes = [stick.axis for stick in stick_assembly]
# ---------- end python ----------
grid_sticks = GhPythonScript(y_range=number_slider_3, offset=number_slider_4, angle_x=number_slider_6, angle_z=number_slider_5)  # -> out, points, sticks, e_lines; inputs x_range: Int32, y_range: Int32, z_range: Int32; disabled
# ---------- grid_sticks: Python ----------
#locate stick class file in the same folder
from compas.geometry import Line, Point, Vector
from compas_rhino import unload_modules
import sys
import os
import math


#get current file path
path = ghenv.Component.OnPingDocument().FilePath
#get parent directory of the parent directory
parentdir = os.path.dirname(path)
#get src folder which contains classes
dire = os.path.join(parentdir,'scripts')

sys.path.append(dire)


unload_modules('stick')


from stick import Stick
from stickmodules_2 import NStickModule


def get_eccentricities(sticks):
    e_lines = []
    for i in range(len(sticks)):
        stick1 = sticks[i]
        stick2 = sticks[(i+1) % len(sticks)]
        e_line = stick1.eccentricity(stick2)
        e_lines.append(e_line)
    return e_lines, e_line.length


stick_radius = 2
stick_length = 100

stick_assembly = []
points = []


for x in range(1):
    for y in range(y_range):
        gap = stick_radius*5
        pt = Point(0, y*gap, 0)
        points.append(pt)
        type_x = x
        type_y = y
        type = {"x":type_x, "y":type_y}
        stick_module = NStickModule(pt, stick_length, stick_radius, offset, math.radians(angle_x), math.radians(angle_z))
        stick_assembly.extend(stick_module.stick_module)

#e_lines, e_dist = get_eccentricities(stick_assembly)
line = [s.eccentricity for s in stick_assembly]
sticks = [s.geometry  for s in stick_assembly]
# ---------- end grid_sticks ----------
stick2stick = GhPythonScript()  # -> out, sticks; inputs line_0: Line, line_1: Line; disabled
# ---------- stick2stick: Python ----------
#locate stick class file in the same folder
from compas_rhino import unload_modules
import sys
import os

#get current file path
path = ghenv.Component.OnPingDocument().FilePath
#get parent directory of the parent directory
parentdir = os.path.dirname(path)
#get src folder which contains classes
dire = os.path.join(parentdir,'scripts')

sys.path.append(dire)


unload_modules('stick')

import stick
import stickmodules
from stick import Stick 
from stickmodules import OStickModule
from compas.geometry import Line, Point, Vector
from compas_rhino.conversions import line_to_compas

Stick.RADIUS = 2

stick_assembly = []

line0 = line_to_compas(line_0)
stick0 = Stick(line0)
stick_assembly.append(stick0)

line1 = line_to_compas(line_1)
stick1 = Stick(line1)
stick_assembly.append(stick1)

stick_between = Stick.stick_between(stick0, stick1, 0.1, 0.1, max_iterations = 50)
stick_assembly.append(stick_between)

sticks = [s.geometry for s in stick_assembly]
# ---------- end stick2stick ----------
grid_sticks_2 = GhPythonScript(offset=Slider(10.9, range=0..20), angle_x=Slider(46, range=-90..90), angle_z=Slider(35, range=-89..89))  # -> out, points, sticks, e_lines, stick_assembly
# ---------- grid_sticks_2: Python ----------
#locate stick class file in the same folder
from compas.geometry import Line, Point, Vector
from compas_rhino import unload_modules
import sys
import os
import math


#get current file path
path = ghenv.Component.OnPingDocument().FilePath
#get parent directory of the parent directory
parentdir = os.path.dirname(path)
#get src folder which contains classes
dire = os.path.join(parentdir,'scripts')

sys.path.append(dire)


unload_modules('stick')


from stick import Stick
from stickmodules_2 import NStickModule


def get_eccentricities(sticks):
    e_lines = []
    for i in range(len(sticks)):
        stick1 = sticks[i]
        stick2 = sticks[(i+1) % len(sticks)]
        e_line = stick1.eccentricity(stick2)
        e_lines.append(e_line)
    return e_lines, e_line.length


stick_radius = 2
stick_length = 100
stick_assembly = []

pt = Point(0, 0, 0)
module0 = NStickModule(pt, stick_length, stick_radius, offset, math.radians(angle_x), math.radians(angle_z))
stick_assembly.extend(module0.stick_module)


#e_lines, e_dist = get_eccentricities(stick_assembly)
#line = [s.eccentricity for s in stick_assembly]
sticks = [s.geometry  for s in stick_assembly]
# ---------- end grid_sticks_2 ----------
panel = Panel(grid_sticks_2.stick_assembly)

# ---- group: sticks
draw = Draw(cg=grid_sticks.points)  # -> rg; disabled
#   port cg: The COMPAS geometry or datastructure to be drawn.
#   port rg: The Rhino geometry object.
# ---------- draw: Python ----------
"""
Draws COMPAS geometry in Grasshopper.
"""
from ghpythonlib.componentbase import executingcomponent as component

from compas.artists import Artist


class CompasToRhinoGeometry(component):
    def RunScript(self, cg):
        if not cg:
            return None

        return Artist(cg).draw()
# ---------- end draw ----------
draw_2 = Draw(cg=grid_sticks.sticks)  # -> rg; disabled; same code as draw

# ----
draw_3 = Draw(cg=grid_sticks.e_lines)  # -> rg; disabled; same code as draw
draw_4 = Draw(cg=grid_sticks_2.points)  # -> rg; same code as draw
draw_5 = Draw(cg=grid_sticks_2.sticks)  # -> rg; same code as draw
draw_6 = Draw(cg=grid_sticks_2.e_lines)  # -> rg; same code as draw
draw_7 = Draw(cg=python.geometry)  # -> rg; disabled; same code as draw
draw_8 = Draw(cg=python.e_lines)  # -> rg; disabled; same code as draw
draw_9 = Draw()  # -> rg; disabled; same code as draw
draw_10 = Draw(cg=python.stick_axes)  # -> rg; disabled; same code as draw
panel_2 = Panel(python.e_dist)  # disabled
python_2 = GhPythonScript(module=python.stick_assembly, engagement_length=number_slider_2)  # -> out, stick_assembly, next_stick; inputs module: list; disabled
# ---------- python_2: Python ----------
from compas.geometry import Polygon, Frame, Vector, Scale, Translation, Point
import math
from compas_ghpython.utilities import unload_modules
import copy

import sys
import os

#get current file path
path = ghenv.Component.OnPingDocument().FilePath
#get parent directory of the parent directory
parentdir = os.path.dirname(path)
#get src folder which contains classes
dire = os.path.join(parentdir,'scripts')

sys.path.append(dire)

unload_modules('stick')
unload_modules('stickmodules')
from stick import Stick
from stickmodules import RStickModule


current_module = RStickModule.from_stick_module(copy.deepcopy(module))
stick_assembly = []
for stick in current_module.sticks:
    v1 = Point(stick.axis.start.x, stick.axis.start.y, 0) - Point(stick.axis.end.x, stick.axis.end.y, 0)
    v2 = v1.unitized() * (v1.length - engagement_length)
    v3 = current_module.mirror_center_along_stick(stick) - current_module.center
    v_move = v3 + v2
    next_module = current_module.copy()
    next_module.flip()
    next_module.move(v_move)
    next_module.rotate(math.radians(180))
    stick_assembly.extend(next_module.geometry)
# ---------- end python_2 ----------
draw_11 = Draw(cg=python_2.stick_assembly)  # -> rg; disabled; same code as draw
