# Grasshopper definition tetrahedron_tower_wataru.ghx (Grasshopper 1.0.7)

length_stick = Slider(40, range=0..100)
tetra_number = Slider(34, range=0..100)
unit_length = Slider(30, range=0..100)
unit_length_2 = Slider(14.2, range=0..100)
ghpython_script = GhPythonScript(tetra_number=tetra_number, unit_length=unit_length, length_stick=length_stick, shift_length=unit_length_2)  # -> out, geometry, support, points, lines_0to1, lines_0to2, lines_0to3, lines_1to2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; inputs tetra_number: Int32
# ---------- ghpython_script: Python ----------
from compas.geometry import Point, Vector, Polyhedron,Scale, centroid_points, distance_point_point, Rotation, Line
import math
from compas_ghpython.utilities import unload_modules
import sys
import os

#get current file path
path = ghenv.Component.OnPingDocument().FilePath
#get parent directory of the parent directory
parentdir = os.path.dirname(path)
#get src folder which contains classes
dire = os.path.join(parentdir,'scripts')

sys.path.append(dire)

unload_modules('stick')
from stick import Stick

def compute_normal(p1, p2, p3):
    v1 = Vector.from_start_end(p1, p2)
    v2 = Vector.from_start_end(p1, p3)
    return v1.cross(v2).unitized()

class MakeTetrahedron:
    def __init__(self, unit_length, h_of_face, h_of_hedron):
        self.unit_length = unit_length
        self.h_of_face = h_of_face
        self.h_of_hedron = h_of_hedron

    def make_initial_tetrahedron(self, vertices):
        faces = [[0, 1, 3], [1, 2, 3], [2, 0, 3], [0, 1, 2]]
        temp = Polyhedron(vertices, faces)
        T = Scale.from_factors([unit_length]*3)
        R = Rotation.from_axis_and_angle(Vector(0, 0, 1), math.radians(30), Point(0,0,0))
        R_2 = Rotation.from_axis_and_angle(Vector(1, 0, 0), math.radians(39.25), Point(0.5,0,0))
        temp_2 = temp.transformed(T)
        temp_3 = temp_2.transformed(R)
        tetrahedron = temp_3.transformed(R_2)
        return tetrahedron

    def make_next_tetrahedron(self, polyhedron, specified_index):
        tetrahedron_faces = polyhedron.faces
        selected_face = tetrahedron_faces[specified_index]
        polyhedron_vertices = polyhedron.vertices
        face_vertices = [Point(*polyhedron_vertices[j]) for j in selected_face] # * is unpack operator
        centroid = centroid_points(face_vertices)
        face_center = Point(*centroid)
        face_normal = compute_normal(*face_vertices)
        scaled_face_normal = face_normal.scaled(self.h_of_hedron * unit_length)
        end_point = face_center + scaled_face_normal
        new_vertices = face_vertices + [end_point]
        new_faces = [ [0, 1, 3], [1, 2, 3], [2, 0, 3], [0, 1, 2] ]
        new_tetrahedron = Polyhedron(new_vertices, new_faces)
        return new_tetrahedron


geometry = []
h_of_triangle = math.sqrt(3) / 2
h_of_tetrahedron = math.sqrt(6) / 3

initial_vertices = [
    Point(-0.5, -h_of_triangle / 3, 0),
    Point(0.5, -h_of_triangle / 3, 0),
    Point(0, h_of_triangle * (2/3), 0),
    Point(0, 0, h_of_tetrahedron)
    ]

for i in range(tetra_number):
    ins_tetrahedron = MakeTetrahedron(unit_length, h_of_triangle, h_of_tetrahedron)
    if i == 0:
        initial_tetrahedron = ins_tetrahedron.make_initial_tetrahedron(initial_vertices)
        geometry.append(initial_tetrahedron)
    else:
        next_tetrahedron = ins_tetrahedron.make_next_tetrahedron(geometry[-1], 1)
        geometry.append(next_tetrahedron)

del geometry[0:1]

points = []
for i,tetrahedron in enumerate(geometry):
    if i == 0:
        points.extend(geometry[0].vertices)
    else:
        points.append(geometry[i].vertices[3])

lines_0to1 = []
lines_0to2 = []
lines_0to3 = []
lines_1to2 = []
lines_1to3 = []
lines_1to4 = []
lines_2to3 = []
lines_2to4 = []
lines_2to5 = []

for i,point in enumerate(points):
    if i%3 == 0:
        if i+1 < len(points):
            line_0to1 = Line(points[i], points[i+1])
            lines_0to1.append(line_0to1)
        if i+2 < len(points):
            line_0to2 = Line(points[i], points[i+2])
            lines_0to2.append(line_0to2)
        if i+3 < len(points):
            line_0to3 = Line(points[i], points[i+3])
            lines_0to3.append(line_0to3)
    if (i-1)%3 == 0:
        if i+1 < len(points):
            line_1to2 = Line(points[i], points[i+1])
            lines_1to2.append(line_1to2)
        if i+2 < len(points):
            line_1to3 = Line(points[i], points[i+2])
            lines_1to3.append(line_1to3)
        if i+3 < len(points):
            line_1to4 = Line(points[i], points[i+3])
            lines_1to4.append(line_1to4)
    if (i-2)%3 == 0:
        if i+1 < len(points):
            line_2to3 = Line(points[i], points[i+1])
            lines_2to3.append(line_2to3)
        if i+2 < len(points):
            line_2to4 = Line(points[i], points[i+2])
            lines_2to4.append(line_2to4)
        if i+3 < len(points):
            line_2to5 = Line(points[i], points[i+3])
            lines_2to5.append(line_2to5)

support = []
point_0 = geometry[0].vertices[0]
point_1 = geometry[0].vertices[1]
point_2 = geometry[0].vertices[2]

R_1 = Rotation.from_axis_and_angle(Vector(0,0,1), math.radians(180), point_1)
R_2 = Rotation.from_axis_and_angle(Vector(0,0,1), math.radians(180), point_2)

line_1 = Line(point_0, point_1)
line_1 = line_1.transformed(R_1)
line_2 = Line(point_0, point_2)
line_2 = line_2.transformed(R_2)

support.append(line_1)
support.append(line_2)

#points.append(line_1.start)
#points.append(line_2.start)

lines = []
lines.extend(lines_0to1)
lines.extend(lines_0to2)
lines.extend(lines_0to3)
lines.extend(lines_1to2)
lines.extend(lines_1to3)
lines.extend(lines_1to4)
lines.extend(lines_2to3)
lines.extend(lines_2to4)
lines.extend(lines_2to5)

module = []
for line in lines:
    # initiate Stick
    stick = Stick(line)
    #change stick parameters (length and shift)
    stick.set_length(length_stick)
    stick.shift(shift_length)
#    stick.rotate_stick_theta(length_stick,shift_length)
    # addo to assembly
    module.append(stick)

geometry_stick = [stick.geometry for stick in module]
stick_axes = [stick.axis for stick in module]
# ---------- end ghpython_script ----------
draw = Draw(cg=ghpython_script.stick_axis)  # -> rg
#   port cg: The COMPAS geometry or datastructure to be drawn.
#   port rg: The Rhino geometry object.
# ---------- draw: Python ----------
"""
Draws COMPAS geometry in Grasshopper.
"""
from ghpythonlib.componentbase import executingcomponent as component

from compas.artists import Artist


class CompasToRhinoGeometry(component):
    def RunScript(self, cg):
        if not cg:
            return None

        return Artist(cg).draw()
# ---------- end draw ----------
draw_2 = Draw(cg=ghpython_script.geometry_stick)  # -> rg; same code as draw
draw_3 = Draw(cg=ghpython_script.geometry)  # -> rg; same code as draw
draw_4 = Draw(cg=ghpython_script.support)  # -> rg; same code as draw
draw_5 = Draw(cg=ghpython_script.points)  # -> rg; same code as draw
draw_6 = Draw(cg=ghpython_script.lines_0to1)  # -> rg; same code as draw
draw_7 = Draw(cg=ghpython_script.lines_0to2)  # -> rg; same code as draw
draw_8 = Draw(cg=ghpython_script.lines_1to2)  # -> rg; same code as draw
draw_9 = Draw(cg=ghpython_script.lines_1to3)  # -> rg; same code as draw
draw_10 = Draw(cg=ghpython_script.lines_2to3)  # -> rg; same code as draw
draw_11 = Draw(cg=ghpython_script.lines_2to4)  # -> rg; same code as draw
draw_12 = Draw(cg=ghpython_script.lines_0to3)  # -> rg; same code as draw
draw_13 = Draw(cg=ghpython_script.lines_1to4)  # -> rg; same code as draw
draw_14 = Draw(cg=ghpython_script.lines_2to5)  # -> rg; same code as draw
list_item = ListItem(List=draw_5, Index=Slider(26, range=0..60), Wrap=True)
