# Grasshopper definition spp_201_stick_assembly.ghx (Grasshopper 1.0.7)

number_slider = Slider(0, range=0..100)
number_slider_2 = Slider(0, range=0..100)
pt = ConstructPoint(XCoordinate=number_slider, YCoordinate=number_slider, ZCoordinate=number_slider)
python = GhPythonScript(num_sticks=Slider(5, range=3..10), engagement_length=Slider(65.8, range=0..250), shift_length=Slider(27.5, range=0..100))  # -> out, base_polygon, pts_base; inputs num_sticks: Int32
# ---------- python: Python ----------
from compas.geometry import Polygon, Frame, Vector, Scale
import math
from compas_ghpython.utilities import unload_modules
import sys
import os

#get current file path
path = ghenv.Component.OnPingDocument().FilePath
#get parent directory of the parent directory
parentdir = os.path.dirname(path)
#get src folder which contains classes
dire = os.path.join(parentdir,'scripts')

sys.path.append(dire)

unload_modules('stick')
from stick import Stick

def create_polygon(sides, side_length):
    polygon = Polygon.from_sides_and_radius_xy(sides, 1)
    T = Scale.from_factors([side_length/(polygon.length/sides)]*3)
    p = polygon.transformed(T)
    return p.lines
    
def get_eccentricities(sticks):
    e_lines = []
    for i in range(len(sticks)):
        stick1 = sticks[i]
        stick2 = sticks[(i+1) % len(sticks)]
        e_line = stick1.eccentricity(stick2)
        e_lines.append(e_line)
    return e_lines, e_line.length


base_polygon = create_polygon(num_sticks, engagement_length)

pts_base = []
for ln in base_polygon:
    pt = ln.start
    pts_base.append(pt)
# ---------- end python ----------
distance_between_pts = Slider(400, range=0..1000)
lenght_of_stick = Slider(100, range=0..200)
pl = ConstructPlane(Origin=pt, XAxis=Vector(1, 0, 0), YAxis=Vector(0, 1, 0))
python_2 = GhPythonScript(
    length_stick=Slider(100, range=0..100),
    num_sticks=Slider(10, range=0..10),
    shift_length=Slider(36.8, range=0..100),
    angle=Slider(0, range=0..90))  # -> out, sticks, lines; inputs num_sticks: Int32
# ---------- python_2: Python ----------
import compas.geometry as cg
from compas.geometry import  Polygon, Frame, Vector, Scale, Plane, Point, Line
import math
from compas_ghpython.utilities import unload_modules
import sys
import os
import copy

#get current file path
path = ghenv.Component.OnPingDocument().FilePath
#get parent directory of the parent directory
parentdir = os.path.dirname(path)
#get src folder which contains classes
dire = os.path.join(parentdir,'scripts')

sys.path.append(dire)

unload_modules('stick')
from stick import Stick

def get_eccentricities(sticks):
    e_lines = []
    for i in range(len(sticks)):
        stick1 = sticks[i]
        stick2 = sticks[(i+1) % len(sticks)]
        e_line = stick1.eccentricity(stick2)
        e_lines.append(e_line)
    return e_lines, e_line.length

start_pt = Point(0,0,0)
point1 = Point(0,0,1000)
dist = start_pt.distance_to_point(point1)

line_vector = Vector.from_start_end(start_pt ,point1)
direction = Vector.unitized(line_vector)
line_height = length_stick  #*math.sin(math.radians(angle))-10
no_sticks = int(dist/line_height)


lines = []

for l in range(no_sticks):
    if l%2 == 0:
        start_pt_new =Point(start_pt.x,start_pt.y,l*line_height) 
        line = cg.Line([0,0,l*length_stick],[length_stick/2,0,(l*length_stick)+length_stick])
        T3 = cg.Rotation.from_axis_and_angle(Vector(start_pt_new.x,start_pt_new.y+line_height,l*line_height+1),math.radians(angle))
        line.transform(T3)
        lines.append(line)
    else:
        pass
#        line = cg.Line([(length_stick/2),0,(l*length_stick)-length_stick*2],[0,0,(l*length_stick)-length_stick])
#        lines.append(line)


#module = []
#for line in lines:
#    # initiate Stick
#    stick = Stick(line)
#    module.append(stick)

sticks = []
for i, ln in enumerate(lines):
    if i != len(lines)-1:
        stick1 = Stick(ln)
        stick2 = Stick(lines[i+1])

        new_stick = Stick.from_two_sticks(stick1,stick2,0.9,0.1,length_stick)
        sticks.append(stick1.geometry)
        sticks.append(new_stick.geometry)

#geometry = [stick.geometry for stick in sticks]
# ---------- end python_2 ----------
python_3 = GhPythonScript(
    length_stick=Slider(100, range=0..100),
    num_sticks=Slider(5, range=0..10),
    engagement_length=Slider(65.8, range=0..250),
    angle=Slider(0, range=0..1),
    height=Slider(1000, range=500..2000))  # -> out, base_polygon, pts_base, newpt, geometry, lines, lines_poly, lines_on_poly, module; inputs num_sticks: Int32
# ---------- python_3: Python ----------
import compas.geometry as cg
from compas.geometry import  Polygon, Frame, Vector, Scale, Plane, Point, Line
import math
from compas_ghpython.utilities import unload_modules
import sys
import os
import copy
import ghpythonlib.treehelpers as th

#get current file path
path = ghenv.Component.OnPingDocument().FilePath
#get parent directory of the parent directory
parentdir = os.path.dirname(path)
#get src folder which contains classes
dire = os.path.join(parentdir,'scripts')

sys.path.append(dire)

unload_modules('stick')
from stick import Stick

def create_polygon(sides, side_length):
    polygon = Polygon.from_sides_and_radius_xy(sides, 1)
    T = Scale.from_factors([side_length/(polygon.length/sides)]*3)
    p = polygon.transformed(T)
    return p.lines
    

def get_eccentricities(sticks):
    e_lines = []
    for i in range(len(sticks)):
        stick1 = sticks[i]
        stick2 = sticks[(i+1) % len(sticks)]
        e_line = stick1.eccentricity(stick2)
        e_lines.append(e_line)
    return e_lines, e_line.length


base_polygon = create_polygon(num_sticks, engagement_length)
top_polygon = copy.deepcopy(base_polygon)


pts_base = []
pts_top = []
for ln in base_polygon:
    pt = ln.start
    pts_base.append(pt)
    pts_top.append(pt)



T = cg.translate_points(pts_top, Vector(0,0,height))
newpt = [Point(i[0],i[1],i[2]) for i in T]

lines_poly = []
lines_on_poly = []
for pt_start in pts_base:
    for pt_end in newpt:

        distance = pt_start.distance_to_point(pt_end)
        no_sticks = int(distance/length_stick)
        lines = []

        for l in range(no_sticks):
            if l%2 == 0:
                line = cg.Line([pt_start.x,pt_start.y,l*length_stick],[pt_end.x+length_stick/2,pt_end.y,(l*length_stick)+length_stick])
        #        T3 = cg.Rotation.from_axis_and_angle(Vector(start_pt_new.x,start_pt_new.y+l,l*line_height+1),math.radians(angle))
        #        line.transform(T3)
                lines.append(line)
            else:
                line = cg.Line([(pt_end.x),pt_end.y,(l*length_stick)+length_stick],[pt_start.x+length_stick/2,pt_start.y,l*length_stick])
                lines.append(line)

        lines_poly.append(lines)
#    lines_on_poly.append(lines_poly)

#        lines_on_poly.append(lines_poly)



#    for ptn in newpt:
#        ptn = pt_end 
#        distance = pt_start.distance_to_point(pt_end)
#        print distance
#line_height = length_stick
#no_sticks = int(distance/line_height)
#lines = []
#lines_on_poly = []






#start_pt = Point(0,0,0)
#point1 = Point(0,0,1000)
#dist = start_pt.distance_to_point(point1)
#
#line_vector = Vector.from_start_end(start_pt ,point1)
#direction = Vector.unitized(line_vector)
#line_height = length_stick  #*math.sin(math.radians(angle))-10
#no_sticks = int(dist/line_height)
#
#
#lines = []
#
#for l in range(no_sticks):
#    if l%2 == 0:
#        start_pt_new =Point(start_pt.x,start_pt.y,l*line_height) 
#        line = cg.Line([0,0,l*length_stick],[length_stick/2,0,(l*length_stick)+length_stick])
##        T3 = cg.Rotation.from_axis_and_angle(Vector(start_pt_new.x,start_pt_new.y+l,l*line_height+1),math.radians(angle))
##        line.transform(T3)
#        lines.append(line)
#    else:
#        line = cg.Line([(length_stick/2),0,(l*length_stick)-length_stick*2],[0,0,(l*length_stick)-length_stick])
#        if l == 1:
#            pass
##        T3 = cg.Rotation.from_axis_and_angle(Vector(start_pt_new.x,start_pt_new.y+l,l*line_height+1),math.radians(angle))
##        line.transform(T3)
#        lines.append(line)
#
#
#module = []
#for lin in lines_poly:
#    for l in lin:
#        # initiate Stick
#        stick = Stick(l)
#    #    Stick.rotate_stick(stick,angle)
#        module.append(stick)




#sticks = []
#for i, ln in enumerate(lines):
#    if i != len(lines)-1:
#        stick1 = Stick(ln)
#        stick2 = Stick(lines[i+1])
#        new_stick = Stick.from_two_sticks(stick1,stick2,0.9,0.1,length_stick)
#        sticks.append(stick1.geometry)
#        sticks.append(new_stick.geometry)

#geometry = [stick.geometry for stick in module]
# ---------- end python_3 ----------
pt_2 = ConstructPoint(XCoordinate=number_slider_2, YCoordinate=number_slider_2, ZCoordinate=number_slider_2)
pt_3 = ConstructPoint(XCoordinate=number_slider_2, YCoordinate=number_slider_2, ZCoordinate=Slider(400, range=0..1000))
python_4 = GhPythonScript(
    num_sticks=Slider(5, range=3..10),
    length_stick=Slider(97.4, range=0..200),
    engagement_length=Slider(65.8, range=0..250),
    shift_length=Slider(27.5, range=0..100))  # -> out, module, geometry, stick_axes, engagement_polygon; inputs num_sticks: Int32
# ---------- python_4: Python ----------
from compas.geometry import Polygon, Frame, Vector, Scale
import math
from compas_ghpython.utilities import unload_modules
import sys
import os

#get current file path
path = ghenv.Component.OnPingDocument().FilePath
#get parent directory of the parent directory
parentdir = os.path.dirname(path)
#get src folder which contains classes
dire = os.path.join(parentdir,'scripts')

sys.path.append(dire)

unload_modules('stick')
from stick import Stick

def create_polygon(sides, side_length):
    polygon = Polygon.from_sides_and_radius_xy(sides, 1)
    T = Scale.from_factors([side_length/(polygon.length/sides)]*3)
    p = polygon.transformed(T)
    return p.lines
    
def get_eccentricities(sticks):
    e_lines = []
    for i in range(len(sticks)):
        stick1 = sticks[i]
        stick2 = sticks[(i+1) % len(sticks)]
        e_line = stick1.eccentricity(stick2)
        e_lines.append(e_line)
    return e_lines, e_line.length


engagement_polygon = create_polygon(num_sticks, engagement_length)

module = []
for line in engagement_polygon:
    # initiate Stick
    stick = Stick(line)
    # adjust stick to reciprocal rotation
    stick.rotate_stick(stick.eccentricity_rotation_angle(alpha=((num_sticks-2)*math.pi)/(2*num_sticks)))
    # change stick parameters (length and shift)
    stick.set_length(length_stick)
    stick.shift(shift_length)
    # addo to assembly
    module.append(stick)

# get eccentricity line and eccentricity distance
# eccentricity distance should be 4.0 for a stick radius of 2.0
e_lines, e_dist = get_eccentricities(module)

geometry = [stick.geometry for stick in module]
stick_axes = [stick.axis for stick in module]
# ---------- end python_4 ----------
cir = Circle(Plane=pl, Radius=Slider(50, range=0..100))
Z = UnitZ(Factor=Slider(100, range=0..100))
draw = Draw(cg=python_2.sticks)  # -> rg
#   port cg: The COMPAS geometry or datastructure to be drawn.
#   port rg: The Rhino geometry object.
# ---------- draw: Python ----------
"""
Draws COMPAS geometry in Grasshopper.
"""
from ghpythonlib.componentbase import executingcomponent as component

from compas.artists import Artist


class CompasToRhinoGeometry(component):
    def RunScript(self, cg):
        if not cg:
            return None

        return Artist(cg).draw()
# ---------- end draw ----------
draw_2 = Draw(cg=python_2.lines)  # -> rg; same code as draw
ln = Line(StartPoint=pt_2, EndPoint=pt_3)
division = Division(A=distance_between_pts, B=lenght_of_stick)
move = Move(Geometry=cir, Motion=Z)  # -> Geometry, Transform
draw_3 = Draw(cg=python_3.base_polygon)  # -> rg; same code as draw
draw_4 = Draw(cg=python_3.pts_base)  # -> rg; same code as draw
geo = Geometry()
draw_5 = Draw(cg=python_3.geometry)  # -> rg; same code as draw
divide = DivideCurve(Curve=ln, Count=division, Kinks=False)  # -> Points, Tangents, Parameters
divide_2 = DivideCurve(Curve=cir, Count=10, Kinks=False)  # -> Points, Tangents, Parameters
divide_3 = DivideCurve(Curve=move.Geometry, Count=Slider(10, range=0..10), Kinks=False)  # -> Points, Tangents, Parameters
panel = Panel(python_3.lines_poly)
draw_6 = Draw(cg=python_4.geometry)  # -> rg; same code as draw
draw_7 = Draw(cg=python_3.newpt)  # -> rg; same code as draw
panel_2 = Panel(python_4.geometry)
draw_8 = Draw(cg=python_3.lines)  # -> rg; same code as draw
cull_i = CullIndex(Indices=Slider(1, range=0..1), Wrap=True)
dispatch = Dispatch(List=divide_2.Points, DispatchPattern=[True, False])  # -> ListA, ListB
dispatch_2 = Dispatch(List=divide_3.Points, DispatchPattern=[True, False])  # -> ListA, ListB
length = Slider(150, range=0..1000)
pt_4 = Point(dispatch_2.ListB)
pt_5 = Point(dispatch.ListA)
python_5 = GhPythonScript(module=python_4.module, height=Slider(95, range=0..1000), length=length)  # -> assembly, geometry, frames; inputs module: list
# ---------- python_5: Python ----------
from compas.geometry import Polygon, Frame, Vector, Scale, Translation, Point, Polyhedron
import math
from compas_ghpython.utilities import unload_modules
import copy

from compas.datastructures import Assembly
from compas.datastructures import Part
from compas import json_dump

import sys
import os

#get current file path
path = ghenv.Component.OnPingDocument().FilePath
#get parent directory of the parent directory
parentdir = os.path.dirname(path)
#get src folder which contains classes
dire = os.path.join(parentdir,'scripts')

sys.path.append(dire)

unload_modules('stick')
unload_modules('stickmodules')
unload_modules('helpers')
from stick import Stick
from stickmodules import RStickModule
from helpers import sort_sticks_by_z



stick_assembly = []

#create a rotated module on top of the first one

module0 = RStickModule.from_stick_module(module)
module1 = module0.copy()
module1.move(Vector(0,0,height))
module1.rotate(math.pi/12)
module1.generate_stick_frames()

#add sticks to list

stick_assembly.extend(module0.sticks)
stick_assembly.extend(module1.sticks)

#create sticks between layers
for i,(a,b) in enumerate(zip(module0.sticks, module1.sticks)):
    c0s0 = a
    c0s1 = module0.sticks[(i+1)%len(module0.sticks)]
    c1s0 = b
    c1s1 = module1.sticks[(i+1)%len(module1.sticks)]
    stick = Stick.from_two_corners(c0s0,c0s1,c1s0,c1s1,length = 150)
    stick_assembly.append(stick)
#sort_sticks_by_z

stick_assembly = sort_sticks_by_z(stick_assembly)


assembly = Assembly()

#generate data for assembly
for stick in stick_assembly:
    stick_frame = stick.frame #generate a frame for stick
    stick_geo = Polyhedron(*stick.geometry.to_vertices_and_faces(triangulated=True))
    part = Part(shape = stick_geo, frame = stick_frame, line = stick.axis, midpoint = stick.axis.midpoint)
    assembly.add_part(part)

geometry = [part.shape for part in assembly.parts()]
frames = [part.frame for part in assembly.parts()]
# ---------- end python_5 ----------
weave = Weave(Pattern=[0, 1], Stream0=pt_5, Stream1=pt_4, NullGaps=False)
pline = PolyLine(Vertices=weave, Closed=True)
draw_9 = Draw(cg=python_5.geometry)  # -> rg; same code as draw
panel_3 = Panel(cull_i)
python_6 = GhPythonScript(assembly=python_5.assembly, save=Button())  # -> connections, a
# ---------- python_6: Python ----------
from compas import json_dump
import os, sys
from itertools import combinations
from compas_rhino import unload_modules
from compas.geometry import Line

#get current file path
path = ghenv.Component.OnPingDocument().FilePath
#get parent directory of the parent directory
parentdir = os.path.dirname(path)
#get src folder which contains classes
dire = os.path.join(parentdir,'scripts')

sys.path.append(dire)

unload_modules('helpers')
from helpers import shortest_distance

json_path = os.path.join(parentdir, 'data', 'stick_assembly.json')

tolerance = 4.1
connections = []

#generate connections between parts(optional)
for a,b in combinations(assembly.parts(),2):
    linea = a.attributes["line"]
    lineb = b.attributes["line"]
    if shortest_distance(linea, lineb) < tolerance:
        assembly.add_connection(a,b)
        mid_a = a.attributes["midpoint"]
        mid_b = b.attributes["midpoint"]
        connections.append(Line(mid_a, mid_b))
if save:
    json_dump({'assembly': assembly}, fp = json_path, pretty = True)
# ---------- end python_6 ----------
draw_10 = Draw(cg=python_6.connections)  # -> rg; same code as draw
python_7 = GhPythonScript(
    length_stick=Slider(100, range=0..100),
    num_sticks=Slider(5, range=0..10),
    engagement_length=Slider(65.8, range=0..250),
    angle=Slider(0, range=0..1),
    height=Slider(1000, range=500..2000))  # -> out, base_polygon, pts_base, newpt, geometry, lines, lines_poly, lines_on_poly, module; inputs num_sticks: Int32
# ---------- python_7: Python ----------
import compas.geometry as cg
from compas.geometry import  Polygon, Frame, Vector, Scale, Plane, Point, Line
import math
from compas_ghpython.utilities import unload_modules
import sys
import os
import copy
import ghpythonlib.treehelpers as th

#get current file path
path = ghenv.Component.OnPingDocument().FilePath
#get parent directory of the parent directory
parentdir = os.path.dirname(path)
#get src folder which contains classes
dire = os.path.join(parentdir,'scripts')

sys.path.append(dire)

unload_modules('stick')
from stick import Stick

def create_polygon(sides, side_length):
    polygon = Polygon.from_sides_and_radius_xy(sides, 1)
    T = Scale.from_factors([side_length/(polygon.length/sides)]*3)
    p = polygon.transformed(T)
    return p.lines
    

def get_eccentricities(sticks):
    e_lines = []
    for i in range(len(sticks)):
        stick1 = sticks[i]
        stick2 = sticks[(i+1) % len(sticks)]
        e_line = stick1.eccentricity(stick2)
        e_lines.append(e_line)
    return e_lines, e_line.length


base_polygon = create_polygon(num_sticks, engagement_length)
top_polygon = copy.deepcopy(base_polygon)


pts_base = []
pts_top = []
for ln in base_polygon:
    pt = ln.start
    pts_base.append(pt)
    pts_top.append(pt)



T = cg.translate_points(pts_top, Vector(0,0,height))
newpt = [Point(i[0],i[1],i[2]) for i in T]


lines = []
for i,pt_start in enumerate(pts_base):
    distance = pt_start.distance_to_point(newpt[i])
    no_sticks = int(distance/length_stick)
    for l in range(no_sticks):
        if l%2 == 0:
            line = cg.Line([pt_start.x,pt_start.y,l*length_stick],[newpt[i].x+length_stick/2,newpt[i].y,(l*length_stick)+length_stick])
    #        T3 = cg.Rotation.from_axis_and_angle(Vector(start_pt_new.x,start_pt_new.y+l,l*line_height+1),math.radians(angle))
    #        line.transform(T3)
            lines.append(line)
        else:
            line = cg.Line([(newpt[i].x),newpt[i].y,(l*length_stick)+length_stick],[pt_start.x+length_stick/2,pt_start.y,l*length_stick])
            lines.append(line)







#start_pt = Point(0,0,0)
#point1 = Point(0,0,1000)
#dist = start_pt.distance_to_point(point1)
#
#line_vector = Vector.from_start_end(start_pt ,point1)
#direction = Vector.unitized(line_vector)
#line_height = length_stick  #*math.sin(math.radians(angle))-10
#no_sticks = int(dist/line_height)
#
#
#lines = []
#
#for l in range(no_sticks):
#    if l%2 == 0:
#        start_pt_new =Point(start_pt.x,start_pt.y,l*line_height) 
#        line = cg.Line([0,0,l*length_stick],[length_stick/2,0,(l*length_stick)+length_stick])
##        T3 = cg.Rotation.from_axis_and_angle(Vector(start_pt_new.x,start_pt_new.y+l,l*line_height+1),math.radians(angle))
##        line.transform(T3)
#        lines.append(line)
#    else:
#        line = cg.Line([(length_stick/2),0,(l*length_stick)-length_stick*2],[0,0,(l*length_stick)-length_stick])
#        if l == 1:
#            pass
##        T3 = cg.Rotation.from_axis_and_angle(Vector(start_pt_new.x,start_pt_new.y+l,l*line_height+1),math.radians(angle))
##        line.transform(T3)
#        lines.append(line)
#
#
module = []
for lin in lines:
        # initiate Stick
        stick = Stick(lin)
    #    Stick.rotate_stick(stick,angle)
        module.append(stick)




#sticks = []
#for i, ln in enumerate(lines):
#    if i != len(lines)-1:
#        stick1 = Stick(ln)
#        stick2 = Stick(lines[i+1])
#        new_stick = Stick.from_two_sticks(stick1,stick2,0.9,0.1,length_stick)
#        sticks.append(stick1.geometry)
#        sticks.append(new_stick.geometry)

geometry = [stick.geometry for stick in module]
# ---------- end python_7 ----------
draw_11 = Draw(cg=python_7.base_polygon)  # -> rg; same code as draw
draw_12 = Draw(cg=python_7.pts_base)  # -> rg; same code as draw
draw_13 = Draw(cg=python_7.geometry)  # -> rg; same code as draw
draw_14 = Draw(cg=python_7.lines_poly)  # -> rg; same code as draw
draw_15 = Draw(cg=python_7.newpt)  # -> rg; same code as draw
draw_16 = Draw(cg=python_7.lines)  # -> rg; same code as draw
panel_4 = Panel(python_7.module)
